# Grasshopper definition robot_playground_abb_animation.ghx (Grasshopper 1.0.7)
# plug-ins: Firefly.Core

# ---- group: ROS client
# Robot
panel = Panel("127.0.0.1")
disconnect = Button()
connect = Button()
restart = Button()
ros = PythonScript(ip=panel, restart=restart)  # -> out, ros_client
# ---------- ros: Python ----------
import sys
import time
import logging
import scriptcontext as sc

from compas_fab.backends import RosClient

from System import TimeSpan
from System.Threading import ManualResetEventSlim

LOGGER = logging.getLogger('roslibpy')

key = 'rosclient_%s' % str(ghenv.Component.InstanceGuid)
previous_client = sc.sticky.get(key, None)
if previous_client:
    previous_client.terminate()

ros_client = RosClient(ip, 9090)
sc.sticky[key] = ros_client

waitLock = ManualResetEventSlim(False)

ros_client.on_ready(lambda: waitLock.Set())

if not waitLock.Wait(TimeSpan.FromSeconds(5)):
    raise Exception('Unable to connect to ROS')

LOGGER.info('ROS connection opened')
# ---------- end ros ----------
connect_2 = PythonScript(ros_client=ros.ros_client, connect=connect, disconnect=disconnect)  # -> out, ros_client
# ---------- connect_2: Python ----------
import logging
from System import TimeSpan
from System.Threading import ManualResetEventSlim

LOGGER = logging.getLogger('roslibpy')

if connect:
    if not ros_client.is_connected:
        LOGGER.debug('Connecting...')
        waitLock = ManualResetEventSlim(False)
        ros_client.on_ready(lambda: waitLock.Set())
        ros_client.connect()

        if not waitLock.Wait(TimeSpan.FromSeconds(5)):
            raise Exception('Unable to connect to ROS')
        LOGGER.debug('Reconnected')

if disconnect:
    if ros_client.is_connected:
        ros_client.terminate()
        LOGGER.debug('Terminated')

print ros_client.is_connected
# ---------- end connect_2 ----------
is_connected = Panel(connect_2.out)

# ----
# Load robot directly from ROS
# (only working if connected and file_server launched)
units = ValueList({"m": 1, "cm": 100, "mm": 1000}, selected="mm")
units_2 = ValueList({"m": 1, "cm": 100, "mm": 1000}, selected="mm")
panel_2 = Panel("Load example UR5 robot")
load = Button()
load_2 = Button()
create = PythonScript(scale_factor=units, load=load)  # -> robot
# ---------- create: Python ----------
import os
from scriptcontext import sticky as st

import compas
from compas_fab.robots.ur5 import Robot
from compas_ghpython.artists import RobotModelArtist

compas.PRECISION = '12f'

# store robot in component
guid = str(ghenv.Component.InstanceGuid)
robot_key = "robot_" + guid

if robot_key not in st:
    st[robot_key] = None

if load:
    robot = Robot(load_geometry=True)
    robot.artist = RobotModelArtist(robot.model)
    st[robot_key] = robot
    robot.scale(scale_factor)

robot = st[robot_key]
# ---------- end create ----------
python = PythonScript(client=connect_2.ros_client, scale_factor=units_2, load=load_2)  # -> out, robot; inputs load: Boolean
# ---------- python: Python ----------
import os
from scriptcontext import sticky as st
import compas
import compas_fab
from compas.robots import RobotModel
from compas_fab.backends import RosClient
from compas_fab.backends import RosFileServerLoader
from compas_fab.robots import Robot
from compas_fab.robots import RobotSemantics
from compas_ghpython.artists import RobotModelArtist

# Set high precision to import meshes defined in meters
compas.PRECISION = '24f'

# store robot in component
guid = str(ghenv.Component.InstanceGuid)
robot_key = "robot_" + guid

if robot_key not in st:
    st[robot_key] = None

if client and client.is_connected and load:
    # Load URDF from ROS
    loader = RosFileServerLoader(client)
    urdf = loader.load_urdf()
    srdf = loader.load_srdf()

    # Create robot model from URDF and load geometry
    model = RobotModel.from_urdf_string(urdf)
    model.load_geometry(loader)
    
#### new #################
#    robot = client.load_robot()
#    robot.info()
#
#    assert robot.name == 'abb_irb120_3_58'
##########################
    semantics = RobotSemantics.from_srdf_string(srdf, model)

    robot = Robot(model, semantics=semantics)

    robot.artist = RobotModelArtist(robot.model)
    robot.scale(scale_factor)
    st[robot_key] = robot

robot = st[robot_key]
if robot:
    robot.client = client
    
    
    
#with RosClient() as client:
#    urdf = compas_fab.get('universal_robot/ur_description/urdf/ur5.urdf')
#    model = RobotModel.from_urdf_file(urdf)
#    robot = Robot(model, client=client)
#
#    robot.info()
#
#    assert robot.name == 'ur5'
# ---------- end python ----------
list = ValueList({"use from ROS": 0, "use example UR5": 1}, selected="use from ROS")
set = PythonScript(robot=create, client=connect_2.ros_client)  # -> robot
# ---------- set: Python ----------
if robot and client:
    robot.client = client
# ---------- end set ----------
filter = StreamFilter(Gate=list, Stream0=python.robot, Stream1=set)
robot = Data(filter)

# ----
# Planning scene
# Pass collision objects to planning scene
# Select the links the object is allowed to touch
scene = PythonScript(robot=robot)  # -> scene
# ---------- scene: Python ----------
from scriptcontext import sticky as st

from compas_fab.robots import PlanningScene

# store scene in component
guid = str(ghenv.Component.InstanceGuid)
scene_key = "scene_" + guid

if scene_key not in st:
    st[scene_key] = None

if robot:
    st[scene_key] = PlanningScene(robot)

scene = st[scene_key]
# ---------- end scene ----------
idxs = Data([3, 4, 5, 6, 7])
py = PythonScript(robot=robot, idxs=idxs)  # -> touch_links; inputs idxs: list of Int32
# ---------- py: Python ----------
if robot:
    link_names = robot.get_link_names()
    touch_links = [link_names[i] for i in idxs]
# ---------- end py ----------
panel_3 = Panel(py)

# ----
# Attach an collision object
# Select link name to attach
yz = YZPlane(Origin=Point(0, 0, 0))
cone = Cone(Base=yz, Radius=35, Length=100)  # -> Cone, Tip
mesh = Mesh(cone.Cone)
mesh_2 = PythonScript(mesh=mesh)  # -> compas_mesh
# ---------- mesh_2: Python ----------
from compas.datastructures import Mesh
from compas_rhino.geometry import RhinoMesh

compas_mesh = RhinoMesh.from_guid(mesh).to_compas()
# ---------- end mesh_2 ----------
py_2 = PythonScript(robot=robot, idx=Slider(7, range=0..7))  # -> link_name; inputs idx: Int32
# ---------- py_2: Python ----------
if robot:
    link_names = robot.get_link_names()
    link_name = link_names[idx]
# ---------- end py_2 ----------
panel_4 = Panel(py_2)
remove = Button()
scale = BooleanToggle(False)
add = Button()
attached = PythonScript(scene=scene, compas_mesh=mesh_2, scale=scale, id="tip", link_name=py_2, touch_links=py, add=add, remove=remove)  # -> acm, out; inputs touch_links: list
# ---------- attached: Python ----------
from compas_fab.robots import CollisionMesh
from compas_fab.robots import AttachedCollisionMesh

cm = CollisionMesh(compas_mesh, id)
acm = AttachedCollisionMesh(cm, link_name, touch_links)

if scene:
    if add:
        scene.add_attached_collision_mesh(acm, scale)
    if remove:
        scene.remove_attached_collision_mesh(id)
        scene.remove_collision_mesh(id)
# ---------- end attached ----------

panel_5 = Panel("Define an obstacle")
brep = Brep(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)
mesh_3 = Mesh(brep)
preview = CustomPreview(Geometry=brep, Shader=ColourSwatch(SwatchColor=RGB(255, 255, 255)))
mesh_4 = PythonScript(mesh=mesh_3)  # -> compas_mesh; same code as mesh_2
remove_2 = Button()
scale_2 = BooleanToggle(False)
add_2 = Button()
collision = PythonScript(scene=scene, compas_mesh=mesh_4, scale=scale_2, id="box", add=add_2, remove=remove_2)  # -> out
# ---------- collision: Python ----------
from compas_fab.robots import CollisionMesh

cm = CollisionMesh(compas_mesh, id)

if scene:
    if add:
        scene.add_collision_mesh(cm, scale)
    if remove:
        scene.remove_collision_mesh(id)
# ---------- end collision ----------
panel_6 = Panel(collision)

open_port = OpenClosePort(OpenClosePort=Toggle(True), PortNumber="7", BaudRate="115200")
panel_7 = Panel(open_port)

# ---- group: dont forget to start the timer
timer = Timer(TimerInterval=50, Target=uno_read)  # disabled

# ----
# Info
info = PythonScript(robot=robot)  # -> out, main_group_name
# ---------- info: Python ----------
if robot:
    robot.info()
    main_group_name = robot.main_group_name
# ---------- end info ----------
panel_8 = Panel(info.out)

uno_read = UnoRead(StartReadingValues=Toggle(True), PortNumber="7")  # -> AnalogPin0, AnalogPin1, AnalogPin2, AnalogPin3, AnalogPin4, AnalogPin5, DigitalPin2, DigitalPin4, DigitalPin7, StatusMessage
panel_9 = Panel(uno_read.AnalogPin0)
panel_10 = Panel(uno_read.StatusMessage)

# ----
# Tool definition
list_2 = ValueList({"Flip": 0, "No Flip": 1}, selected="Flip")
crv = Curve(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)
pt = Point(Point(0, 0, 73.52667469))
crv_2 = Curve(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)
geo = Geometry(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)
pl = ConstructPlane(Origin=pt, XAxis=crv_2, YAxis=crv)
mesh_5 = MeshBrep(
    Brep=geo,
    Settings={GridMaxCount=0, GridMinCount=16, JaggedSeams=False, MaxEdgeLength=0, MinEdgeLength=0.0001, MinTolerance=0, Refine=True, RefineAngle=0, RelativeTolerance=0.65, SimplePlanes=True, Tolerance=0})

cluster = Cluster(G_2=mesh_5, G=pl, B=pl, G_4=list_2, _1=mesh_5, G_3=list_2)  # -> P, s_0, s_0_2

# ---- group: remap sensor value to smth meaningful
dom = ConstructDomain(DomainStart="-170", DomainEnd="170")
dom_2 = ConstructDomain(DomainStart="0", DomainEnd="1023")
remap = RemapNumbers(Value=uno_read.AnalogPin0, Source=dom_2, Target=dom)  # -> Mapped, Clipped

# ----
# Input plane generation
crv_3 = Curve(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)
pframes = PerpFrames(Curve=crv_3, Count=30, Align=True)  # -> Frames, Parameters
pln = Plane(pframes.Frames)

main_planning_group = Text(info.main_group_name)
data = Data(remap.Mapped)
# Configuration
panel_11 = Panel(data)
orient = Orient(Geometry=cluster.s_0_2, Source=cluster.P, Target=pln)  # -> Geometry, Transform

# ---- group: forward kinematics
a1 = Slider(0, range=-360..360)
a4 = Slider(0, range=-360..360)
a5 = Slider(0, range=-360..360)
a6 = Slider(0, range=-360..360)
a2 = Slider(30, range=-360..360)
a3 = Slider(0, range=-360..360)
set_joint_positions = BooleanToggle(False)
jp = GhPythonScript()  # -> joint_positions
# ---------- jp: Python ----------
import math
joint_positions = [-3.136, -0.328, -1.218, 3.129, 0.852, 0.008]
joint_positions = [0] * 6
print joint_positions
# ---------- end jp ----------
forward_kinematics = PythonScript(robot=robot, set_joint_positions=set_joint_positions, joint_positions=jp, a1=a1, a2=a2, a3=a3, a4=a4, a5=a5, a6=a6)  # -> full_configuration, joint_positions, joint_positions_send; inputs joint_positions: list
# ---------- forward_kinematics: Python ----------
import math
import Grasshopper
from compas.robots import Joint
from compas_fab.robots import Configuration

if set_joint_positions:

    j = 0
    for i in range(ghenv.Component.Params.Input.Count):
        nslider = ghenv.Component.Params.Input[i].Sources[0]
        if nslider.GetType() == Grasshopper.Kernel.Special.GH_NumberSlider:
            nslider.TrySetSliderValue(math.degrees(joint_positions[j]))
            j += 1

if robot:
    joint_positions = [a1, a2, a3, a4, a5, a6]
    joint_positions_send = [a1, a2, a3, a4, a5, a6]
    joint_types = robot.get_configurable_joint_types()
    for i, joint_type in enumerate(joint_types):
        if joint_type == Joint.REVOLUTE:
            joint_positions[i] = math.radians(joint_positions[i])
    full_configuration = Configuration(joint_positions, joint_types)
    print full_configuration
# ---------- end forward_kinematics ----------

# ----
start_configuration = Data(forward_kinematics.full_configuration)
avoid_collisions = BooleanToggle(False)
inverse = GhPythonScript(
    reset=Button(),
    robot=robot,
    group=main_planning_group,
    planes=orient.Geometry,
    start_configuration=start_configuration,
    avoid_collisions=avoid_collisions,
    index=Slider(0, range=0..30))  # -> out, group_configuration, full_configuration, frame, frames; inputs planes: list, index: Int32
# ---------- inverse: Python ----------
"""Calculate the robot's inverse kinematic for a given plane.
    Inputs:
        robot: The robot
        group: str, optional
            The planning group used for calculation. Defaults to the robot's
            main planning group.
        plane: The plane in world coordinate frame to calculate the inverse for.
        start_configuration: :class:`compas_fab.robots.Configuration`, optional
            If passed, the inverse will be calculated such that the calculated
            joint positions differ the least from the start_configuration.
            Defaults to the zero configuration.
        avoid_collisions: bool, optional
            Whether or not to avoid collisions. Defaults to True.
    Output:
        group_configuration: The group configuration
        full_configuration: The full configuration
"""
from __future__ import print_function
import logging

from compas.geometry import Frame
from scriptcontext import sticky

if "start_conf" not in sticky:
    sticky["start_conf"] = start_configuration
if reset:
    sticky["start_conf"] = start_configuration
#if index == 0:
#    sticky["start_conf"] = start_configuration
    

LOGGER = logging.getLogger('roslibpy')

plane = planes[index]
frame = Frame(plane.Origin, plane.XAxis, plane.YAxis)
frames = [frame, Frame(plane.Origin, plane.XAxis, plane.YAxis)]
full_configuration = []
start_conf = sticky["start_conf"]
if robot and robot.client:
    if robot.client.is_connected:
        for frame in frames:
            full_configuration.append(robot.inverse_kinematics(frame,
                                                          start_configuration=start_conf,
                                                          group=group,
                                                          return_full_configuration=True,
                                                          options={
                                                            'avoid_collisions':avoid_collisions,
                                                          }))
            if full_configuration:
                sticky["start_conf"] = full_configuration[0]
                
        print(group_configuration)
        
    else:
        print("Robot client is not connected")
# ---------- end inverse ----------

start_configuration_2 = Data(forward_kinematics.full_configuration)
avoid_collisions_2 = BooleanToggle(False)
inverse_2 = GhPythonScript(
    reset=Button(),
    run=Toggle(False),
    robot=robot,
    group=main_planning_group,
    planes=orient.Geometry,
    start_configuration=start_configuration_2,
    avoid_collisions=avoid_collisions_2)  # -> out, group_configuration, full_configuration, frame, frames; inputs planes: list
# ---------- inverse_2: Python ----------
"""Calculate the robot's inverse kinematic for a given plane.
    Inputs:
        robot: The robot
        group: str, optional
            The planning group used for calculation. Defaults to the robot's
            main planning group.
        plane: The plane in world coordinate frame to calculate the inverse for.
        start_configuration: :class:`compas_fab.robots.Configuration`, optional
            If passed, the inverse will be calculated such that the calculated
            joint positions differ the least from the start_configuration.
            Defaults to the zero configuration.
        avoid_collisions: bool, optional
            Whether or not to avoid collisions. Defaults to True.
    Output:
        group_configuration: The group configuration
        full_configuration: The full configuration
"""
from __future__ import print_function
import logging

from compas.geometry import Frame
from scriptcontext import sticky

if "start_conf" not in sticky:
    sticky["start_conf"] = start_configuration
if "count" not in sticky:
    sticky["count"] = 0
if sticky["count"] > len(planes):
    sticky["count"] = 0
if sticky["count"] == 0:
    sticky["start_conf"] = start_configuration

if reset:
#    sticky["start_conf"] = start_configuration
    sticky["count"] = 0
    
LOGGER = logging.getLogger('roslibpy')

count = sticky["count"]
plane = planes[count]
frame = Frame(plane.Origin, plane.XAxis, plane.YAxis)
frames = [frame, Frame(plane.Origin, plane.XAxis, plane.YAxis)]
full_configuration = []
start_conf = sticky["start_conf"]
if run:
    if robot and robot.client:
        if robot.client.is_connected:
            for frame in frames:
                full_configuration.append(robot.inverse_kinematics(frame,
                                                              start_configuration=start_conf,
                                                              group=group,
                                                              return_full_configuration=True,
                                                              options={
                                                                'avoid_collisions':avoid_collisions,
                                                              }))
                if full_configuration:
                    sticky["start_conf"] = full_configuration[0]
                    sticky["count"]+=1
            print(group_configuration)
            
        else:
            print("Robot client is not connected")
else:
    full_configuration = sticky["start_conf"]
# ---------- end inverse_2 ----------
timer_2 = Timer(TimerInterval=50, Target=inverse_2)

panel_12 = Panel(forward_kinematics.full_configuration)
panel_13 = Panel(forward_kinematics.joint_positions)

# ---- group: forward kinematics
forward = PythonScript(robot=robot, group=main_planning_group, full_configuration=forward_kinematics.full_configuration)  # -> out, frame_WCF
# ---------- forward: Python ----------
"""Calculate the robot's forward kinematic.
    Inputs:
        robot: :class:`compas_fab.robots.Robot`
            The robot.
        group: str, optional
            The planning group used for calculation. Defaults to the robot's
            main planning group.
        full_configuration : :class:`compas_fab.robots.Configuration`
            The full configuration to calculate the forward kinematic for. If no
            full configuration is passed, the zero-joint state for the other
            configurable joints is assumed.
    Output:
        :class:`Frame`
            The frame in the world coordinate frame (WCF).
"""
from __future__ import print_function
import logging

LOGGER = logging.getLogger('roslibpy')

if robot and robot.client and full_configuration:
    if robot.client.is_connected:
        frame_WCF = robot.forward_kinematics(full_configuration, group, options={'solver':'model'})
        print(frame_WCF)
    else:
        print("Robot is not connected")
# ---------- end forward ----------
panel_14 = Panel(forward.out)

# ----
list_3 = ValueList({"foward_kinematics": 0, "inverse": 1, "inverse step": 2}, selected="foward_kinematics")
filter_2 = StreamFilter(
    Gate=list_3,
    Stream0=forward_kinematics.full_configuration,
    Stream1=inverse_2.full_configuration,
    Stream2=inverse.full_configuration)

# ----
# Visualisation
# Select configuration input: from fk, ik, path, or from real robot
data_2 = Data(info.main_group_name)
show_end_effector_frame = BooleanToggle(True)
show_base_frame = BooleanToggle(True)
show_collision = BooleanToggle(False)
show_frames = BooleanToggle(False)
show_visual = BooleanToggle(True)
visualize = PythonScript(
    robot=robot,
    group=data_2,
    full_configuration=filter_2,
    int_configuration=Slider(0, range=0..1),
    show_visual=show_visual,
    show_collision=show_collision,
    show_frames=show_frames,
    show_base_frame=show_base_frame,
    show_end_effector_frame=show_end_effector_frame)  # -> out, visual, collision, frames, base_frame_WCF, ee_frame_WCF, ee_plane; inputs full_configuration: list, int_configuration: Int32
# ---------- visualize: Python ----------
"""Calculates a cartesian motion path (linear in tool space).
    Inputs:
        robot: The robot
        group: str
            The planning group used for visualisation
        full_configuration: :class:`compas_fab.robots.Configuration`
            The robot's full configuration to display.
        show_visual: bool
           Whether or not to show the robot's visual meshes.
        show_collision: bool
           Whether or not to show the robot's collision meshes.
        show_frames: bool
           Whether or not to show the robot's joint frames.
        show_base_frame: bool
           Whether or not to show the robot's base frame.
        show_end_effector_frame: bool
            Whether or not to show the robot's end-effector frame.
    Output:
        visual: The robot's visual meshes.
        collision: The robot's collision meshes.
        frames: The robot's joint frames.
        base_frame_WCF: The robot's base frame.
        ee_frame_WCF: The robot's end-effector frame.
"""
from __future__ import print_function
full_configuration = full_configuration[int_configuration]
import compas_ghpython as cgh

if robot and full_configuration:
    robot.update(full_configuration, group=group, visual=show_visual, collision=show_collision)

    print(full_configuration)

    if show_visual:
        visual = robot.draw_visual()

    if show_collision:
        collision = robot.draw_collision()

    if show_frames:
        axes = robot.transformed_axes(full_configuration)
        frames = robot.transformed_frames(full_configuration)

    if show_base_frame:
        base_frame_WCF = robot.get_base_frame(group, full_configuration)

    if show_end_effector_frame:
        ee_frame_WCF = robot.get_end_effector_frame(group, full_configuration)
        print("End-effector", ee_frame_WCF)
        
        ee_plane = cgh.draw_frame(ee_frame_WCF)
# ---------- end visualize ----------
panel_15 = Panel(visualize.out)
geo_2 = Geometry(visualize.visual)
geo_3 = Geometry(visualize.collision)
py_3 = PythonScript(robot=robot)  # -> scale
# ---------- py_3: Python ----------
if robot:
    scale = robot.scale_factor * 0.1
else:
    scale = 1.
# ---------- end py_3 ----------
draw = GhPythonScript(frames=[visualize.frames, visualize.ee_frame_WCF, visualize.base_frame_WCF], scale=py_3)  # -> P, V, C, W; inputs frames: list
# ---------- draw: Python ----------
from System.Drawing import Color
from compas_ghpython import draw_frame

red = Color.FromArgb(255, 0, 0)
green = Color.FromArgb(0, 255, 0)
blue = Color.FromArgb(0, 0, 255)

P = []
V = []
C = []

scale = float(scale)

for frame in frames:
    if not frame:
        continue
    plane = draw_frame(frame)
    P += [plane.Origin] * 3
    V.append(plane.XAxis * scale)
    V.append(plane.YAxis * scale)
    V.append(plane.ZAxis * scale)
    C += [red, green, blue]

W = 3
# ---------- end draw ----------
vdisex = VectorDisplayEx(Point=draw.P, Vector=draw.V, Colour=draw.C, Width=draw.W)
pln_2 = Plane(visualize.ee_plane)
geo_4 = Geometry(cluster.s_0)
orient_2 = Orient(Geometry=geo_4, Source=cluster.P, Target=pln_2)  # -> Geometry, Transform
preview_2 = CustomPreview(Geometry=geo_2, Shader=ColourSwatch(SwatchColor=RGBA(0, 0, 0, 219)))
preview_3 = CustomPreview(Geometry=orient_2.Geometry, Shader=ColourSwatch(SwatchColor=RGBA(20, 156, 255, 120)))

# ----
# Communication
reload = Button()
init = Button()
py_4 = PythonScript(reload=reload)
# ---------- py_4: Python ----------
from compas_rhino.utilities.misc import get_tolerance
from compas_rhino.utilities.misc import unload_modules

from compas_ghpython import unload_modules
unload_modules("compas")
unload_modules("compas_fab")
unload_modules("roslibpy")
unload_modules("abb_communication")
# ---------- end py_4 ----------
list_4 = ValueList({"192.168.0.102", "192.168.0.103", "127.0.0.1"}, selected="127.0.0.1")
refresh_text_window = Button()
list_5 = ValueList({"tool 0": "0", "robotic_lacing_pneumatic": "1", "robotic_lacing_electric": "2"}, selected="tool 0")
reset_robot = Button()
r_on = Button()
r_off = Button()
list_6 = ValueList({"robotic_lacing_wobj": 10}, selected="robotic_lacing_wobj")
update_settings = Button()
list_7 = ValueList({"fast": 0, "mid": 1, "slow": 2}, selected="slow")
send_frames = Button()
send_frame = Button()
send_joints = Button()
python_2 = GhPythonScript(ip_abb=list_4, init=init)  # -> out, communication
# ---------- python_2: Python ----------
from scriptcontext import sticky as st
from abb_communication.clients.rfl_robot.communication import ABBCommunication
from compas_rhino.utilities.misc import unload_modules
from compas_ghpython import unload_modules

unload_modules("abb_communication")

communication = ABBCommunication("ABB", ip_abb, port_snd = 30003, port_rcv=30004)
#st["communication"] = communication
# ---------- end python_2 ----------
if_connection = PythonScript(
    init=init,
    communication=python_2.communication,
    ip_abb=list_4,
    connect_robot=r_on,
    close_robot=r_off,
    refresh=refresh_text_window,
    reset_robot=reset_robot)  # -> out, communication; inputs connect_robot: Boolean, close_robot: Boolean, refresh: Boolean
# ---------- if_connection: Python ----------
import Rhino.Geometry as rg
from compas.geometry import Frame
from abb_communication.geometry import Frame as F
from scriptcontext import sticky as st
from abb_communication.clients.rfl_robot.communication.messages.clientstates import *
from abb_communication.clients.rfl_robot.communication import ABBCommunication


#communication = ABBCommunication("ABB", ip_abb, port_snd = 30003, port_rcv=30004)
#st["communication"] = communication

#communication = st["communication"]

print communication.running

# =========================================================================================    
if connect_robot == True:
    if communication.running == False:
       communication.start()
    else:
        pass

# =========================================================================================    
if close_robot == True:
    if communication.running == True:
        communication.close()
        communication.cmd_counter_to_client = 0
        communication.cmd_exec_counter_from_client = 0
        
        communication.publish_state(1)
    else:
        pass

if reset_robot:
    communication.close()
    communication.cmd_counter_to_client = 0
    communication.cmd_exec_counter_from_client = 0
    communication.publish_state(1)
    try:
        communication.start()
    except:
        print "CONNECTION TO ABB FAILED"



robot_conncection_state = "online" if communication.running else "offline"
print "ABB CONNECTION STATE:", robot_conncection_state
print "ABB STATE: ", client_states_str_array[communication.state]
print "Sent commands to ABB: ",  communication.get_cmd_counter()
print "Executed commands from ABB: ",  communication.cmd_exec_counter_from_client
# ---------- end if_connection ----------
update_sender = PythonScript(
    init=init,
    communication=if_connection.communication,
    update_settings=update_settings,
    speed=list_7,
    tool_num=list_5,
    wobj_num=list_6,
    rob_num=Slider(1, range=0..10))  # -> out, a; inputs tool_num: Int32
# ---------- update_sender: Python ----------
from abb_communication.clients.rfl_robot.communication.messages.messagetypes import *
import Rhino.Geometry as rg
from abb_communication.geometry import Frame
from scriptcontext import sticky as st
import math as m
from threading import Thread
import time


#communication = st["communication"]
#print joints_abb
if communication:    
    
    communication.float_arbitrary = rob_num
    if update_settings:
        if speed == 0:
            print "SET SPEED FAST"
            communication.set_speed_fast()
        if speed == 1:
            print "SET SPEED MID"
            communication.set_speed_mid()
        if speed == 2:
            print "SET SPEED SLOW"
            communication.set_speed_slow()
        if tool_num:
            communication.set_tool_to_num(tool_num)
        else:
            print "Provide to tool number"
        """
        if tool_num == 0:
            print "SET TOOL 0"
            communication.set_tool0()
        elif tool_num == 1:
            print "SET TOOL MESH MOULD"
            communication.set_tool_meshmould()
        elif tool_num == 6:
            print "SET TOOL MTIP"
            communication.set_tool_mtip()
        elif tool_num == 7:
            print "SET TOOL LWS GRIPPER"
            communication.set_tool_lws_gripper()
        elif tool_num == 8:
            print "SET TOOL STU GRIPPER"
            communication.set_tool_stu_gripper()
        elif tool_num == 10:
            print "SET TOOL MAS MAGAZINE"
            communication.set_tool_mas_magazine()
        else:
            print "WRONG TOOL NUM"
        """
        if wobj_num:
            communication.set_wobj_to_num(wobj_num)
        else:
            print "Provide a WOBJ number"

        """
        if wobj_num == 0:
            print "SET WOBJ 0"
            communication.set_wobj_0()
        elif wobj_num == 1:
            print "SET WOBJ LWS COMMON"
            communication.set_wobj_common()
        elif wobj_num == 2:
            print "SET WOBJ BASE"
            communication.set_wobj_base()
        elif wobj_num == 3:
            print "SET WOBJ STU PICK"
            communication.set_wobj_stu_pick()
        elif wobj_num == 4:
            print "SET WOBJ STU BASE"
            communication.set_wobj_stu_base()
        else:
            print "WRONG TOOL NUM"
           """
        if wobj_num:
            communication.set_rob_num(rob_num)
        else:
            print "Provide a WOBJ number"
    # =========================================================================================
    # =========================================================================================
    if communication.running:
        print "ROBOT IS ONLINE"
        # =====================================================================================     
    else:
        print "ROBOT IS OFFLINE"
# ---------- end update_sender ----------
testsend = GhPythonScript(
    communication=if_connection.communication,
    joint_positions=forward_kinematics.joint_positions_send,
    frame=inverse_2.frame,
    frames=inverse_2.frames,
    send_joints=send_joints,
    send_frame=send_frame,
    send_frames=send_frames,
    get_pose=Button())  # -> out, a; inputs joint_positions: list, frames: list
# ---------- testsend: Python ----------
from abb_communication.clients.rfl_robot.communication.messages.messagetypes import *
import Rhino.Geometry as rg
from compas.geometry import Frame as fr
from abb_communication.geometry import Frame
from scriptcontext import sticky as st
import math as m
from threading import Thread
import time

ext_axes = [0, 0, 0]

#print list_ext_axes

#communication = st["communication"]

pose = []

print joint_positions
if communication:        
    # =========================================================================================
    # =========================================================================================
    if communication.running:
        print "ROBOT IS ONLINE"
        if send_joints:
            joints_abb = joint_positions + [0,0,0]
            joints_abb_list = [float(x) for x in joints_abb]
            print joints_abb
            communication.send_axes_absolute(joints_abb_list, int_arr = None)
        if send_frame:
            communication.send_pose_cartesian(frame)
        if send_frames:
            communication.send_pose_cartesian_list(frames)
        if get_pose:
            pose = communication.get_current_pose_cartesian()
    else:
        print "ROBOT IS OFFLINE"
    
print "pose", pose
# ---------- end testsend ----------
panel_16 = Panel(if_connection.out)
panel_17 = Panel(update_sender.out)
panel_18 = Panel(testsend.out)

send_frames_2 = Button()
send_frame_2 = Button()
send_joints_2 = Button()
testsend_2 = GhPythonScript(
    run=Toggle(False),
    communication=if_connection.communication,
    joint_positions=forward_kinematics.joint_positions_send,
    frame=inverse_2.frame,
    frames=inverse_2.frames,
    send_joints=send_joints_2,
    send_frame=send_frame_2,
    send_frames=send_frames_2,
    get_pose=Button())  # -> out, a; inputs joint_positions: list, frames: list
# ---------- testsend_2: Python ----------
from abb_communication.clients.rfl_robot.communication.messages.messagetypes import *
import Rhino.Geometry as rg
from compas.geometry import Frame as fr
from abb_communication.geometry import Frame
from scriptcontext import sticky as st
import math as m
from threading import Thread
import time

ext_axes = [0, 0, 0]

#print list_ext_axes

#communication = st["communication"]

pose = []

if run:
#print joints_abb
    if communication:        
        # =========================================================================================
        # =========================================================================================
        if communication.running:
            print "ROBOT IS ONLINE"
            if send_joints:
                joints_abb = joint_positions + [0,0,0]
                joints_abb_list = [float(x) for x in joints_abb]
                print joints_abb
                communication.send_axes_absolute(joints_abb_list, int_arr = None)
            if send_frame:
                communication.send_pose_cartesian(frame)
            if send_frames:
                communication.send_pose_cartesian_list(frames)
            if get_pose:
                pose = communication.get_current_pose_cartesian()
        else:
            print "ROBOT IS OFFLINE"
    
#print "pose", pose
# ---------- end testsend_2 ----------

# ==== cluster Cluster
xy = XYPlane(Origin=Point(0, 0, 0))
yz = YZPlane(Origin=Point(0, 0, 0))
P = ClusterOutput(xy)
G = ClusterInput()
G_2 = ClusterInput()
orient = Orient(Geometry=G, Source=xy, Target=yz)  # -> Geometry, Transform
orient_2 = Orient(Geometry=G_2, Source=xy, Target=yz)  # -> Geometry, Transform
B = ClusterInput()
G_3 = ClusterInput()
G_4 = ClusterInput()
_1 = ClusterInput()
orient_3 = Orient(Source=xy, Target=orient.Geometry)  # -> Geometry, Transform
orient_4 = Orient(Source=xy, Target=B)  # -> Geometry, Transform
filter = StreamFilter(Gate=G_4, Stream0=orient_2.Geometry, Stream1=_1)
inverse = InverseTransform(Transform=orient_3.Transform)
inverse_2 = InverseTransform(Transform=orient_4.Transform)
s_0 = ClusterOutput(filter)
transform = Transform(Geometry=xy, Transform=inverse)
transform_2 = Transform(Geometry=xy, Transform=inverse_2)
filter_2 = StreamFilter(Gate=G_3, Stream0=transform, Stream1=transform_2)
s_0_2 = ClusterOutput(filter_2)
