# Grasshopper definition robot_playground_abb_arduino.ghx (Grasshopper 1.0.7)
# plug-ins: Firefly.Core

geo = Geometry(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)
pt = Point(Point(0, 0, 73.52667469))
crv = Curve(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)
crv_2 = Curve(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)

# ----
# Steps for connecting to the ABBs in the ECL
# https://github.com/createchaos/arc_574/blob/main/README.md
# 1. Turn on the robots
# 2. Use visual Studio Code to get Docker Running
# 3. Connect the robots to your computer
# 4. Ethernet settings
# 5. Use Anaconda Prompt to activate your environment.
# 6. Ping the robots to make sure you are connected
# 7. In grasshopper ROS section: restart, connect, load
# 8. On robot controller: PP to main, live button, press play
# 9. In grasshopper: init, R on, update settings
# 10. Send planes
restart = Button()
disconnect = Button()
connect = Button()
ros = PythonScript(ip="127.0.0.1", restart=restart)  # -> out, ros_client
# ---------- ros: Python ----------
import sys
import time
import logging
import scriptcontext as sc

from compas_fab.backends import RosClient

from System import TimeSpan
from System.Threading import ManualResetEventSlim

LOGGER = logging.getLogger('roslibpy')

key = 'rosclient_%s' % str(ghenv.Component.InstanceGuid)
previous_client = sc.sticky.get(key, None)
if previous_client:
    previous_client.terminate()

ros_client = RosClient(ip, 9090)
sc.sticky[key] = ros_client

waitLock = ManualResetEventSlim(False)

ros_client.on_ready(lambda: waitLock.Set())

if not waitLock.Wait(TimeSpan.FromSeconds(5)):
    raise Exception('Unable to connect to ROS')

LOGGER.info('ROS connection opened')
# ---------- end ros ----------
connect_2 = PythonScript(ros_client=ros.ros_client, connect=connect, disconnect=disconnect)  # -> out, ros_client
# ---------- connect_2: Python ----------
import logging
from System import TimeSpan
from System.Threading import ManualResetEventSlim

LOGGER = logging.getLogger('roslibpy')

if connect:
    if not ros_client.is_connected:
        LOGGER.debug('Connecting...')
        waitLock = ManualResetEventSlim(False)
        ros_client.on_ready(lambda: waitLock.Set())
        ros_client.connect()

        if not waitLock.Wait(TimeSpan.FromSeconds(5)):
            raise Exception('Unable to connect to ROS')
        LOGGER.debug('Reconnected')

if disconnect:
    if ros_client.is_connected:
        ros_client.terminate()
        LOGGER.debug('Terminated')

print ros_client.is_connected
# ---------- end connect_2 ----------
is_connected = Panel(connect_2.out)

# ----
# Load a robot from ROS
# (only will work if you have done steps 1-5)
# Load a UR5 example robot
units = ValueList({"m": 1, "cm": 100, "mm": 1000}, selected="mm")
units_2 = ValueList({"m": 1, "cm": 100, "mm": 1000}, selected="mm")
list = ValueList({"use from ROS": 0, "use example UR5": 1}, selected="use from ROS")
load = Button()
load_2 = Button()
create = PythonScript(scale_factor=units_2, load=load)  # -> robot
# ---------- create: Python ----------
import os
from scriptcontext import sticky as st

import compas
from compas_fab.robots.ur5 import Robot
from compas_ghpython.artists import RobotModelArtist

compas.PRECISION = '12f'

# store robot in component
guid = str(ghenv.Component.InstanceGuid)
robot_key = "robot_" + guid

if robot_key not in st:
    st[robot_key] = None

if load:
    robot = Robot(load_geometry=True)
    robot.artist = RobotModelArtist(robot.model)
    st[robot_key] = robot
    robot.scale(scale_factor)

robot = st[robot_key]
# ---------- end create ----------
python = PythonScript(client=connect_2.ros_client, scale_factor=units, load=load_2)  # -> out, robot; inputs load: Boolean
# ---------- python: Python ----------
import os
from scriptcontext import sticky as st
import compas
import compas_fab
from compas.robots import RobotModel
from compas_fab.backends import RosClient
from compas_fab.backends import RosFileServerLoader
from compas_fab.robots import Robot
from compas_fab.robots import RobotSemantics
from compas_ghpython.artists import RobotModelArtist

# Set high precision to import meshes defined in meters
compas.PRECISION = '24f'

# store robot in component
guid = str(ghenv.Component.InstanceGuid)
robot_key = "robot_" + guid

if robot_key not in st:
    st[robot_key] = None

if client and client.is_connected and load:
    # Load URDF from ROS
    loader = RosFileServerLoader(client)
    urdf = loader.load_urdf()
    srdf = loader.load_srdf()

    # Create robot model from URDF and load geometry
    model = RobotModel.from_urdf_string(urdf)
    model.load_geometry(loader)
    
#### new #################
#    robot = client.load_robot()
#    robot.info()
#
#    assert robot.name == 'abb_irb120_3_58'
##########################
    semantics = RobotSemantics.from_srdf_string(srdf, model)

    robot = Robot(model, semantics=semantics)

    robot.artist = RobotModelArtist(robot.model)
    robot.scale(scale_factor)
    st[robot_key] = robot

robot = st[robot_key]
if robot:
    robot.client = client
    
    
    
#with RosClient() as client:
#    urdf = compas_fab.get('universal_robot/ur_description/urdf/ur5.urdf')
#    model = RobotModel.from_urdf_file(urdf)
#    robot = Robot(model, client=client)
#
#    robot.info()
#
#    assert robot.name == 'ur5'
# ---------- end python ----------
set = PythonScript(robot=create, client=connect_2.ros_client)  # -> robot
# ---------- set: Python ----------
if robot and client:
    robot.client = client
# ---------- end set ----------
filter = StreamFilter(Gate=list, Stream0=python.robot, Stream1=set)
robot = Data(filter)

# ----
# Define a Tool
mesh = MeshBrep(
    Brep=geo,
    Settings={GridMaxCount=0, GridMinCount=16, JaggedSeams=False, MaxEdgeLength=0, MinEdgeLength=0.0001, MinTolerance=0, Refine=True, RefineAngle=0, RelativeTolerance=0.65, SimplePlanes=True, Tolerance=0})
pl = ConstructPlane(Origin=pt, XAxis=crv, YAxis=crv_2)
list_2 = ValueList({"Flip": 0, "No Flip": 1}, selected="Flip")
cluster = Cluster(G_2=mesh, G=pl, B=pl, G_4=list_2, _1=mesh, G_3=list_2)  # -> P_2, P, s_0, s_0_2, s_0_3

# ----
# Check to see
# which port you
# should use in
# the Arduino IDE
# under tools
panel = Panel("4")

# ----
# Toggle to open
# the serial port
# Double click to
# start timer
toggle = BooleanToggle(False)
open_port = OpenClosePort(OpenClosePort=toggle, PortNumber=panel, BaudRate="115200")
panel_2 = Panel(open_port)
timer = Timer(TimerInterval=50, Target=uno_read)  # disabled
uno_read = UnoRead(StartReadingValues=Toggle(False), PortNumber=panel)  # -> AnalogPin0, AnalogPin1, AnalogPin2, AnalogPin3, AnalogPin4, AnalogPin5, DigitalPin2, DigitalPin4, DigitalPin7, StatusMessage
panel_3 = Panel(uno_read.AnalogPin0)
panel_4 = Panel(uno_read.StatusMessage)

# ----
# Load Robot information from ROS
info = PythonScript(robot=robot)  # -> out, main_group_name
# ---------- info: Python ----------
if robot:
    robot.info()
    main_group_name = robot.main_group_name
# ---------- end info ----------
panel_5 = Panel(info.out)

# ----
# Simulate arduino using a slider
panel_6 = Panel("0")

# ----
# If there are no values coming from the Arduino
# (you are not connected), Grasshopper will use
# this slider as an input instead.  This is a great
# way to test if your script is working.
number_slider = Slider(26, range=0..100)
data = Data(number_slider)

# ----
# Remap sensor values
dom = ConstructDomain(DomainStart="-50", DomainEnd="50")
dom_2 = ConstructDomain(DomainStart=panel_6, DomainEnd="100")
remap = RemapNumbers(Value=data, Source=dom_2, Target=dom)  # -> Mapped, Clipped

# ----
# Remap sensor values
dom_3 = ConstructDomain(DomainStart="-50", DomainEnd="50")
dom_4 = ConstructDomain(DomainStart="40", DomainEnd="160")
remap_2 = RemapNumbers(Value=uno_read.AnalogPin0, Source=dom_4, Target=dom_3)  # -> Mapped, Clipped

# ----
# Arduino Input
python_2 = GhPythonScript(x=remap_2.Mapped, y=remap.Mapped)  # -> out, a
# ---------- python_2: Python ----------
__author__ = "parascho"
__version__ = "2021.03.13"

import rhinoscriptsyntax as rs

if x:
    a = x
else:
    a = y
# ---------- end python_2 ----------

# ----
# Generate Planes
# Example: Generate planes in grasshopper directly
# Generate planes along a
# curve drawn in Rhino
crv_3 = Curve(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)
pframes = PerpFrames(Curve=crv_3, Count=30, Align=True)  # -> Frames, Parameters
pln = Plane(pframes.Frames)

# ----
# Use slider to step through
# configurations
number_slider_2 = Slider(0, range=0..30)

a6 = Slider(0, range=-360..360)
a1 = Slider(0, range=-360..360)
a4 = Slider(0, range=-360..360)
a5 = Slider(0, range=-360..360)
a2 = Slider(0, range=-360..360)
a3 = Slider(0, range=-360..360)

# ----
# Reset
# Turn On
toggle_2 = BooleanToggle(False)

# ----
# Reset
# Turn On
toggle_3 = BooleanToggle(False)

# ----
# Turn timer on
# to continuously update
# configuration
timer_2 = Timer(TimerInterval=50, Target=inverse)  # disabled

# ----
# Forward Kinematics
# You set all the joint values
set_joint_positions = BooleanToggle(False)
jp = GhPythonScript()  # -> joint_positions
# ---------- jp: Python ----------
import math
joint_positions = [-3.136, -0.328, -1.218, 3.129, 0.852, 0.008]
joint_positions = [0] * 6
print joint_positions
# ---------- end jp ----------
forward_kinematics = PythonScript(robot=robot, set_joint_positions=set_joint_positions, joint_positions=jp, a1=a1, a2=a2, a3=a3, a4=a4, a5=a5, a6=a6)  # -> full_configuration, joint_positions; inputs joint_positions: list
# ---------- forward_kinematics: Python ----------
import math
import Grasshopper
from compas.robots import Joint
from compas_fab.robots import Configuration

if set_joint_positions:

    j = 0
    for i in range(ghenv.Component.Params.Input.Count):
        nslider = ghenv.Component.Params.Input[i].Sources[0]
        if nslider.GetType() == Grasshopper.Kernel.Special.GH_NumberSlider:
            nslider.TrySetSliderValue(math.degrees(joint_positions[j]))
            j += 1

if robot:
    joint_positions = [a1, a2, a3, a4, a5, a6]
    joint_positions_rad = [0,0,0,0,0,0]
    joint_types = robot.get_configurable_joint_types()
    for i, joint_type in enumerate(joint_types):
        if joint_type == Joint.REVOLUTE:
            joint_positions_rad[i] = math.radians(joint_positions[i])
    full_configuration = Configuration(joint_positions_rad, joint_types)
    print full_configuration
# ---------- end forward_kinematics ----------

# ----
# Send Joints
# Send Frame
# Send Frames
send_frame = Button()

# ----
# Connect to Robots in ECL
reload = Button()
init = Button()
r_on = Button()
update_settings = Button()
py = PythonScript(reload=reload)
# ---------- py: Python ----------
from compas_rhino.utilities.misc import get_tolerance
from compas_rhino.utilities.misc import unload_modules

from compas_ghpython import unload_modules
unload_modules("compas")
unload_modules("compas_fab")
unload_modules("roslibpy")
unload_modules("abb_communication")
# ---------- end py ----------
list_3 = ValueList({"192.168.0.102", "192.168.0.103"}, selected="192.168.0.102")
refresh_text_window = Button()
python_3 = GhPythonScript(ip_abb=list_3, init=init)  # -> out, communication
# ---------- python_3: Python ----------
from scriptcontext import sticky as st
from abb_communication.clients.rfl_robot.communication import ABBCommunication
from compas_rhino.utilities.misc import unload_modules
from compas_ghpython import unload_modules

unload_modules("abb_communication")

communication = ABBCommunication("ABB", ip_abb, port_snd = 30003, port_rcv=30004)
#st["communication"] = communication
# ---------- end python_3 ----------
list_4 = ValueList({"tool 0": "0", "robotic_lacing_pneumatic": "1", "robotic_lacing_electric": "2"}, selected="tool 0")
reset_robot = Button()
r_off = Button()
list_5 = ValueList({"robotic_lacing_wobj": 10, "wobj_0": 0}, selected="wobj_0")
list_6 = ValueList({"fast": 0, "mid": 1, "slow": 2}, selected="fast")
if_connection = PythonScript(
    init=init,
    communication=python_3.communication,
    ip_abb=list_3,
    connect_robot=r_on,
    close_robot=r_off,
    refresh=refresh_text_window,
    reset_robot=reset_robot)  # -> out, communication; inputs connect_robot: Boolean, close_robot: Boolean, refresh: Boolean
# ---------- if_connection: Python ----------
import Rhino.Geometry as rg
from compas.geometry import Frame
from abb_communication.geometry import Frame as F
from scriptcontext import sticky as st
from abb_communication.clients.rfl_robot.communication.messages.clientstates import *
from abb_communication.clients.rfl_robot.communication import ABBCommunication


#communication = ABBCommunication("ABB", ip_abb, port_snd = 30003, port_rcv=30004)
#st["communication"] = communication

#communication = st["communication"]

print communication.running

# =========================================================================================    
if connect_robot == True:
    if communication.running == False:
       communication.start()
    else:
        pass

# =========================================================================================    
if close_robot == True:
    if communication.running == True:
        communication.close()
        communication.cmd_counter_to_client = 0
        communication.cmd_exec_counter_from_client = 0
        
        communication.publish_state(1)
    else:
        pass

if reset_robot:
    communication.close()
    communication.cmd_counter_to_client = 0
    communication.cmd_exec_counter_from_client = 0
    communication.publish_state(1)
    try:
        communication.start()
    except:
        print "CONNECTION TO ABB FAILED"



robot_conncection_state = "online" if communication.running else "offline"
print "ABB CONNECTION STATE:", robot_conncection_state
print "ABB STATE: ", client_states_str_array[communication.state]
print "Sent commands to ABB: ",  communication.get_cmd_counter()
print "Executed commands from ABB: ",  communication.cmd_exec_counter_from_client
# ---------- end if_connection ----------
update_sender = PythonScript(
    init=init,
    communication=if_connection.communication,
    update_settings=update_settings,
    speed=list_6,
    tool_num=list_4,
    wobj_num=list_5,
    rob_num=Slider(1, range=0..10))  # -> out, a; inputs tool_num: Int32, wobj_num: Int32
# ---------- update_sender: Python ----------
from abb_communication.clients.rfl_robot.communication.messages.messagetypes import *
import Rhino.Geometry as rg
from abb_communication.geometry import Frame
from scriptcontext import sticky as st
import math as m
from threading import Thread
import time


#communication = st["communication"]
#print joints_abb
if communication:    
    print communication.get_state()
    communication.float_arbitrary = rob_num
    if update_settings:
        if speed == 0:
            print "SET SPEED FAST"
            communication.set_speed_fast()
#            communication.send_set_speed(500)
        if speed == 1:
            print "SET SPEED MID"
            communication.set_speed_mid()
        if speed == 2:
            print "SET SPEED SLOW"
            communication.set_speed_slow()
        if tool_num:
            communication.set_tool_to_num(int(tool_num))
        else:
            print "Provide to tool number"
        """
        if tool_num == 0:
            print "SET TOOL 0"
            communication.set_tool0()
        elif tool_num == 1:
            print "SET TOOL MESH MOULD"
            communication.set_tool_meshmould()
        elif tool_num == 6:
            print "SET TOOL MTIP"
            communication.set_tool_mtip()
        elif tool_num == 7:
            print "SET TOOL LWS GRIPPER"
            communication.set_tool_lws_gripper()
        elif tool_num == 8:
            print "SET TOOL STU GRIPPER"
            communication.set_tool_stu_gripper()
        elif tool_num == 10:
            print "SET TOOL MAS MAGAZINE"
            communication.set_tool_mas_magazine()
        else:
            print "WRONG TOOL NUM"
        """
        if wobj_num:
            communication.set_wobj_to_num(wobj_num)
        else:
            print "Provide a WOBJ number"

        """
        if wobj_num == 0:
            print "SET WOBJ 0"
            communication.set_wobj_0()
        elif wobj_num == 1:
            print "SET WOBJ LWS COMMON"
            communication.set_wobj_common()
        elif wobj_num == 2:
            print "SET WOBJ BASE"
            communication.set_wobj_base()
        elif wobj_num == 3:
            print "SET WOBJ STU PICK"
            communication.set_wobj_stu_pick()
        elif wobj_num == 4:
            print "SET WOBJ STU BASE"
            communication.set_wobj_stu_base()
        else:
            print "WRONG TOOL NUM"
           """
        if rob_num:
            communication.set_rob_num(rob_num)
        else:
            print "Provide a ROB number"
    # =========================================================================================
    # =========================================================================================
    if communication.running:
        print "ROBOT IS ONLINE"
        # =====================================================================================     
    else:
        print "ROBOT IS OFFLINE"
# ---------- end update_sender ----------
panel_7 = Panel(if_connection.out)
panel_8 = Panel(update_sender.out)

# ----
# Example: Generate planes in grasshopper
# and manipulate using feedback
# from arduino
# Generate plane and rotate plane
pln_2 = Plane(Plane(origin=(195.2586876, -153.5850751, 389.3575739), x=(0.7629242826, -0.6339132983, 0.1268876249), y=(-0.2093934589, -0.4279920311, -0.8791912196)))
deplane = DeconstructPlane(Plane=pln_2)  # -> Origin, XAxis, YAxis, ZAxis
rot3d = Rotate3D(Geometry=pln_2, Angle=Slider(-1.15, range=-3.142..3.142), Center=deplane.Origin, Axis=deplane.XAxis)  # -> Geometry, Transform
deplane_2 = DeconstructPlane(Plane=rot3d.Geometry)  # -> Origin, XAxis, YAxis, ZAxis

# ----
# Sensor value
# applied to geometry
# (in this case by shifting
# a plane along it's z-axis)
amp = Amplitude(Vector=deplane_2.ZAxis, Amplitude=python_2.a)
move = Move(Geometry=rot3d.Geometry, Motion=amp)  # -> Geometry, Transform

pln_3 = Plane(move.Geometry)

# ----
# Final planes
# for sending to the robot
# If you make your own planes in a different way,
# plug them into this component
pln_4 = Plane(pln_3)
orient = Orient(Geometry=cluster.s_0_2, Source=cluster.P_2, Target=pln_4)  # -> Geometry, Transform
orient_2 = Orient(Geometry=cluster.s_0_3, Source=cluster.P_2, Target=pln_4)  # -> Geometry, Transform

# ----
# Inverse Kinematics
# You tell the robot where you want it to go
# and it figures out the configuration
avoid_collisions = BooleanToggle(False)
start_configuration = Data(forward_kinematics.full_configuration)
inverse = GhPythonScript(
    reset=Button(),
    run=toggle_2,
    robot=robot,
    group=info.main_group_name,
    planes=orient.Geometry,
    start_configuration=start_configuration,
    avoid_collisions=avoid_collisions)  # -> out, group_configuration, full_configuration, frame, frames; inputs planes: list
# ---------- inverse: Python ----------
"""Calculate the robot's inverse kinematic for a given plane.
    Inputs:
        robot: The robot
        group: str, optional
            The planning group used for calculation. Defaults to the robot's
            main planning group.
        plane: The plane in world coordinate frame to calculate the inverse for.
        start_configuration: :class:`compas_fab.robots.Configuration`, optional
            If passed, the inverse will be calculated such that the calculated
            joint positions differ the least from the start_configuration.
            Defaults to the zero configuration.
        avoid_collisions: bool, optional
            Whether or not to avoid collisions. Defaults to True.
    Output:
        group_configuration: The group configuration
        full_configuration: The full configuration
"""
from __future__ import print_function
import logging

from compas.geometry import Frame
from scriptcontext import sticky

if "start_conf" not in sticky:
    sticky["start_conf"] = start_configuration
if "count" not in sticky:
    sticky["count"] = 0
if sticky["count"] >= len(planes):
    sticky["count"] = 0
if sticky["count"] == 0:
    sticky["start_conf"] = start_configuration

if reset:
#    sticky["start_conf"] = start_configuration
    sticky["count"] = 0
    
LOGGER = logging.getLogger('roslibpy')

count = sticky["count"]
plane = planes[count]
frame = Frame(plane.Origin, plane.XAxis, plane.YAxis)
frames = [frame, Frame(plane.Origin, plane.XAxis, plane.YAxis)]
full_configuration = []
start_conf = sticky["start_conf"]
if run:
    if robot and robot.client:
        if robot.client.is_connected:
            for frame in frames:
                full_configuration.append(robot.inverse_kinematics(frame,
                                                              start_configuration=start_conf,
                                                              group=group,
                                                              return_full_configuration=True,
                                                              options={
                                                                'avoid_collisions':avoid_collisions,
                                                              }))
                if full_configuration:
                    sticky["start_conf"] = full_configuration[0]
                    sticky["count"]+=1
            print(group_configuration)
            
        else:
            print("Robot client is not connected")
else:
    full_configuration = sticky["start_conf"]
# ---------- end inverse ----------

# ----
# Inverse Step
# You tell the robot where you want it to go
# and it figures out the configuration
avoid_collisions_2 = BooleanToggle(False)
start_configuration_2 = Data(forward_kinematics.full_configuration)
inverse_2 = GhPythonScript(
    reset=Button(),
    run=toggle_3,
    robot=robot,
    group=info.main_group_name,
    planes=orient.Geometry,
    start_configuration=start_configuration_2,
    avoid_collisions=avoid_collisions_2,
    index=number_slider_2)  # -> out, group_configuration, full_configuration, frame, frames, plane; inputs planes: list, index: Int32
# ---------- inverse_2: Python ----------
"""Calculate the robot's inverse kinematic for a given plane.
    Inputs:
        robot: The robot
        group: str, optional
            The planning group used for calculation. Defaults to the robot's
            main planning group.
        plane: The plane in world coordinate frame to calculate the inverse for.
        start_configuration: :class:`compas_fab.robots.Configuration`, optional
            If passed, the inverse will be calculated such that the calculated
            joint positions differ the least from the start_configuration.
            Defaults to the zero configuration.
        avoid_collisions: bool, optional
            Whether or not to avoid collisions. Defaults to True.
    Output:
        group_configuration: The group configuration
        full_configuration: The full configuration
"""
from __future__ import print_function
import logging

from compas.geometry import Frame
from scriptcontext import sticky

if "start_conf" not in sticky:
    sticky["start_conf"] = start_configuration
if reset:
    sticky["start_conf"] = start_configuration
#if index == 0:
#    sticky["start_conf"] = start_configuration
    

LOGGER = logging.getLogger('roslibpy')

plane = planes[index]
frame = Frame(plane.Origin, plane.XAxis, plane.YAxis)
frames = [frame, Frame(plane.Origin, plane.XAxis, plane.YAxis)]
full_configuration = []
start_conf = sticky["start_conf"]
if run:
    if robot and robot.client:
        if robot.client.is_connected:
            for frame in frames:
                full_configuration.append(robot.inverse_kinematics(frame,
                                                              start_configuration=start_conf,
                                                              group=group,
                                                              return_full_configuration=True,
                                                              options={
                                                                'avoid_collisions':avoid_collisions,
                                                              }))
                if full_configuration:
                    sticky["start_conf"] = full_configuration[0]
                    
            print(group_configuration)
            
        else:
            print("Robot client is not connected")
# ---------- end inverse_2 ----------

# ----
# Configuration
# Position of all the robots joints based on either
# values you give them or the location you want it to reach
# Select:
# forward kinematics
# inverse kinematics
# inverse step
panel_9 = Panel(forward_kinematics.full_configuration)
list_7 = ValueList({"foward_kinematics": 0, "inverse": 1, "inverse step": 2}, selected="foward_kinematics")
filter_2 = StreamFilter(
    Gate=list_7,
    Stream0=forward_kinematics.full_configuration,
    Stream1=inverse.full_configuration,
    Stream2=inverse_2.full_configuration)

# ----
# Visualize Robots
number_slider_3 = Slider(0, range=0..1)
show_end_effector_frame = BooleanToggle(True)
show_base_frame = BooleanToggle(True)
show_collision = BooleanToggle(False)
show_frames = BooleanToggle(False)
show_visual = BooleanToggle(True)
data_2 = Data(info.main_group_name)
visualize = PythonScript(
    robot=robot,
    group=data_2,
    full_configuration=filter_2,
    int_configuration=number_slider_3,
    show_visual=show_visual,
    show_collision=show_collision,
    show_frames=show_frames,
    show_base_frame=show_base_frame,
    show_end_effector_frame=show_end_effector_frame)  # -> out, visual, collision, frames, base_frame_WCF, ee_frame_WCF, ee_plane; inputs full_configuration: list, int_configuration: Int32
# ---------- visualize: Python ----------
"""Calculates a cartesian motion path (linear in tool space).
    Inputs:
        robot: The robot
        group: str
            The planning group used for visualisation
        full_configuration: :class:`compas_fab.robots.Configuration`
            The robot's full configuration to display.
        show_visual: bool
           Whether or not to show the robot's visual meshes.
        show_collision: bool
           Whether or not to show the robot's collision meshes.
        show_frames: bool
           Whether or not to show the robot's joint frames.
        show_base_frame: bool
           Whether or not to show the robot's base frame.
        show_end_effector_frame: bool
            Whether or not to show the robot's end-effector frame.
    Output:
        visual: The robot's visual meshes.
        collision: The robot's collision meshes.
        frames: The robot's joint frames.
        base_frame_WCF: The robot's base frame.
        ee_frame_WCF: The robot's end-effector frame.
"""
from __future__ import print_function
full_configuration = full_configuration[int_configuration]
import compas_ghpython as cgh

if robot and full_configuration:
    robot.update(full_configuration, group=group, visual=show_visual, collision=show_collision)

    print(full_configuration)

    if show_visual:
        visual = robot.draw_visual()

    if show_collision:
        collision = robot.draw_collision()

    if show_frames:
        axes = robot.transformed_axes(full_configuration)
        frames = robot.transformed_frames(full_configuration)

    if show_base_frame:
        base_frame_WCF = robot.get_base_frame(group, full_configuration)

    if show_end_effector_frame:
        ee_frame_WCF = robot.get_end_effector_frame(group, full_configuration)
        print("End-effector", ee_frame_WCF)
        
        ee_plane = cgh.draw_frame(ee_frame_WCF)
# ---------- end visualize ----------
panel_10 = Panel(visualize.out)
py_2 = PythonScript(robot=robot)  # -> scale
# ---------- py_2: Python ----------
if robot:
    scale = robot.scale_factor * 0.1
else:
    scale = 1.
# ---------- end py_2 ----------
draw = GhPythonScript(frames=[visualize.frames, visualize.ee_frame_WCF, visualize.base_frame_WCF], scale=py_2)  # -> P, V, C, W; inputs frames: list
# ---------- draw: Python ----------
from System.Drawing import Color
from compas_ghpython import draw_frame

red = Color.FromArgb(255, 0, 0)
green = Color.FromArgb(0, 255, 0)
blue = Color.FromArgb(0, 0, 255)

P = []
V = []
C = []

scale = float(scale)

for frame in frames:
    if not frame:
        continue
    plane = draw_frame(frame)
    P += [plane.Origin] * 3
    V.append(plane.XAxis * scale)
    V.append(plane.YAxis * scale)
    V.append(plane.ZAxis * scale)
    C += [red, green, blue]

W = 3
# ---------- end draw ----------
geo_2 = Geometry(visualize.visual)
geo_3 = Geometry(visualize.collision)
vdisex = VectorDisplayEx(Point=draw.P, Vector=draw.V, Colour=draw.C, Width=draw.W)
geo_4 = Geometry(cluster.s_0)
pln_5 = Plane(visualize.ee_plane)
orient_3 = Orient(Geometry=geo_4, Source=cluster.P_2, Target=pln_5)  # -> Geometry, Transform
preview = CustomPreview(Geometry=geo_2, Shader=ColourSwatch(SwatchColor=RGBA(0, 0, 0, 219)))
preview_2 = CustomPreview(Geometry=orient_3.Geometry, Shader=ColourSwatch(SwatchColor=RGBA(20, 156, 255, 120)))

# ----
# Send Geometry to Robots
# Make sure these toggles are
# false when you start
get_pose = Button()  # disabled
python_4 = GhPythonScript(conf=filter_2)  # -> out, joints; inputs conf: list
# ---------- python_4: Python ----------
__author__ = "parascho"
__version__ = "2021.03.09"

import rhinoscriptsyntax as rs
from compas_fab.robots import Configuration 
import math

config = conf[0]
joints = config.revolute_values

for i, j in enumerate(joints):
    joints[i] = math.degrees(j)
print joints
# ---------- end python_4 ----------
pln_6 = Plane(orient_2.Geometry)
testsend = GhPythonScript(
    send_joints=Toggle(False),
    communication=if_connection.communication,
    joint_positions=python_4.joints,
    frame=pln_6,
    frames=pln_6,
    send_frame=send_frame,
    send_frames=Toggle(False),
    get_pose=get_pose)  # -> out, a; inputs joint_positions: list, frames: list
# ---------- testsend: Python ----------
from abb_communication.clients.rfl_robot.communication.messages.messagetypes import *
import Rhino.Geometry as rg
from compas.geometry import Frame as fr
from abb_communication.geometry import Frame
from scriptcontext import sticky as st
import math as m
from threading import Thread
import time

ext_axes = [0, 0, 0]

#print list_ext_axes

#communication = st["communication"]

pose = []

#print joints_abb
if communication:        
    # =========================================================================================
    # =========================================================================================
    if communication.running:
        print "ROBOT IS ONLINE"
#            if send_joints:
        joints_abb = joint_positions + [0,0,0]
        joints_abb_list = [float(x) for x in joints_abb]
        print joints_abb
        state = communication.get_state()
        print state
        if state == 1: 
            if send_joints:
                communication.send_axes_absolute(joints_abb_list, int_arr = None)
            if send_frame:
                communication.send_pose_cartesian(frame)
            if send_frames:
    #            communication.send_pose_cartesian_list(frames)
                communication.send_pose_cartesian(frame)
            if get_pose:
                pose = communication.get_current_pose_cartesian()
    else:
        print "ROBOT IS OFFLINE"
    
#print "pose", pose
# ---------- end testsend ----------

# ==== cluster Cluster
xy = XYPlane(Origin=Point(0, 0, 0))
yz = YZPlane(Origin=Point(0, 0, 0))
P = ClusterOutput(yz)
P_2 = ClusterOutput(xy)
G = ClusterInput()
G_2 = ClusterInput()
orient = Orient(Geometry=G_2, Source=xy, Target=yz)  # -> Geometry, Transform
orient_2 = Orient(Geometry=G, Source=xy, Target=yz)  # -> Geometry, Transform
B = ClusterInput()
G_3 = ClusterInput()
G_4 = ClusterInput()
_1 = ClusterInput()
orient_3 = Orient(Source=xy, Target=orient_2.Geometry)  # -> Geometry, Transform
orient_4 = Orient(Source=xy, Target=B)  # -> Geometry, Transform
orient_5 = Orient(Source=xy, Target=G)  # -> Geometry, Transform
filter = StreamFilter(Gate=G_4, Stream0=orient.Geometry, Stream1=_1)
inverse = InverseTransform(Transform=orient_3.Transform)
inverse_2 = InverseTransform(Transform=orient_4.Transform)
inverse_3 = InverseTransform(Transform=orient_5.Transform)
s_0 = ClusterOutput(filter)
transform = Transform(Geometry=xy, Transform=inverse)
transform_2 = Transform(Geometry=xy, Transform=inverse_2)
filter_2 = StreamFilter(Gate=G_3, Stream0=transform, Stream1=transform_2)
s_0_2 = ClusterOutput(filter_2)
transform_3 = Transform(Geometry=xy, Transform=inverse_3)
filter_3 = StreamFilter(Gate=G_3, Stream0=transform_3, Stream1=transform_2)
s_0_3 = ClusterOutput(filter_3)
