# Grasshopper definition IFMM_NEST_IFControl.gh (Grasshopper 0.9.76)
# plug-ins: Python Interpreter

# ----
# angleB
# speed
# data for further calculation
# set path
# set path
# set path
# set path
# set path
# set path
# set path
# force
# force
# force
# force
# force
# force
# angleA
# angleA
# angleA
# angleA
# angleA
# angleA
# angleB
# angleB
# angleB
# angleB
# angleB
# angleB
# speed
# speed
# speed
# speed
# speed
# speed
# force
# force
# force
# force
# force
# force
# angleA
# angleA
# angleA
# angleA
# angleA
# angleA
# angleA
# angleA
# angleA
# angleA
# angleA
# angleA
# angleA
# angleB
# angleB
# angleB
# angleB
# angleB
# angleB
# speed
# speed
# speed
# speed
# speed
# speed
# speed
# speed
# speed
# speed
# speed
# speed
# speed
# data for further calculation
# data for further calculation
# data for further calculation
# data for further calculation
# data for further calculation
# data for further calculation
# material resistance
# force
# angleA
# angleB
# speed
# . . . . . . . . . . . . . . . . . .
# .                                 .
# .   <<><><>    <<><><>  <<        .
# .   <<    ><   <<       <<        .
# .   <<><><>    <<><><   <<        .
# .   <<  ><     <<       <<        .
# .   <<   <>    <<       <<        .
# .   <<    ><   <<       <<><><>   .
# .                                 .
# .             GKR 2016/17         .
# . . . . . . . . . . . . . . . . . .
# 
# Created on 10.12.2016
# 
# @author: kathrind, stefanap
# force
# angleA
# angleB
# speed
# material resistance
# angleA
# material resistance
# angleB
# force
# speed
# angleA
# angleB
# force
# speed
# angleA
# angleB
# force
# speed
# angleA
# angleB
# speed
# material resistance
# material resistance
# material resistance
# force
# force
# force
# angleA
# angleA
# angleA
# angleB
# angleB
# speed
# speed
# force
# force
# angleA
# angleA
# angleB
# angleB
# speed
# speed
unload_abb_communication_lib = Button()
py = PythonScript(unload=unload_abb_communication_lib)
# ---------- py: Python ----------
from abb_communication.useful import unload_rfl_lib

if unload:
    unload_rfl_lib()
# ---------- end py ----------

# ----
# IF robot
list = ValueList({"192.168.125.1", "127.0.0.1"}, selected="127.0.0.1")
init = Button()
if = IF(init=init, ip_abb=list)

Z = UnitZ(Factor=1)
multiplication = Multiplication(A=Z, B=Slider(532.256, range=0..1000))
xy = XYPlane(Origin=Point(0, 0, 0))
move = Move(Geometry=xy, Motion=multiplication)  # -> Geometry, Transform

# ----
# tools
list_2 = ValueList({"mm tool": 0, "measurement tool": 1}, selected="mm tool")
tool = Tool(int=list_2, init=init)
set_tool_and_base = PythonScript(robot=if, tool=tool, base_plane=move.Geometry)  # -> out, robot
# ---------- set_tool_and_base: Python ----------
from scriptcontext import sticky as st



robot.set_tool(tool)
robot.set_robot_origin(base_plane)
# set_robot_origin_with_measured_base(self, base_plane):

st["if_robot"] = robot
# ---------- end set_tool_and_base ----------

front = Slider(24.2, range=-90..90)
back = Slider(-4.065, range=-90..90)
extended = BooleanToggle(True)
mm_tool_front_back = Data([front, back])

a2 = Slider(130.387, range=-360..360)
# IF animation
a5 = Slider(17, range=-360..360)
a1 = Slider(-72.853, range=-360..360)
a3 = Slider(-17, range=-360..360)
a4 = Slider(67, range=-360..360)
_46 = Slider(173, range=-360..360)
abb_a1_a6 = Data([a1, a2, a3, a4, a5, _46])

set_speed_slow = Button()
set_speed_mid = Button()
set_speed_fast = Button()
list_3 = ValueList({"tool_0": 0, "tool_meshmould": 1, "tool_mtip": 6}, selected="tool_0")
set_tool = Button()

get_joints = PythonScript(get_joint_vals=Toggle(True))  # -> out, joint_values
# ---------- get_joints: Python ----------
import ghpythonlib.components as ghcomp
import Rhino.Geometry as rg
import math as m
from copy import copy, deepcopy
from scriptcontext import sticky as st
robot = st["if_robot"] 


if robot.comm.ghenv == None:
    robot.comm.ghenv = ghenv

if get_joint_vals:
    
    if robot.comm.running:
        joint_values =  robot.comm.get_current_pose_joint()
        print "Robot Joint Pose:  [%.3f, %.3f, %.3f, %.3f, %.3f, %.3f] " % (m.degrees(joint_values[0]), m.degrees(joint_values[1]), m.degrees(joint_values[2]), m.degrees(joint_values[3]), m.degrees(joint_values[4]), m.degrees(joint_values[5]))
        joint_values = [m.degrees(p) for p in joint_values]

        pose_values = robot.comm.get_current_pose_cartesian()
        print "Robot Pose:  [%.3f, %.3f, %.3f, %.3f, %.3f, %.3f, %.3f] " % tuple(pose_values)
        
    else:
        print "ROBOT IS OFFLINE"
        robot.comm.current_joint_values = [0,0,0,0,0,0]
        robot.comm.current_tool0_pose = [0,0,0,0,0,0,0]
        
joint_values = robot.comm.current_joint_values
pose_values = robot.comm.current_tool0_pose

"""
print "Current joints:  [%.3f, %.3f, %.3f, %.3f, %.3f, %.3f] " % tuple(joint_values)
print "Current task_pose:  [%.3f, %.3f, %.3f, %.3f, %.3f, %.3f, %.3f] " % tuple(pose_values)"""
# ---------- end get_joints ----------
panel = Panel(get_joints.out)

# ----
# Define plane sequence WCS
# material resistance
# force
# angleA
# angleB
# speed
# force
# angleA
# angleB
# speed
# angleB
# speed
# force
# angleA
# angleB
# speed
number_slider = Slider(30, range=0..100)
crv = Curve(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)

pframes = PerpFrames(Curve=crv, Count=number_slider, Align=True)  # -> Frames, Parameters

reorient_planes = PythonScript(F=pframes.Frames)  # -> out, F; inputs F: list of Plane
# ---------- reorient_planes: Python ----------
import Rhino.Geometry as rg
import math as m



[f.Rotate(m.radians(90), f.XAxis, f.Origin) for f in F]
[f.Rotate(m.radians(90), f.ZAxis, f.Origin) for f in F]
# ---------- end reorient_planes ----------

# ----
# Calculation planes and poses
ur_poses = PythonScript(robot=set_tool_and_base.robot, planes_tool_WCS=reorient_planes.F, idx=Slider(12, range=0..30))  # -> origin_plane, planes_tool_WCS, planes_tool_RCS, planes_tool0_RCS, poses_tool_RCS, plane_at_idx_WCS, tool_geo_on_plane_at_idx_WCS, tool_geo_colors; inputs planes_tool_WCS: list of Plane, idx: Int32
# ---------- ur_poses: Python ----------
import Rhino.Geometry as rg
import ghpythonlib.components as ghcomp

origin_plane = robot.origin_plane

planes_tool_RCS = [robot.get_tool_plane_in_RCS(tp_WCS) for tp_WCS in planes_tool_WCS]
planes_tool0_RCS = [robot.get_tool0_plane_in_RCS(tp_WCS) for tp_WCS in planes_tool_WCS]
poses_tool_RCS = [robot.get_tool_pose_in_RCS(tp_WCS) for tp_WCS in planes_tool_WCS]


"""
ur_tool_geo_on_planes_WCS_nested = [robot.tool.get_transformed_geo_trfd(rg.Transform.PlaneToPlane(rg.Plane.WorldXY, tp_WCS)) for tp_WCS in ur_planes_tool_WCS]
ur_tool_geo_on_planes_WCS = [x for sublist in ur_tool_geo_on_planes_WCS_nested for x in sublist]

ur_tool_geo_on_planes_RCS_nested = [robot.tool.get_transformed_geo_trfd(rg.Transform.PlaneToPlane(rg.Plane.WorldXY, tp_RCS)) for tp_RCS in ur_planes_tool_RCS]
ur_tool_geo_on_planes_RCS = [x for sublist in ur_tool_geo_on_planes_RCS_nested for x in sublist]"""

plane_at_idx_WCS = planes_tool_WCS[idx]
T = rg.Transform.PlaneToPlane(rg.Plane.WorldXY, plane_at_idx_WCS)

tool_geo_on_plane_at_idx_WCS = robot.tool.get_transformed_geo_with_tool_transformation_WCS(T, 30, 30, extended = True)
tool_geo_colors = robot.tool.colors
# ---------- end ur_poses ----------
pln = Plane(ur_poses.plane_at_idx_WCS)
geo = Geometry(ur_poses.tool_geo_on_plane_at_idx_WCS)
planesrf = PlaneSurface(Plane=ur_poses.planes_tool_WCS, XSize=Domain(-10, 10), YSize=Domain(-10, 10))
preview = CustomPreview(Geometry=geo, Shader=ur_poses.tool_geo_colors)

# ----
# IF communication
send_current_robot_tool_pose = Button()
list_4 = ValueList({"joints_meshmould_left_low": "98.54 -20.98 45.48 0.0 65.50 68.54", "joints_meshmould_left_high": "98.54 -23.4 23.9 0.0 89.50 68.54", "joints_meshmould_right_low": "-81.46 -20.98 45.48 0.0 65.50 68.54", "joints_meshmould_parking_high": "0 -20.98 45.48 0.0 65.50 -111.46", "joints_meshmould_parking_mid": "0 -60.94 66.90 0.0 84.28 63.15", "joints_meshmould_parking_low": "0 -70.8 72.19 0.0 88.92 61.82"}, selected="joints_meshmould_parking_high")
send_robot_joints_absolute = Button()
send_robot_joints_relative = Button()
set_joint_6_to_zero = Button()
joints_1_6 = Slider(6, range=1..6)
stepsize = Slider(10, range=-180..180)
refresh_text_window = Button()
reset_robot = Button()
r_on = Button()
r_off = Button()
if_sender = PythonScript(
    init=init,
    plane_WCS=pln,
    set_speed_fast=set_speed_fast,
    set_speed_mid=set_speed_mid,
    set_speed_slow=set_speed_slow,
    send_current_tool_pose=send_current_robot_tool_pose,
    send_joints_absolute=send_robot_joints_absolute,
    joints_abb=list_4,
    send_joints_rel=simplify(send_robot_joints_relative),
    joint=joints_1_6,
    relative_angle=stepsize,
    set_joint_6_to_zero=set_joint_6_to_zero,
    set_tool=set_tool,
    tool_num=list_3)  # -> out, a; inputs send_current_tool_pose: Boolean, joint: Int32, set_tool: Boolean, tool_num: Int32
# ---------- if_sender: Python ----------
from ifmm_lib.clients.if_robot.communication.messages.messagetypes import *
import Rhino.Geometry as rg
from ifmm_lib.geometry import Frame
from scriptcontext import sticky as st
import math as m
from threading import Thread
import time

robot = st["if_robot"]


if robot:    
    
    if set_speed_fast:
        print "SET SPEED FAST"
        robot.comm.set_speed_fast()
    if set_speed_mid:
        print "SET SPEED MID"
        robot.comm.set_speed_mid()
    if set_speed_slow:
        print "SET SPEED SLOW"
        robot.comm.set_speed_slow()
    
    if set_tool:
        if tool_num == 0:
            print "SET TOOL 0"
            robot.comm.set_tool0()
        elif tool_num == 1:
            print "SET TOOL MESH MOULD"
            robot.comm.set_tool_meshmould()
        elif tool_num == 6:
            print "SET TOOL MTIP"
            robot.comm.set_tool_mtip()
        else:
            print "WRONG TOOL NUM"
    
    # =========================================================================================
    # =========================================================================================
    if robot.comm.running:
        print "ROBOT IS ONLINE"
        
        # =========================================================================================
        if send_current_tool_pose:
            #tool_plane_RCS = robot.get_tool_plane_in_RCS(plane_WCS)
            #robot.comm.send_pose_cartesian(tool_plane_RCS)
            tool0_plane_RCS = robot.get_tool0_plane_in_RCS(plane_WCS)
            robot.comm.send_pose_cartesian(tool0_plane_RCS)
            
        if send_joints_rel:
            joints = [0,0,0,0,0,0]
            joints[joint-1] = relative_angle
            robot.comm.send_axes_relative(joints, int_arr = None)
            
        if send_joints_absolute:
            joints_abb_list = [float(x) for x in joints_abb.split()]
            robot.comm.send_axes_absolute(joints_abb_list, int_arr = None)
        
        if set_joint_6_to_zero:
            posej = robot.comm.get_current_pose_joint()
            posej_deg = [m.degrees(j) for j in posej]
            posej_deg[5] = 0
            #posej_deg[3] = 0
            robot.comm.send_axes_absolute(posej_deg, int_arr = None)       
        
            
    else:
        print "ROBOT IS OFFLINE"
# ---------- end if_sender ----------
if_connection = PythonScript(
    robot=set_tool_and_base.robot,
    connect_robot=r_on,
    close_robot=r_off,
    refresh=refresh_text_window,
    reset_robot=reset_robot)  # -> out; inputs connect_robot: Boolean, close_robot: Boolean, refresh: Boolean
# ---------- if_connection: Python ----------
import Rhino.Geometry as rg
from ifmm_lib.clients.if_robot.communication.messages.clientstates import *

print robot.comm.running

# =========================================================================================    
if connect_robot == True:
    if robot.comm.running == False:
        robot.comm.start()
    else:
        pass

# =========================================================================================    
if close_robot == True:
    if robot.comm.running == True:
        robot.comm.close()
        robot.comm.cmd_counter_to_client = 0
        robot.comm.cmd_exec_counter_from_client = 0
        robot.comm.publish_state(1)
    else:
        pass

if reset_robot:
    robot.comm.close()
    robot.comm.cmd_counter_to_client = 0
    robot.comm.cmd_exec_counter_from_client = 0
    robot.comm.publish_state(1)
    try:
        robot.comm.start()
    except:
        print "CONNECTION TO ABB FAILED"


robot_conncection_state = "online" if robot.comm.running else "offline"
print "ABB CONNECTION STATE:", robot_conncection_state
print "ABB STATE: ", client_states_str_array[robot.comm.state]
print "Sent commands to ABB: ",  robot.comm.get_cmd_counter()
print "Executed commands from ABB: ",  robot.comm.cmd_exec_counter_from_client
# ---------- end if_connection ----------
panel_2 = Panel(if_connection)

# ----
# inclination_length for 2, 4, 10, 15
# inclination_length for 30
# Calculate edge curves
panel_3 = Panel(if_sender.out)

list_5 = ValueList({"0 forward, angles from sliders": 0, "1 forward, angles from online robot": 1}, selected="1 forward, angles from online robot")
# Select input for
# representation
filter = StreamFilter(Gate=list_5, Stream0=abb_a1_a6, Stream1=get_joints.joint_values)

filter_2 = StreamFilter(Gate=list_5, Stream0=mm_tool_front_back, Stream1=mm_tool_front_back)

ifrep = PythonScript(
    robot=set_tool_and_base.robot,
    robot_origin_plane=move.Geometry,
    joint_values=filter,
    tool_joint_values=filter_2,
    show_coll_geo=Toggle(True))  # -> base_geo, link_geo, robot_geo_colors, tool_geo, tool_geo_colors, tool0_plane; inputs robot_origin_plane: Plane, joint_values: list, tool_joint_values: list, extended: Boolean, show_coll_geo: Boolean
# ---------- ifrep: Python ----------
print joint_values


robot.set_robot_origin(robot_origin_plane)
#base_geo, link_geo, tool_geo = robot.get_geo_with_rotated_joints_in_world(joint_values)
base_geo, link_geo, tool_geo = robot.get_geo_with_rotated_joints_in_world_with_tool_rot(joint_values, tool_joint_values, extended = extended)

tool_geo_colors = robot.tool.colors

tool0_plane = robot.get_tool0_plane_from_joint_values_world(joint_values)

if show_coll_geo == False:
    tool_geo.pop(-1)
    

robot_geo_colors = robot.colors_links + robot.colors_base
# ---------- end ifrep ----------
pln_2 = Plane(ifrep.tool0_plane)
preview_2 = CustomPreview(Geometry=[ifrep.link_geo, ifrep.base_geo], Shader=ifrep.robot_geo_colors)

preview_3 = CustomPreview(Geometry=ifrep.tool_geo, Shader=ifrep.tool_geo_colors)

# ==== cluster Tool
p3_rot_back_gripper_retracted = Mesh(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)
p3_rot_back_gripper_extended = Mesh(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)
p3_rot_back_frame = Mesh(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)
mm_tool_plane = Plane(Plane(origin=(-87.75034292, 151.9880897, 617), x=(0.5, -0.8660254038, 0), y=(-0.8660254038, -0.5, 0)))
mm_cam_plane = Plane(Plane(origin=(-220.4173906, -246.1664658, 566.7384126), x=(-0.8256223359, 0.5642231459, 0), y=(-0.2905964029, -0.4252269385, 0.8571673007)))
p2_rot_front = Mesh(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)
collision_geo = Mesh(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)
p1_fixed = Mesh(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)
int = ClusterInput()
init = ClusterInput()
tool_geo_mesh = Mesh([p1_fixed, p2_rot_front, p3_rot_back_frame, p3_rot_back_gripper_retracted, p3_rot_back_gripper_extended, collision_geo])
int_2 = Integer(int)

set_tool = PythonScript(init=init, tool_geo=tool_geo_mesh, tool_plane=mm_tool_plane, cam_plane=mm_cam_plane)  # -> out, tool, tool_plane, tool_geo, tool_axes, tool_axes_colors; inputs tool_geo: list of Mesh, tool_plane: Plane
# ---------- set_tool: Python ----------
import Rhino.Geometry as rg
import ghpythonlib.components as ghcomp
import math as m


from ifmm_lib.clients.if_robot import MeshMouldTool
from ifmm_lib.geometry import Frame



#rot_plane = rg.Plane(rg.Plane.WorldXY)

#T_trans = rg.Transform.Translation(rot_plane.ZAxis*40)


#T_rot = rg.Transform.Rotation(m.radians(-20), rot_plane.ZAxis, rot_plane.Origin)
#tool_geo = ghcomp.Transform(tool_geo, T_rot)
#tool_plane = ghcomp.Transform(tool_plane, T_rot)
#cam_plane = ghcomp.Transform(cam_plane, T_rot)

#T_rot = rg.Transform.Rotation(m.radians(-20), rot_plane.XAxis, rot_plane.Origin)
#tool_geo = ghcomp.Transform(tool_geo, T_rot)
#tool_plane = ghcomp.Transform(tool_plane, T_rot)
#cam_plane = ghcomp.Transform(cam_plane, T_rot)
#rot_plane = ghcomp.Transform(rot_plane, T_rot)

#T_rot = rg.Transform.Rotation(m.radians(10), rot_plane.YAxis, rot_plane.Origin)
#tool_geo = ghcomp.Transform(tool_geo, T_rot)
#tool_plane = ghcomp.Transform(tool_plane, T_rot)
#cam_plane = ghcomp.Transform(cam_plane, T_rot)
#rot_plane = ghcomp.Transform(rot_plane, T_rot)

#tool_geo = ghcomp.Transform(tool_geo, T_trans)
#tool_plane = ghcomp.Transform(tool_plane, T_trans)
#cam_plane = ghcomp.Transform(cam_plane, T_trans)


tool = MeshMouldTool(tool_geo, tool_plane, cam_plane)


tool_plane = tool.get_plane()
tool_axes, tool_axes_colors = tool.get_frame_axes_as_lines()
# ---------- end set_tool ----------
pln = Plane(set_tool.tool_plane)
preview = CustomPreview(Geometry=set_tool.tool_axes, Shader=set_tool.tool_axes_colors)
geo = Geometry(set_tool.tool_geo)
preview_2 = CustomPreview(Geometry=geo, Shader=ColourSwatch(SwatchColor=RGBA(100, 168, 178, 162)))

select_tool = StreamFilter(Gate=int_2, Stream0=set_tool.tool)
tool = Data(select_tool)
tool_2 = ClusterOutput(tool)

# ==== cluster IF
l1 = Mesh(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)
l3 = Mesh(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)
l4 = Mesh(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)
l5 = Mesh(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)
l6 = Mesh(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)
l2 = Mesh(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)
mesh = Mesh([l1, l2, l3, l4, l5, l6])
ip_abb = ClusterInput()
init = ClusterInput()
base = Mesh([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])
plane = Plane([PlaneXY(-1.185867404e-09, 0, 0), Plane(origin=(175, 0, 495), x=(0, 0, 1), y=(1, 0, 0)), Plane(origin=(175, 0, 1590), x=(0, 0, 1), y=(1, 0, 0)), Plane(origin=(175, 0, 1765), x=(0, 0, -1), y=(0, 1, 0)), Plane(origin=(1446, 0, 1765), x=(0, 0, 1), y=(1, 0, 0)), Plane(origin=(1581, 0, 1765), x=(-1.94917184e-05, 1.016258774e-11, -0.9999999998), y=(-2.075117433e-05, 0.9999999998, 4.146386344e-10))])
if = PythonScript(init=init, ip_abb=ip_abb, joint_planes=plane, base_geo=base, link_geo=mesh)  # -> robot; inputs joint_planes: list of Plane, base_geo: list of Mesh, link_geo: list of Mesh
# ---------- if: Python ----------
from ifmm_lib.clients import Robot

robot = Robot(link_geo, base_geo, joint_planes, ip_abb = ip_abb)
# ---------- end if ----------
robot = ClusterOutput(if)
