# Grasshopper definition 170109_Tooldata.gh (Grasshopper 0.9.76)
# plug-ins: Python Interpreter

# ----
# . . . . . . . . . . . . . . . . . .
# .                                 .
# .   <<><><>    <<><><>  <<        .
# .   <<    ><   <<       <<        .
# .   <<><><>    <<><><   <<        .
# .   <<  ><     <<       <<        .
# .   <<   <>    <<       <<        .
# .   <<    ><   <<       <<><><>   .
# .                                 .
# .             GKR 2016/17         .
# . . . . . . . . . . . . . . . . . .
# 
# Created on 10.12.2016
# 
# @author: kathrind, stefanap
unload_abb_communication_lib = Button()
py = PythonScript(unload=unload_abb_communication_lib)
# ---------- py: Python ----------
from abb_communication.useful import unload_rfl_lib

if unload:
    unload_rfl_lib()
# ---------- end py ----------

pt = Point(Point(-0.4295600592, 0.7983398464, 369.3904607))
crv = Curve(<curve referenced from the Rhino model>)
crv_2 = Curve(<curve referenced from the Rhino model>)
pl = ConstructPlane(Origin=pt, XAxis=crv_2, YAxis=crv)

# ----
# frame to plane
button = Button()
frame = PythonScript(init=button)  # -> out, frame
# ---------- frame: Python ----------
from abb_communication.geometry import Frame

import Rhino.Geometry as rg


frame = Frame(draw_geo = True)
# ---------- end frame ----------
python = PythonScript(frame=frame.frame)  # -> out, xa, ya, za, plane
# ---------- python: Python ----------
#pose_tool_v = [128.969, 246.023, 358.84, 0.692736, -0.363623, 0.0140559, -0.622654]
pose_vakgrip_vert_m1 = [-11.1463, 63.3699, 319.265, 0.610901, -0.614651, 0.353847, -0.351848]

#pose_gripper_corner = [-57.9328, 123.417, 338.146, 0.701441, 0.701351, 0.0935002, 0.0857094]
#pose_gripper_corner = [-57.6187,123.797,338.443,0.701887,0.701227,0.0916058,0.0851124]
pose_gripper_rob1 = [0.0905273,1.59452,332.474,0.00161999,0.00138947,-0.710535,-0.703659]
pose_gripper_mas = [-0.296848,0.393448,349.395,0.494737,-0.501492,0.495089,-0.508555]

frame.set_to_pose_quaternion(pose_gripper_mas)

xa = frame.x_axis
ya = frame.y_axis
za = frame.z_axis

plane = frame.get_plane()
# ---------- end python ----------
line = Line(python.za)
line_2 = Line(python.xa)
line_3 = Line(python.ya)
group = Group(Objects=[line_2, line_3, line])
preview = CustomPreview(Geometry=line_3, Shader=ColourSwatch(SwatchColor=RGB(163, 255, 197)))
preview_2 = CustomPreview(Geometry=line_2, Shader=ColourSwatch(SwatchColor=RGB(255, 150, 150)))
preview_3 = CustomPreview(Geometry=line, Shader=ColourSwatch(SwatchColor=RGB(15, 27, 255)))

# ----
# plane to frame
button_2 = Button()
frame_2 = PythonScript(init=button_2)  # -> out, frame; same code as frame
gplane = Plane(pl)
python_2 = PythonScript(frame=frame_2.frame, gripper_plane=gplane)  # -> out, toolframe_arr, xa, ya, za
# ---------- python_2: Python ----------
# quat tool v = 0.692736, -0.363623, 0.0140559, -0.622654
import math

frame.set_to_plane(gripper_plane)

xa = frame.x_axis
ya = frame.y_axis
za = frame.z_axis

toolframe_arr = frame.get_pose_quaternion()
#print toolframe_arr
t = [round(t, 5) for t in toolframe_arr]

print( "gripperframe: [[%.5f, %.5f, %.5f] , [%.5f, %.5f, %.5f, %.5f]]" % (t[0], t[1],t[2],t[3],t[4],t[5],t[6]))
# ---------- end python_2 ----------
line_4 = Line(python_2.ya)
line_5 = Line(python_2.za)
line_6 = Line(python_2.xa)
panel = Panel(python_2.out)
preview_4 = CustomPreview(Geometry=line_6, Shader=ColourSwatch(SwatchColor=RGB(255, 150, 150)))
preview_5 = CustomPreview(Geometry=line_4, Shader=ColourSwatch(SwatchColor=RGB(163, 255, 197)))
preview_6 = CustomPreview(Geometry=line_5, Shader=ColourSwatch(SwatchColor=RGB(15, 27, 255)))

pln = Plane(python.plane)
