# Grasshopper definition 170322_ABB_RFLControl_MAS.gh (Grasshopper 0.9.76)
# plug-ins: Python Interpreter

safe_conf = Panel("""-90.0
0.0
0.0
0.0
0.0
0.0
264.0
-9700.0
-4060.0""")
rob_01 = Plane(flatten([Plane(origin=(22624.31217, 6551.220909, 1786.60254), x=(-1, 0, 0), y=(0, 0.8660254038, 0.5)), Plane(origin=(22624.31217, 6557.470909, 1775.777223), x=(-1, 0, 0), y=(0, 0.8660254038, 0.5)), Plane(origin=(22624.31217, 6563.720909, 1764.951905), x=(-1, 0, 0), y=(0, 0.8660254038, 0.5)), Plane(origin=(22624.31217, 6569.970909, 1754.126588), x=(-1, 0, 0), y=(0, 0.8660254038, 0.5)), Plane(origin=(22624.31217, 6576.220909, 1743.30127), x=(-1, 0, 0), y=(0, 0.8660254038, 0.5))]))
pln = Plane(Plane(origin=(22624.31217, 6551.220909, 1786.60254), x=(-1, 0, 0), y=(0, 0.8660254038, 0.5)))

# ----
# angleB
# speed
# data for further calculation
# set path
# set path
# set path
# set path
# set path
# set path
# set path
# force
# force
# force
# force
# force
# force
# angleA
# angleA
# angleA
# angleA
# angleA
# angleA
# angleB
# angleB
# angleB
# angleB
# angleB
# angleB
# speed
# speed
# speed
# speed
# speed
# speed
# force
# force
# force
# force
# force
# force
# angleA
# angleA
# angleA
# angleA
# angleA
# angleA
# angleA
# angleA
# angleA
# angleA
# angleA
# angleA
# angleA
# angleB
# angleB
# angleB
# angleB
# angleB
# angleB
# speed
# speed
# speed
# speed
# speed
# speed
# speed
# speed
# speed
# speed
# speed
# speed
# speed
# data for further calculation
# data for further calculation
# data for further calculation
# data for further calculation
# data for further calculation
# data for further calculation
# . . . . . . . . . . . . . . . . . .
# .                                 .
# .   <<><><>    <<><><>  <<        .
# .   <<    ><   <<       <<        .
# .   <<><><>    <<><><   <<        .
# .   <<  ><     <<       <<        .
# .   <<   <>    <<       <<        .
# .   <<    ><   <<       <<><><>   .
# .                                 .
# .             GKR 2016/17         .
# . . . . . . . . . . . . . . . . . .
# 
# Created on 10.12.2016
# 
# @author: kathrind, stefanap
unload_abb_communication_lib = Button()
py = PythonScript(unload=unload_abb_communication_lib)
# ---------- py: Python ----------
from abb_communication.useful import unload_rfl_lib

if unload:
    unload_rfl_lib()
# ---------- end py ----------

# ----
# material resistance
# force
# angleA
# angleB
# speed
# force
number_slider = Slider(10000, range=0..10000)
number_slider_2 = Slider(16120, range=0..100000)
number_slider_3 = Slider(1000, range=0..1000)
gantry = Panel("""264.0
-9800.0
-40600.0""")
pln_2 = Plane(rob_01)
panel = Panel(pln_2)
gantry_2 = Panel("""16117.0
-9000.0
-3500.0""")
pt = ConstructPoint(XCoordinate=number_slider_2, YCoordinate=Slider(9800, range=0..10000), ZCoordinate=number_slider_3)
# angleA
# angleB
# speed
# material resistance
# force
# angleA
# angleB
# speed
# force
# angleA
# angleB
# speed
phi = Slider(0, range=-360..360)  # disabled
Y = UnitY(Factor="-1.0")
pt_2 = ConstructPoint(XCoordinate=number_slider_2, YCoordinate=number_slider, ZCoordinate=number_slider_3)
safe_config = Panel("""15.91
-75.71
2.62
35.40
-104.68
99.20
16526.69
-4284.98
-3329.26""")  # disabled
gantry_pick = Panel("""16526.69
-4285.00
-2900.00""")  # disabled
lng = ListLength(List=pln_2)
pl = ConstructPlane(Origin=pt, XAxis=Vector(1, 0, 0), YAxis=Y)

pt_3 = ConstructPoint(XCoordinate=0, YCoordinate=0, ZCoordinate=0)  # disabled
brick_class_center_origin = PythonScript(origin_pt=pt_3, phi=phi)  # -> out, a, b, Brick; inputs origin_pt: Point3d; disabled
# ---------- brick_class_center_origin: Python ----------
import Rhino.Geometry as rg
import math as m

from scriptcontext import sticky


class Brick:
    """Brick Class.
    """
    def __init__(self, origin_pt, x_size = 245, y_size = 115, z_size = 70, phi = 0, gr_pln_off = 0):
        self.o = origin_pt
        self.oplane = rg.Plane(self.o, rg.Vector3d.ZAxis)
        
        self.x = x_size
        self.y = y_size
        self.z = z_size
        
        self.gr_pln_off = gr_pln_off
        self.r = m.radians(phi)
        self.rplane = self.get_oriented_plane()
        
        self.mesh = self.generate_mesh()
        self.c = None
        
        self.gripping_plane = self.get_gripping_plane()
        
        self.outline = self.generate_outline()
    
    def get_oriented_plane(self):
        R = rg.Transform.Rotation(self.r, self.oplane.ZAxis, self.o)
        rplane = rg.Plane(self.oplane)
        rplane.Transform(R)
        return rplane
    
    def get_gripping_plane(self):
        temp_o = self.rplane.Origin + self.rplane.ZAxis * self.gr_pln_off
        temp_plane = rg.Plane(temp_o, -self.rplane.XAxis, self.rplane.YAxis)
        return temp_plane
    
    def generate_mesh(self):
        temp_mesh = rg.Mesh()
        
        corner_1 = self.o -  self.rplane.XAxis * self.x / 2 - self.rplane.YAxis * self.y / 2
        self.mesh_add_pt(temp_mesh, corner_1)
        corner_2 = self.o + self.rplane.XAxis * self.x / 2 - self.rplane.YAxis * self.y / 2
        self.mesh_add_pt(temp_mesh, corner_2)
        corner_3 = self.o + self.rplane.XAxis * self.x / 2 + self.rplane.YAxis * self.y / 2
        self.mesh_add_pt(temp_mesh, corner_3)
        corner_4 = self.o - self.rplane.XAxis * self.x / 2 + self.rplane.YAxis * self.y / 2
        self.mesh_add_pt(temp_mesh, corner_4)
        
        
        corner_5 = self.o - self.rplane.XAxis * self.x / 2 - self.rplane.YAxis * self.y / 2 + self.rplane.ZAxis * self.z
        self.mesh_add_pt(temp_mesh, corner_5)
        corner_6 = self.o + self.rplane.XAxis * self.x / 2 - self.rplane.YAxis * self.y / 2 + self.rplane.ZAxis * self.z
        self.mesh_add_pt(temp_mesh, corner_6)
        corner_7 = self.o + self.rplane.XAxis * self.x / 2 + self.rplane.YAxis * self.y / 2 + self.rplane.ZAxis * self.z
        self.mesh_add_pt(temp_mesh, corner_7)
        corner_8 = self.o - self.rplane.XAxis * self.x / 2 + self.rplane.YAxis * self.y / 2 + self.rplane.ZAxis * self.z
        self.mesh_add_pt(temp_mesh, corner_8)
        
        
        temp_mesh.Faces.AddFace(0, 1, 2, 3)
        temp_mesh.Faces.AddFace(0, 1, 5, 4)
        temp_mesh.Faces.AddFace(1, 2, 6, 5)
        temp_mesh.Faces.AddFace(2, 3, 7, 6)
        temp_mesh.Faces.AddFace(3, 0, 4, 7)
        temp_mesh.Faces.AddFace(4, 5, 6, 7)
        
        temp_mesh.Unweld(10.0, False)
        
        return temp_mesh
    
    def mesh_add_pt(self, mesh, pt):
        mesh.Vertices.Add(pt[0], pt[1], pt[2])
    
    def generate_outline(self):
        temp_pts = []
        temp_pts.append(rg.Point3d(self.mesh.Vertices[0]))
        temp_pts.append(rg.Point3d(self.mesh.Vertices[1]))
        temp_pts.append(rg.Point3d(self.mesh.Vertices[2]))
        temp_pts.append(rg.Point3d(self.mesh.Vertices[3]))
        temp_pts.append(rg.Point3d(self.mesh.Vertices[0]))
        
        temp_pline = rg.Curve.CreateInterpolatedCurve(temp_pts, 1)
        return temp_pline
    
    def check_crvcrv_intersection(self, other_brick):
        res = rg.Intersect.Intersection.CurveCurve(self.outline, other_brick.outline, 5.0, 5.0)
        return res


if __name__ == '__main__':
    my_brick = Brick(origin_pt, phi = phi)
    a = my_brick.mesh
    b = my_brick.gripping_plane
# ---------- end brick_class_center_origin ----------

pl_2 = ConstructPlane(Origin=pt_2, XAxis=Vector(1, 0, 0), YAxis=Y)
pln_3 = Plane(Plane(origin=(16901.75, 3296.84, -0.84), x=(-0.9999894201, -5.335964593e-06, -0.004599969476), y=(5.335964593e-06, 0.9999973088, -0.002319984606)))
safe_config_2 = Panel("""57
-73.96
-0.16
35.13
-103.96
98.63
16526.69
-4285.0
-3500.0""")  # disabled
python = PythonScript(x=gantry, y=lng)  # -> out, flatten(a); inputs x: list
# ---------- python: Python ----------
a = []
for i in range(y):
    a.append(x)
    
print a
# ---------- end python ----------
panel_2 = Panel(pln_3)  # disabled

# ----
# Define plane sequence WCS
number_slider_4 = Slider(30, range=0..100)
crv = Curve(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)
pframes = PerpFrames(Curve=crv, Count=number_slider_4, Align=True)  # -> Frames, Parameters
reorient_planes = PythonScript(F=pframes.Frames)  # -> out, F; inputs F: list of Plane
# ---------- reorient_planes: Python ----------
import Rhino.Geometry as rg
import math as m



[f.Rotate(m.radians(90), f.XAxis, f.Origin) for f in F]
[f.Rotate(m.radians(90), f.ZAxis, f.Origin) for f in F]
# ---------- end reorient_planes ----------

geo = Geometry(brick_class_center_origin.a)  # disabled

# ----
# tools
list = ValueList({"mm tool": 0, "lws gripper": 1, "rth gripper": 2}, selected="lws gripper")

timer = Timer(TimerInterval=100, Target=button)  # disabled
pt_4 = ConstructPoint(XCoordinate=0, YCoordinate=0, ZCoordinate=0)  # disabled

# ----
# RFL robot
list_2 = ValueList({"192.168.125.1", "127.0.0.1", "192.168.0.21", "192.168.0.11"}, selected="192.168.0.21")
init = Button()
rfl = RFL(init=init, ip_abb=list_2)

srf = Surface(reparameterize(<surface referenced from the Rhino model>))  # disabled
number_slider_5 = Slider(3, range=1..4)  # disabled
Z = UnitZ(Factor=1)  # disabled
number_slider_6 = Slider(0, range=0..304)  # disabled
evalsrf = EvaluateSurface(Surface=srf, Point=pt_4)  # -> Point, Normal, Frame; disabled
set_speed_slow = Button()  # disabled
set_speed_mid = Button()  # disabled
send_bricks_all = Button()  # disabled
set_speed_fast = Button()  # disabled
list_3 = ValueList({"tool_0": 0, "tool_meshmould": 1, "tool_mtip": 6, "tool_lws_gripper": 7, "tool_rth_gripper": 8, "tool_mas_gripper": 9, "tool_mas_magazine": 10}, selected="tool_mas_magazine")  # disabled
send_brick = Button()  # disabled
pick_up = BooleanToggle(False)  # disabled
list_4 = ValueList({"wobj_0": 0, "wobj_common": 1, "wobj_base": 2, "wobj_stu_pick": 3, "wobj_stu_base": 4}, selected="wobj_0")  # disabled
set_wobj = Button()  # disabled
set_tool = Button()  # disabled
tool = Tool(int=list, init=init)

cluster = Cluster(init=init)
set_tool_and_base = PythonScript(robot=rfl, tool=tool, gantry=cluster)  # -> out, robot, gantry_geo, tool_geo
# ---------- set_tool_and_base: Python ----------
from scriptcontext import sticky as st


robot.set_tool(tool)
robot.set_gantry(gantry)
#robot.set_robot_origin(base_plane1, 1)
# set_robot_origin_with_measured_base(self, base_plane):

st["rfl_robot"] = robot

tool_geo = tool.geo
gantry_geo = gantry.geo
# ---------- end set_tool_and_base ----------
mesh = Mesh(set_tool_and_base.tool_geo)
mesh_2 = Mesh(set_tool_and_base.gantry_geo)

send_current_robot_tool_pose_joint_multi = Button()  # "send current robot tool pose joint multiple"
# RFL communication
send_current_robot_tool_pose_multiple = Button()
send_current_robot_tool_pose_joint = Button()
send_current_robot_tool_pose = Button()
list_5 = ValueList({"joints_meshmould_left_low": "98.54 -20.98 45.48 0.0 65.50 68.54", "joints_meshmould_left_high": "98.54 -23.4 23.9 0.0 89.50 68.54", "joints_meshmould_right_low": "-81.46 -20.98 45.48 0.0 65.50 68.54", "joints_meshmould_parking_high": "0 -20.98 45.48 0.0 65.50 -111.46", "joints_meshmould_parking_mid": "0 -60.94 66.90 0.0 84.28 63.15", "joints_meshmould_parking_low": "0 -70.8 72.19 0.0 88.92 61.82"}, selected="joints_meshmould_parking_high")
send_robot_joints_absolute = Button()
send_robot_joints_relative = Button()
stepsize = Slider(5, range=-180..180)
stepsize_2 = Slider(-100, range=-14000..14000)
axis_1_6 = Slider(9, range=1..9)
set_joint_6_to_zero = Button()
set_speed_slow_2 = Button()
set_speed_mid_2 = Button()
set_speed_fast_2 = Button()
list_6 = ValueList({"tool_0": 0, "tool_meshmould": 1, "tool_mtip": 6, "tool_lws_gripper": 2, "tool_rth_gripper": 3}, selected="tool_0")
list_7 = ValueList({"wobj_0": 0, "wobj_common": 1, "wobj_base": 2, "wobj_stu_pick": 3, "wobj_stu_base": 4}, selected="wobj_0")
set_wobj_2 = Button()
set_tool_2 = Button()
expression = Expression(x=axis_1_6, y=stepsize, z=stepsize_2, Expression="If(x < 7, y, z)")
refresh_text_window = Button()
reset_robot = Button()
r_on = Button()
r_off = Button()
if_connection = PythonScript(
    robot=set_tool_and_base.robot,
    connect_robot=r_on,
    close_robot=r_off,
    refresh=refresh_text_window,
    reset_robot=reset_robot)  # -> out; inputs connect_robot: Boolean, close_robot: Boolean, refresh: Boolean
# ---------- if_connection: Python ----------
import Rhino.Geometry as rg
from abb_communication.clients.rfl_robot.communication.messages.clientstates import *

print robot.comm.running

# =========================================================================================    
if connect_robot == True:
    if robot.comm.running == False:
        robot.comm.start()
    else:
        pass

# =========================================================================================    
if close_robot == True:
    if robot.comm.running == True:
        robot.comm.close()
        robot.comm.cmd_counter_to_client = 0
        robot.comm.cmd_exec_counter_from_client = 0
        robot.comm.publish_state(1)
    else:
        pass

if reset_robot:
    robot.comm.close()
    robot.comm.cmd_counter_to_client = 0
    robot.comm.cmd_exec_counter_from_client = 0
    robot.comm.publish_state(1)
    try:
        robot.comm.start()
    except:
        print "CONNECTION TO ABB FAILED"

robot_conncection_state = "online" if robot.comm.running else "offline"
print "ABB CONNECTION STATE:", robot_conncection_state
print "ABB STATE: ", client_states_str_array[robot.comm.state]
print "Sent commands to ABB: ",  robot.comm.get_cmd_counter()
print "Executed commands from ABB: ",  robot.comm.cmd_exec_counter_from_client
# ---------- end if_connection ----------
panel_3 = Panel(if_connection)

x_size = Slider(245, range=0..1000)  # disabled
y_size = Slider(115, range=0..1000)  # disabled
z_size = Slider(70, range=0..1000)  # disabled
contour = Contour(Shape=srf, Point=evalsrf.Point, Direction=Z, Distance=z_size)  # -> flatten(Contours); disabled
number_slider_7 = Slider(25, range=0..100)  # disabled
z_off = Slider(0, range=-100..100)  # disabled
curves = Curve(contour)  # disabled

# ----
# Calculation planes and poses
ur_poses = PythonScript(robot=set_tool_and_base.robot, planes_tool_WCS=reorient_planes.F, idx=Slider(30, range=0..30), init=Button())  # -> origin_plane, planes_tool_WCS, planes_tool_RCS, planes_tool0_RCS, poses_tool_RCS, plane_at_idx_WCS, tool_geo_on_plane_at_idx_WCS, tool_geo_colors; inputs planes_tool_WCS: list of Plane, idx: Int32
# ---------- ur_poses: Python ----------
import Rhino.Geometry as rg
import ghpythonlib.components as ghcomp

origin_plane_1 = robot.origin_plane_1
origin_plane_2 = robot.origin_plane_2

planes_tool_RCS_1 = [robot.get_tool_plane_in_RCS(tp_WCS, 1) for tp_WCS in planes_tool_WCS]
planes_tool_RCS_2 = [robot.get_tool_plane_in_RCS(tp_WCS, 2) for tp_WCS in planes_tool_WCS]

planes_tool0_RCS_1 = [robot.get_tool0_plane_in_RCS(tp_WCS, 1) for tp_WCS in planes_tool_WCS]
planes_tool0_RCS_2 = [robot.get_tool0_plane_in_RCS(tp_WCS, 2) for tp_WCS in planes_tool_WCS]

poses_tool_RCS_1 = [robot.get_tool_pose_in_RCS(tp_WCS, 1) for tp_WCS in planes_tool_WCS]
poses_tool_RCS_2 = [robot.get_tool_pose_in_RCS(tp_WCS, 2) for tp_WCS in planes_tool_WCS]

"""
ur_tool_geo_on_planes_WCS_nested = [robot.tool.get_transformed_geo_trfd(rg.Transform.PlaneToPlane(rg.Plane.WorldXY, tp_WCS)) for tp_WCS in ur_planes_tool_WCS]
ur_tool_geo_on_planes_WCS = [x for sublist in ur_tool_geo_on_planes_WCS_nested for x in sublist]

ur_tool_geo_on_planes_RCS_nested = [robot.tool.get_transformed_geo_trfd(rg.Transform.PlaneToPlane(rg.Plane.WorldXY, tp_RCS)) for tp_RCS in ur_planes_tool_RCS]
ur_tool_geo_on_planes_RCS = [x for sublist in ur_tool_geo_on_planes_RCS_nested for x in sublist]"""

plane_at_idx_WCS = planes_tool_WCS[idx]
T = rg.Transform.PlaneToPlane(rg.Plane.WorldXY, plane_at_idx_WCS)

tool_geo_on_plane_at_idx_WCS = robot.tool.get_transformed_geo_WCS(T)
tool_geo_colors = robot.tool.colors
print tool_geo_colors
# ---------- end ur_poses ----------
pln_4 = Plane(ur_poses.plane_at_idx_WCS)
geo_2 = Geometry(ur_poses.tool_geo_on_plane_at_idx_WCS)
planesrf = PlaneSurface(Plane=ur_poses.planes_tool_WCS, XSize=Domain(-10, 10), YSize=Domain(-10, 10))
preview = CustomPreview(Geometry=geo_2, Shader=ur_poses.tool_geo_colors)

int = Integer(expression)
if_sender = PythonScript(
    init=init,
    plane=pl,
    ext_axes=gantry_2,
    list_planes=pln_2,
    list_ext_axes=python.a,
    set_speed_fast=set_speed_fast_2,
    set_speed_mid=set_speed_mid_2,
    set_speed_slow=set_speed_slow_2,
    send_current_tool_pose=send_current_robot_tool_pose,
    send_current_tool_poses_mult=send_current_robot_tool_pose_multiple,
    sent_current_tool_pose_joints=send_current_robot_tool_pose_joint,
    send_current_tool_poses_joints_mult=send_current_robot_tool_pose_joint_multi,
    send_joints_absolute=send_robot_joints_absolute,
    joints_abb=safe_config,
    send_joints_rel=simplify(send_robot_joints_relative),
    joint=axis_1_6,
    relative_angle=int,
    set_joint_6_to_zero=set_joint_6_to_zero,
    set_tool=set_tool_2,
    tool_num=list_6,
    set_wobj=set_wobj_2,
    wobj_num=list_7,
    rob_num=Slider(3, range=1..4))  # -> out, a; inputs ext_axes: list, list_planes: list, list_ext_axes: list, send_current_tool_pose: Boolean, joints_abb: list, joint: Int32, set_tool: Boolean, tool_num: Int32
# ---------- if_sender: Python ----------
from abb_communication.clients.rfl_robot.communication.messages.messagetypes import *
import Rhino.Geometry as rg
from abb_communication.geometry import Frame
from scriptcontext import sticky as st
import math as m
from threading import Thread
import time

print ext_axes


robot = st["rfl_robot"]
#print joints_abb
if robot:    
    
    robot.comm.float_arbitrary = rob_num
    
    if set_speed_fast:
        print "SET SPEED FAST"
        robot.comm.set_speed_fast()
    if set_speed_mid:
        print "SET SPEED MID"
        robot.comm.set_speed_mid()
    if set_speed_slow:
        print "SET SPEED SLOW"
        robot.comm.set_speed_slow()
    
    if set_tool:
        if tool_num == 0:
            print "SET TOOL 0"
            robot.comm.set_tool0()
        elif tool_num == 1:
            print "SET TOOL MESH MOULD"
            robot.comm.set_tool_meshmould()
        elif tool_num == 6:
            print "SET TOOL MTIP"
            robot.comm.set_tool_mtip()
        elif tool_num == 7:
            print "SET TOOL LWS GRIPPER"
            robot.comm.set_tool_lws_gripper()
        elif tool_num == 8:
            print "SET TOOL STU GRIPPER"
            robot.comm.set_tool_stu_gripper()
        else:
            print "WRONG TOOL NUM"
    
    if set_wobj:
        if wobj_num == 0:
            print "SET WOBJ 0"
            robot.comm.set_wobj_0()
        elif wobj_num == 1:
            print "SET WOBJ LWS COMMON"
            robot.comm.set_wobj_common()
        elif wobj_num == 2:
            print "SET WOBJ BASE"
            robot.comm.set_wobj_base()
        elif wobj_num == 3:
            print "SET WOBJ STU PICK"
            robot.comm.set_wobj_stu_pick()
        elif wobj_num == 4:
            print "SET WOBJ STU BASE"
            robot.comm.set_wobj_stu_base()
        else:
            print "WRONG TOOL NUM"
    
    # =========================================================================================
    # =========================================================================================
    if robot.comm.running:
        print "ROBOT IS ONLINE"
        # =========================================================================================
        if send_current_tool_pose:
            robot.float_arbitrary = int(rob_num)
            print "axes_ext", ext_axes
            test = robot.comm.send_pose_cartesian(plane, ext_axes)
            print test
        if sent_current_tool_pose_joints:
            robot.float_arbitrary = int(rob_num)
            test = robot.comm.send_pose_cartesian_joints(plane, ext_axes)
            print test
        if send_current_tool_poses_mult:
            print list_planes
            print list_ext_axes
            robot.float_arbitrary = int(rob_num)
            test = robot.comm.send_pose_cartesian_list(list_planes, list_ext_axes)
            print test
        if send_current_tool_poses_joints_mult:
            robot.float_arbitrary = int(num_rob)
            robot.comm.send_pose_cartesian_joints_list(list_planes, list_ext_axes)
            
        if send_joints_rel:
            robot.float_arbitrary = int(rob_num)
            print "joints rel"
            joints = [0,0,0,0,0,0,0,0,0]
            joints[joint-1] = relative_angle
            test = robot.comm.send_axes_relative(joints, int_arr = None)
            print test
            
        if send_joints_absolute:
            robot.float_arbitrary = int(rob_num)
            #joints_abb_list = [float(x) for x in joints_abb.split()]
            joints_abb_list = [float(x) for x in joints_abb]
            robot.comm.send_axes_absolute(joints_abb_list, int_arr = None)
        
        if set_joint_6_to_zero:
            robot.float_arbitrary = int(rob_num)
            posej = robot.comm.get_current_pose_joint()
            posej_deg = [m.degrees(j) for j in posej]
            posej_deg[5] = 0
            #posej_deg[3] = 0
            robot.comm.send_axes_absolute(posej_deg, int_arr = None)       
        
            
    else:
        print "ROBOT IS OFFLINE"
# ---------- end if_sender ----------
running_bond = PythonScript(
    Brick=brick_class_center_origin.Brick,
    curves=curves,
    x_size=x_size,
    y_size=y_size,
    z_size=z_size,
    h_buffer=number_slider_7,
    gr_pln_off=z_off)  # -> out, brick_count, complete_mesh, gripping_planes; inputs curves: list of Curve, x_size: Int32, y_size: Int32, z_size: Int32, h_buffer: Int32; disabled
# ---------- running_bond: Python ----------
import Rhino.Geometry as rg
import math as m
import rhinoscriptsyntax as rs

test_geom = []

class BrickLab:
    """Design Class
    """
    def __init__(self):
        self.bricks = []
        self.b_array = []
        
        self.sequence = []
        self.s_array = []
        self.gripping_planes = []
        
        self.mesh = rg.Mesh()
    
    def compute_brick_wall_from_curves(self, curves, brick_length, h_buffer):
        temp_layer = []
        
        for n,curve in enumerate(curves):
            temp_params = curve.DivideByLength((brick_length + h_buffer) / 2, False)
            if temp_params != None:
                temp_pts = [curve.PointAt(p) for p in temp_params]
            else:
                continue
            self.temp_pts = temp_pts
            for i, pt in enumerate(temp_pts):
                
                ##############################
                # generating the Running Bond#
                ##############################
                
                tangent = curve.TangentAt(temp_params[i])
                angle = rs.Angle([0,0,0],tangent)[0]
                
                #even layers
                if (n%2 == 0 and i%2 == 0):
                    brick_object = Brick(pt, phi = angle, gr_pln_off = gr_pln_off)
                    self.bricks.append(brick_object)
                    temp_layer.append(brick_object)
                    self.gripping_planes.append(brick_object.gripping_plane)
                
                #odd layers
                if (n%2 == 1 and i%2 == 1):
                    brick_object = Brick(pt, phi = angle, gr_pln_off = gr_pln_off)
                    self.bricks.append(brick_object)
                    temp_layer.append(brick_object)
                    self.gripping_planes.append(brick_object.gripping_plane)
                
                #end condition left
                if (n%2 == 1 and i == 0):
                    brick_object_temp = Brick(pt, phi = angle)
                    pt = pt - brick_object_temp.rplane.XAxis * (brick_object_temp.x + h_buffer)/4
                    brick_object = Brick(pt, phi = angle - 90, gr_pln_off = gr_pln_off)
                    
                    self.bricks.append(brick_object)
                    temp_layer.append(brick_object)
                    self.gripping_planes.append(brick_object.gripping_plane)
                
                #end condition right
                if (n%2 == 1 and i == len(temp_pts) - 1):
                    brick_object_temp = Brick(pt, phi = angle)
                    pt = pt + brick_object_temp.rplane.XAxis * (brick_object_temp.x + h_buffer)/4
                    brick_object = Brick(pt, phi = angle + 90, gr_pln_off = gr_pln_off)
                    
                    self.bricks.append(brick_object)
                    temp_layer.append(brick_object)
                    self.gripping_planes.append(brick_object.gripping_plane)
                    
            self.b_array.append(temp_layer)
        
        self.generate_mesh()
    
    def generate_mesh(self):
        for bl in self.b_array:
            for b in bl:
                self.mesh.Append(b.mesh)
    
    def generate_sequence(self):
        None


myBrickLab = BrickLab()
myBrickLab.compute_brick_wall_from_curves(curves, x_size, h_buffer)
complete_mesh = myBrickLab.mesh
brick_count = len(myBrickLab.bricks)

temp_pts = myBrickLab.temp_pts
gripping_planes = myBrickLab.gripping_planes
# ---------- end running_bond ----------
swatch = ColourSwatch(SwatchColor=RGB(255, 255, 255))  # disabled
medges = MeshEdges(Mesh=running_bond.complete_mesh)  # -> NakedEdges, InteriorEdges, NonManifoldEdges; disabled
panel_4 = Panel(running_bond.brick_count)  # disabled
mesh_3 = Mesh(running_bond.complete_mesh)  # disabled
panel_5 = Panel(if_sender.out)
gripping_planes = Geometry(running_bond.gripping_planes)  # disabled
pln_5 = Plane(flatten(gripping_planes))  # disabled
python_2 = PythonScript(planes=pln_5)  # -> out, simplify(gantry_values), values_copy; inputs planes: list; disabled
# ---------- python_2: Python ----------
import Rhino

gantry_values = []
for p in planes:
    origin = p.Origin
    x_axis = 16526.69
    y_axis = (origin.Y + 700.0) * -1
    z_axis = (origin.Z + 2500.0) * -1
    if z_axis < -4900.0:
        z_axis = -4900.0
    if y_axis > 0.0:
        y_axis = 0.0
    
    gantry_values.append([x_axis, y_axis, z_axis])
    #values_copy = {"x": x_axis, "y": y_axis, "z": z_axis}
# ---------- end python_2 ----------

number_slider_8 = Slider(0, range=0..20)  # disabled
item = ListItem(List=pln_5, Index=number_slider_8, Wrap=True)  # disabled

python_3 = PythonScript(x=python_2.gantry_values, y=number_slider_8)  # -> out, a; inputs x: list; disabled
# ---------- python_3: Python ----------
a = x[int(y)]

print a
# ---------- end python_3 ----------
python_4 = PythonScript(
    safe_config=safe_config_2,
    send_brick=send_brick,
    start_pos=number_slider_6,
    send_bricks_all=send_bricks_all,
    pick_up=pick_up,
    plane_pick=pln_3,
    ext_axes_pick=gantry_pick,
    plane_place=item,
    ext_axes_place=python_3.a,
    list_planes_place=pln_5,
    list_ext_axes_place=python_2.gantry_values,
    set_speed_fast=set_speed_fast,
    set_speed_mid=set_speed_mid,
    set_speed_slow=set_speed_slow,
    set_tool=set_tool,
    tool_num=list_3,
    set_wobj=set_wobj,
    wobj_num=list_4,
    rob_num=number_slider_5)  # -> out, a; inputs safe_config: list of Int32, start_pos: Int32, ext_axes_pick: list, ext_axes_place: list, list_planes_place: list, list_ext_axes_place: list; disabled
# ---------- python_4: Python ----------
from abb_communication.clients.rfl_robot.communication.messages.messagetypes import *
import Rhino.Geometry as rg
from abb_communication.geometry import Frame
from scriptcontext import sticky as st
import math as m
from threading import Thread
import time
import rhinoscriptsyntax as rs

robot = st["rfl_robot"]
#print ext_axes_pick
print list_planes_place[3]

if robot:    
    
    robot.comm.float_arbitrary = rob_num
    
    if set_speed_fast:
        print "SET SPEED FAST"
        robot.comm.set_speed_fast()
    if set_speed_mid:
        print "SET SPEED MID"
        robot.comm.set_speed_mid()
    if set_speed_slow:
        print "SET SPEED SLOW"
        robot.comm.set_speed_slow()
    
    if set_tool:
        if tool_num == 0:
            print "SET TOOL 0"
            robot.comm.set_tool0()
        elif tool_num == 1:
            print "SET TOOL MESH MOULD"
            robot.comm.set_tool_meshmould()
        elif tool_num == 6:
            print "SET TOOL MTIP"
            robot.comm.set_tool_mtip()
        elif tool_num == 7:
            print "SET TOOL LWS GRIPPER"
            robot.comm.set_tool_lws_gripper()
        elif tool_num == 8:
            print "SET TOOL STU GRIPPER"
            robot.comm.set_tool_stu_gripper()
        elif tool_num == 9:
            print "SET TOOL MAS GRIPPER"
            robot.comm.set_tool_mas_gripper()
        elif tool_num == 10:
            print "SET TOOL MAS MAGAZINE"
            robot.comm.set_tool_mas_magazine()
        else:
            print "WRONG TOOL NUM"
    
    if set_wobj:
        if wobj_num == 0:
            print "SET WOBJ 0"
            robot.comm.set_wobj_0()
        elif wobj_num == 1:
            print "SET WOBJ LWS COMMON"
            robot.comm.set_wobj_common()
        elif wobj_num == 2:
            print "SET WOBJ BASE"
            robot.comm.set_wobj_base()
        elif wobj_num == 3:
            print "SET WOBJ STU PICK"
            robot.comm.set_wobj_stu_pick()
        elif wobj_num == 4:
            print "SET WOBJ STU BASE"
            robot.comm.set_wobj_stu_base()
        else:
            print "WRONG TOOL NUM"
            
    # =========================================================================================
    # =========================================================================================
    if robot.comm.running:
        print "ROBOT IS ONLINE"
        # =========================================================================================
        #if send_brick:
            #print "send a brick"
            #robot.float_arbitrary = int(rob_num)
            #ext_axes_pick = [float(a) for a in ext_axes_pick]
            #ext_axes_place = [float(a) for a in ext_axes_place]
            #safe_config = [float(a) for a in safe_config]
            #if pick_up:
            #    robot.comm.send_axes_absolute(safe_config)
            #    robot.comm.send_mas_pick_brick_magazine(plane_pick, ext_axes_pick)
            #    robot.comm.send_axes_absolute(safe_config)
            #robot.comm.send_mas_place_brick_magazine(plane_place, ext_axes_place)
        
        if send_bricks_all:
            print "send all bricks"
            robot.float_arbitrary = int(rob_num)
            ea_pick = [float(a) for a in ext_axes_pick]
            safe_config_i = [float(a) for a in safe_config]
            for i in range(int(start_pos), len(list_planes_place)):
                if i%6 == 0:
                    robot.comm.send_axes_absolute(safe_config_i)
                    robot.comm.wait_for_state_ready(0.2)
                    robot.comm.send_mas_pick_brick_magazine(plane_pick, ea_pick)
                    robot.comm.wait_for_state_ready(0.2)
                    robot.comm.send_axes_absolute(safe_config_i)
                    robot.comm.wait_for_state_ready(0.2)
                    
                ea_place = [float(a) for a in list_ext_axes_place[i]]
                robot.comm.send_mas_place_brick_magazine(list_planes_place[i], ea_place)
                robot.comm.wait_for_state_ready(0.2)
# ---------- end python_4 ----------
panel_6 = Panel(python_4.out)  # disabled
preview_2 = CustomPreview(Geometry=medges.NonManifoldEdges, Shader=swatch)  # disabled

# ----
# Select input for
# representation
button = Button()

front = Slider(0, range=-90..90)
back = Slider(0, range=-90..90)
mm_tool_front_back = Data([front, back])

a5 = Slider(0, range=-360..360)
a2 = Slider(0, range=-360..360)
a1 = Slider(0, range=-360..360)
a4 = Slider(0, range=-360..360)
_46 = Slider(0, range=-360..360)
a3 = Slider(0, range=-360..360)
abb_a1_a6 = Data([a1, a2, a3, a4, a5, _46])

# ----
# RFL animation
gantry_y = Slider(3000, range=0..12200)
gantry_x = Slider(16117, range=0..37200)
gantry_z = Slider(2000, range=1300..4600)
python_5 = PythonScript(x=gantry_x, y=gantry_y, z=gantry_z)  # -> out, a
# ---------- python_5: Python ----------
a = []

a.append(x)
a.append(y*(-1))
a.append(z*(-1))
# ---------- end python_5 ----------

gantry_y_2 = Slider(9000, range=0..12200)
gantry_z_2 = Slider(3000, range=1300..4600)
python_6 = PythonScript(x=gantry_x, y=gantry_y_2, z=gantry_z_2)  # -> out, a; same code as python_5

a2_2 = Slider(0, range=-360..360)
a5_2 = Slider(0, range=-360..360)
a1_2 = Slider(0, range=-360..360)
_46_2 = Slider(0, range=-360..360)
a3_2 = Slider(0, range=-360..360)
a4_2 = Slider(0, range=-360..360)
abb_a1_a6_2 = Data([a1_2, a2_2, a3_2, a4_2, a5_2, _46_2])

get_joints = PythonScript(get_joint_vals=Toggle(True), init=button)  # -> out, rob_values, gantry_values
# ---------- get_joints: Python ----------
import ghpythonlib.components as ghcomp
import Rhino.Geometry as rg
import math as m
from copy import copy, deepcopy
from scriptcontext import sticky as st
robot = st["rfl_robot"] 


if robot.comm.ghenv == None:
    robot.comm.ghenv = ghenv

if get_joint_vals:
    
    if robot.comm.running:
        
        posej =  robot.comm.get_current_pose_joint()
        #print posej
        joint_values_3 = (m.degrees(posej[18]), m.degrees(posej[19]), m.degrees(posej[20]), m.degrees(posej[21]), m.degrees(posej[22]), m.degrees(posej[23]), posej[24], posej[25], posej[26])
        rob_values_3 = joint_values_3[0:6]
        gantry_values_3 = joint_values_3[6:9]
        joint_values_4 = (m.degrees(posej[27]), m.degrees(posej[28]), m.degrees(posej[29]), m.degrees(posej[30]), m.degrees(posej[31]), m.degrees(posej[32]), posej[33], posej[34], posej[35])
        rob_values_4 = joint_values_4[0:6]
        gantry_values_4 = joint_values_4[6:9]
        rob_values = [rob_values_3, rob_values_4]
        gantry_values = [gantry_values_3, gantry_values_4]
        
        #print posej
        print "Robot 3 Joint Pose:  [%.6f, %.6f, %.6f, %.6f, %.6f, %.6f, %.6f, %.6f, %.6f] " % (m.degrees(posej[18]), m.degrees(posej[19]), m.degrees(posej[20]), m.degrees(posej[21]), m.degrees(posej[22]), m.degrees(posej[23]), posej[24], posej[25], posej[26])
        print "Robot 4 Joint Pose:  [%.6f, %.6f, %.6f, %.6f, %.6f, %.6f, %.6f, %.6f, %.6f] " % (m.degrees(posej[27]), m.degrees(posej[28]), m.degrees(posej[29]), m.degrees(posej[30]), m.degrees(posej[31]), m.degrees(posej[32]), posej[33], posej[34], posej[35])
        
        posec =  robot.comm.get_current_pose_cartesian()
        #print posec
        print "Robot 3 Cartesian Pose:  [%.6f, %.6f, %.6f, %.6f, %.6f, %.6f, %.6f, %.6f, %.6f, %.6f] " % (posec[20], posec[21], posec[22], posec[23], posec[24], posec[25], posec[26], posec[27], posec[28], posec[29])
        print "Robot 4 Cartesian Pose:  [%.6f, %.6f, %.6f, %.6f, %.6f, %.6f, %.6f, %.6f, %.6f, %.6f] " % (posec[30], posec[31], posec[32], posec[33], posec[34], posec[35], posec[36], posec[37], posec[38], posec[39])
        
    else:
        print "ROBOT IS OFFLINE"
        joint_values_3 = [0,0,0,0,0,0,3000,-3000,-3000]
        rob_values_3 = joint_values_3[0:6]
        gantry_values_3 = joint_values_3[6:9]
        joint_values_4 = [0,0,0,0,0,0,3000,-8000,-3000]
        rob_values_4 = joint_values_4[0:6]
        gantry_values_4 = joint_values_4[6:9]
        
        rob_values = [rob_values_3, rob_values_4]
        gantry_values = [gantry_values_3, gantry_values_4]
        

print "gantry_values", gantry_values
print "rob_values", rob_values
#print "pose_values", pose_values
# ---------- end get_joints ----------
panel_7 = Panel(get_joints.out)
python_7 = PythonScript(x=get_joints.gantry_values)  # -> out, g3, g4; inputs x: list
# ---------- python_7: Python ----------
g3 = x[0]
g4 = x[1]
# ---------- end python_7 ----------

# ----
# frame to plane
button_2 = Button()
frame = PythonScript(init=button_2)  # -> out, frame
# ---------- frame: Python ----------
from abb_communication.geometry import Frame

import Rhino.Geometry as rg


frame = Frame(draw_geo = True)
# ---------- end frame ----------
python_8 = PythonScript(frame=frame.frame)  # -> out, xa, ya, za, plane
# ---------- python_8: Python ----------
#pose_tool_v = [128.969, 246.023, 358.84, 0.692736, -0.363623, 0.0140559, -0.622654]
pose_vakgrip_vert_m1 = [-11.1463, 63.3699, 319.265, 0.610901, -0.614651, 0.353847, -0.351848]

#pose_gripper_corner = [-57.9328, 123.417, 338.146, 0.701441, 0.701351, 0.0935002, 0.0857094]
#pose_gripper_corner = [-57.6187,123.797,338.443,0.701887,0.701227,0.0916058,0.0851124]
pose_gripper_rob1 = [0.0905273,1.59452,332.474,0.00161999,0.00138947,-0.710535,-0.703659]
pose_gripper_mas = [-0.296848,0.393448,349.395,0.494737,-0.501492,0.495089,-0.508555]
pose_gripper_magazine = [4.88405,-355.158,265.322,0.00842024,0.00471044,-0.999918,-0.00847207]
pose_pick_up = [16901.75, 3296.84, -0.84, 0.00230, 0.00000, 1.00000, -0.00116]

frame.set_to_pose_quaternion(pose_pick_up)

xa = frame.x_axis
ya = frame.y_axis
za = frame.z_axis

plane = frame.get_plane()
# ---------- end python_8 ----------
line = Line(python_8.za)
line_2 = Line(python_8.xa)
line_3 = Line(python_8.ya)
group = Group(Objects=[line_2, line_3, line])
preview_3 = CustomPreview(Geometry=line_3, Shader=ColourSwatch(SwatchColor=RGB(163, 255, 197)))
preview_4 = CustomPreview(Geometry=line_2, Shader=ColourSwatch(SwatchColor=RGB(255, 150, 150)))
# inclination_length for 2, 4, 10, 15
# inclination_length for 30
preview_5 = CustomPreview(Geometry=line, Shader=ColourSwatch(SwatchColor=RGB(15, 27, 255)))

pln_6 = Plane(python_8.plane)

python_9 = PythonScript()  # -> out, plane_fin
# ---------- python_9: Python ----------
import abb_communication.geometry.frame as gf
import Rhino

plane_in = Rhino.Geometry.Plane(Rhino.Geometry.Point3d(0,0,0), Rhino.Geometry.Vector3d(1,0,0), Rhino.Geometry.Vector3d(0,1,0)) 

frame_0 = gf.Frame()
frame_0.set_to_plane(plane_in)

pl_world_rfl = Rhino.Geometry.Plane(Rhino.Geometry.Point3d(0,0,0), Rhino.Geometry.Vector3d(-1,0,0), Rhino.Geometry.Vector3d(0,1,0)) 
trans = frame_0.get_transformation_to(pl_world_rfl)
frame_0.set_to_tmatrix(trans)
plane_fin = frame_0.get_plane()
# ---------- end python_9 ----------
pln_7 = Plane(python_9.plane_fin)

python_10 = PythonScript()  # -> out, plane_fin
# ---------- python_10: Python ----------
import abb_communication.geometry.frame as gf
import Rhino

plane_in = Rhino.Geometry.Plane(Rhino.Geometry.Point3d(0,0,0), Rhino.Geometry.Vector3d(1,0,0), Rhino.Geometry.Vector3d(0,1,0)) 

frame_0 = gf.Frame()
frame_0.set_to_plane(plane_in)

pl_world_rfl = Rhino.Geometry.Plane(Rhino.Geometry.Point3d(0,0,0), Rhino.Geometry.Vector3d(1,0,0), Rhino.Geometry.Vector3d(0,-1,0)) 
trans = frame_0.get_transformation_to(pl_world_rfl)
frame_0.set_to_tmatrix(trans)
plane_fin = frame_0.get_plane()
# ---------- end python_10 ----------
pln_8 = Plane(python_10.plane_fin)

python_11 = PythonScript()  # -> out, plane_fin; same code as python_9
pln_9 = Plane(python_11.plane_fin)

python_12 = PythonScript()  # -> out, plane_fin; same code as python_10
pln_10 = Plane(python_12.plane_fin)

list_8 = ValueList({"0 forward, angles from sliders": 0, "1 forward, angles from online robot": 1}, selected="0 forward, angles from sliders")
python_13 = PythonScript(j3=abb_a1_a6, j4=abb_a1_a6_2)  # -> out, a; inputs j1: list, j2: list, j3: list, j4: list
# ---------- python_13: Python ----------
a = []

a.append(j1)
a.append(j2)
a.append(j3)
a.append(j4)

print a
# ---------- end python_13 ----------
filter = StreamFilter(Gate=list_8, Stream0=mm_tool_front_back, Stream1=mm_tool_front_back)
filter_2 = StreamFilter(Gate=list_8, Stream0=python_13.a, Stream1=get_joints.rob_values)

filter_3 = StreamFilter(Gate=list_8, Stream0=python_5.a, Stream1=python_7.g3)
python_14 = PythonScript(x=filter_3)  # -> out, x_val, y_val, z_val; inputs x: list
# ---------- python_14: Python ----------
x_val = x[0]
y_val = -x[1]
z_val = -x[2]
# ---------- end python_14 ----------
vec = VectorXYZ(XComponent=python_14.x_val, YComponent=python_14.y_val, ZComponent=python_14.z_val)  # -> Vector, Length
move = Move(Geometry=pln_7, Motion=vec.Vector)  # -> Geometry, Transform

filter_4 = StreamFilter(Gate=list_8, Stream0=python_6.a, Stream1=python_7.g4)
python_15 = PythonScript(x=filter_4)  # -> out, x_val, y_val, z_val; inputs x: list; same code as python_14
vec_2 = VectorXYZ(XComponent=python_15.x_val, YComponent=python_15.y_val, ZComponent=python_15.z_val)  # -> Vector, Length
move_2 = Move(Geometry=pln_8, Motion=vec_2.Vector)  # -> Geometry, Transform

filter_5 = StreamFilter(Gate=list_8, Stream0=python_5.a, Stream1=python_7.g3)
python_16 = PythonScript(x=filter_5)  # -> out, x_val, y_val, z_val; inputs x: list; same code as python_14
vec_3 = VectorXYZ(XComponent=python_16.x_val, YComponent=python_16.y_val, ZComponent=python_16.z_val)  # -> Vector, Length
move_3 = Move(Geometry=pln_10, Motion=vec_3.Vector)  # -> Geometry, Transform

filter_6 = StreamFilter(Gate=list_8, Stream0=python_6.a, Stream1=python_7.g4)
python_17 = PythonScript(x=filter_6)  # -> out, x_val, y_val, z_val; inputs x: list; same code as python_14
vec_4 = VectorXYZ(XComponent=python_17.x_val, YComponent=python_17.y_val, ZComponent=python_17.z_val)  # -> Vector, Length
move_4 = Move(Geometry=pln_9, Motion=vec_4.Vector)  # -> Geometry, Transform

ifrep = PythonScript(
    robot=set_tool_and_base.robot,
    robot_origin_plane_3=move.Geometry,
    robot_origin_plane_4=move_4.Geometry,
    joint_values=filter_2,
    tool_joint_values=filter,
    show_coll_geo=Toggle(True))  # -> base_geo_3, base_geo_4, link_geo_3, link_geo_4, robot_geo_colors, tool_geo_3, tool_geo_4, tool_geo_colors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; inputs robot_origin_plane_3: Plane, joint_values: list, tool_joint_values: list, show_coll_geo: Boolean
# ---------- ifrep: Python ----------
print joint_values

geo_init = robot.tool.geo
robot.set_robot_origin(robot_origin_plane_3, 3)
robot.set_robot_origin(robot_origin_plane_4, 4)

#base_geo_1, link_geo_1, tool_geo_1 = robot.get_geo_with_rotated_joints_in_world_with_tool_rot(joint_values[0], tool_joint_values, 1, extended = extended)
#base_geo_2, link_geo_2, tool_geo_2 = robot.get_geo_with_rotated_joints_in_world_with_tool_rot(joint_values[1], tool_joint_values, 2, extended = extended)
#base_geo_3, link_geo_3, tool_geo_3 = robot.get_geo_with_rotated_joints_in_world_with_tool_rot(joint_values[2], tool_joint_values, 3, extended = extended)
#base_geo_4, link_geo_4, tool_geo_4 = robot.get_geo_with_rotated_joints_in_world_with_tool_rot(joint_values[3], tool_joint_values, 4, extended = extended)

base_geo_3, link_geo_3, tool_geo_3 = robot.get_geo_with_rotated_joints_in_world(joint_values[2], 3)
base_geo_4, link_geo_4, tool_geo_4 = robot.get_geo_with_rotated_joints_in_world(joint_values[3], 4)


tool_geo_colors = robot.tool.colors

tool0_plane_3 = robot.get_tool0_plane_from_joint_values_world(joint_values[2], 3)
tool0_plane_4 = robot.get_tool0_plane_from_joint_values_world(joint_values[3], 4)

gantry_geo_3 = robot.gantry.get_transformed_geo(robot_origin_plane_3, 3)
gantry_geo_4 = robot.gantry.get_transformed_geo(robot_origin_plane_4, 4)

#if show_coll_geo == False:
#    tool_geo.pop(-1)
    
robot_geo_colors = robot.colors_links + robot.colors_base
# ---------- end ifrep ----------
mesh_4 = Mesh(ifrep.geo_init)
mesh_5 = Mesh(ifrep.gantry_geo_4)
mesh_6 = Mesh(ifrep.gantry_geo_3)
pln_11 = Plane([ifrep.tool0_plane_3, ifrep.tool0_plane_4])
preview_6 = CustomPreview(Geometry=[ifrep.link_geo_3, ifrep.base_geo_3, ifrep.base_geo_4, ifrep.link_geo_4], Shader=ifrep.robot_geo_colors)
preview_7 = CustomPreview(Geometry=[ifrep.tool_geo_3, ifrep.tool_geo_4], Shader=ColourSwatch(SwatchColor=RGBA(176, 214, 255, 139)))

panel_8 = Panel(filter_2)

# ==== cluster RFL
l1 = Mesh(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)
l3 = Mesh(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)
l4 = Mesh(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)
l5 = Mesh(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)
l6 = Mesh(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)
l2 = Mesh(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)
base = Mesh([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])
base_2 = Mesh([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])
mesh = Mesh([l1, l2, l3, l4, l5, l6])
ip_abb = ClusterInput()
init = ClusterInput()
plane = Plane([PlaneXY(-1.185867404e-09, 0, 0), Plane(origin=(175, 0, 495), x=(0, 0, 1), y=(1, 0, 0)), Plane(origin=(175, 0, 1590), x=(0, 0, 1), y=(1, 0, 0)), Plane(origin=(175, 0, 1765), x=(0, 0, -1), y=(0, 1, 0)), Plane(origin=(1446, 0, 1765), x=(0, 0, 1), y=(1, 0, 0)), Plane(origin=(1581, 0, 1765), x=(-1.94917184e-05, 1.016258774e-11, -0.9999999998), y=(-2.075117433e-05, 0.9999999998, 4.146386344e-10))])
if = PythonScript(init=init, ip_abb=ip_abb, joint_planes=plane, base_geo=base, link_geo=mesh)  # -> robot; inputs joint_planes: list of Plane, base_geo: list of Mesh, link_geo: list of Mesh
# ---------- if: Python ----------
from abb_communication.clients import Robot4x

robot = Robot4x(link_geo, base_geo, joint_planes, ip_abb = ip_abb)
# ---------- end if ----------
robot = ClusterOutput(if)

# ==== cluster Cluster

rob_11_z1 = Brep(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)
rob_11_z_base = Brep([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])
rob_11_12_y = Brep([null, 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])
rob_11_12_21_22_x = Brep([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])
rob_11_z2 = Brep([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])
mesh = Mesh(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)
mesh_2 = Mesh([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])
mesh_3 = Mesh([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])
mesh_4 = Mesh([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])
mesh_5 = Mesh([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])

mjoin = MeshJoin(Meshes=mesh_3)
mjoin_2 = MeshJoin(Meshes=mesh_2)
mjoin_3 = MeshJoin(Meshes=mesh_4)
mjoin_4 = MeshJoin(Meshes=mesh)
mjoin_5 = MeshJoin(Meshes=mesh_5)
merge = Merge(Data1=mjoin_4, Data2=mjoin_2, Data3=mjoin, Data4=mjoin_3, Data5=mjoin_5)
xy = XYPlane(Origin=Point(0, 0, 0))
init = ClusterInput()
set_tool = PythonScript(init=init, gantry_geo=merge, gantry_plane=xy)  # -> out, gantry, gantry_geo; inputs gantry_geo: list of Mesh, gantry_plane: Plane
# ---------- set_tool: Python ----------
import Rhino.Geometry as rg
import ghpythonlib.components as ghcomp
import math as m

#from abb_communication.clients.rfl_robot import Tool
from abb_communication.clients.rfl_robot.gantry import Gantry
from abb_communication.geometry import Frame

gantry = Gantry(gantry_geo, gantry_plane)

gantry_geo_n = gantry.geo
# ---------- end set_tool ----------
geo = Geometry(set_tool.gantry_geo)
gantry = ClusterOutput(set_tool.gantry)

# ==== cluster Tool
p1_fixed = Mesh(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)
p3_rot_back_frame = Mesh(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)
p3_rot_back_gripper_retracted = Mesh(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)
p3_rot_back_gripper_extended = Mesh(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)
mm_tool_plane = Plane(Plane(origin=(-87.75034292, 151.9880897, 617), x=(0.5, -0.8660254038, 0), y=(-0.8660254038, -0.5, 0)))
mm_cam_plane = Plane(Plane(origin=(-220.4173906, -246.1664658, 566.7384126), x=(-0.8256223359, 0.5642231459, 0), y=(-0.2905964029, -0.4252269385, 0.8571673007)))
p2_rot_front = Mesh(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)
collision_geo = Mesh(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)
mesh = Mesh([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])
plane = Plane(PlaneXY(0, 0, 0))
pln = Plane(Plane(origin=(0.0867109651, 1.472961418, 319.9745917), x=(-0.99999089, -0.004254372967, 0.0003466928643), y=(0.004257543076, -0.9999436638, 0.009723299055)))
mesh_2 = Mesh([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])
plane_2 = Plane(PlaneXY(0, 0, 0))
pln_2 = Plane(Plane(origin=(0.0867109651, 1.472961418, 319.9745917), x=(-0.99999089, -0.004254372967, 0.0003466928643), y=(0.004257543076, -0.9999436638, 0.009723299055)))
init = ClusterInput()
int = ClusterInput()
tool_geo_mesh = Mesh([p1_fixed, p2_rot_front, p3_rot_back_frame, p3_rot_back_gripper_retracted, p3_rot_back_gripper_extended, collision_geo])
int_2 = Integer(int)

set_tool = PythonScript(init=init, tool_geo=tool_geo_mesh, tool_plane=mm_tool_plane, cam_plane=mm_cam_plane)  # -> out, tool, tool_plane, tool_geo, tool_axes, tool_axes_colors; inputs tool_geo: list of Mesh, tool_plane: Plane
# ---------- set_tool: Python ----------
import Rhino.Geometry as rg
import ghpythonlib.components as ghcomp
import math as m


from abb_communication.clients.rfl_robot import MeshMouldTool
from abb_communication.geometry import Frame



#rot_plane = rg.Plane(rg.Plane.WorldXY)

#T_trans = rg.Transform.Translation(rot_plane.ZAxis*40)


#T_rot = rg.Transform.Rotation(m.radians(-20), rot_plane.ZAxis, rot_plane.Origin)
#tool_geo = ghcomp.Transform(tool_geo, T_rot)
#tool_plane = ghcomp.Transform(tool_plane, T_rot)
#cam_plane = ghcomp.Transform(cam_plane, T_rot)

#T_rot = rg.Transform.Rotation(m.radians(-20), rot_plane.XAxis, rot_plane.Origin)
#tool_geo = ghcomp.Transform(tool_geo, T_rot)
#tool_plane = ghcomp.Transform(tool_plane, T_rot)
#cam_plane = ghcomp.Transform(cam_plane, T_rot)
#rot_plane = ghcomp.Transform(rot_plane, T_rot)

#T_rot = rg.Transform.Rotation(m.radians(10), rot_plane.YAxis, rot_plane.Origin)
#tool_geo = ghcomp.Transform(tool_geo, T_rot)
#tool_plane = ghcomp.Transform(tool_plane, T_rot)
#cam_plane = ghcomp.Transform(cam_plane, T_rot)
#rot_plane = ghcomp.Transform(rot_plane, T_rot)

#tool_geo = ghcomp.Transform(tool_geo, T_trans)
#tool_plane = ghcomp.Transform(tool_plane, T_trans)
#cam_plane = ghcomp.Transform(cam_plane, T_trans)


tool = MeshMouldTool(tool_geo, tool_plane, cam_plane)


tool_plane = tool.get_plane()
tool_axes, tool_axes_colors = tool.get_frame_axes_as_lines()
# ---------- end set_tool ----------
pln_3 = Plane(set_tool.tool_plane)
preview = CustomPreview(Geometry=set_tool.tool_axes, Shader=set_tool.tool_axes_colors)
geo = Geometry(set_tool.tool_geo)
preview_2 = CustomPreview(Geometry=geo, Shader=ColourSwatch(SwatchColor=RGBA(100, 168, 178, 162)))

set_tool_2 = PythonScript(init=init, tool_geo=mesh, tool_plane=pln)  # -> out, tool, tool_plane, tool_geo, tool_axes, tool_axes_colors; inputs tool_geo: list of Mesh, tool_plane: Plane
# ---------- set_tool_2: Python ----------
import Rhino.Geometry as rg
import ghpythonlib.components as ghcomp
import math as m


from abb_communication.clients.rfl_robot import MeshMouldTool
from abb_communication.clients.rfl_robot.tool import LwsGripperTool
#from abb_communication.clients.rfl_robot import Tool
from abb_communication.geometry import Frame


tool = LwsGripperTool(tool_geo, tool_plane)

tool_plane = tool.get_plane()
tool_axes, tool_axes_colors = tool.get_frame_axes_as_lines()
# ---------- end set_tool_2 ----------
pln_4 = Plane(set_tool_2.tool_plane)
preview_3 = CustomPreview(Geometry=set_tool_2.tool_axes, Shader=set_tool_2.tool_axes_colors)
geo_2 = Geometry(set_tool_2.tool_geo)
preview_4 = CustomPreview(Geometry=geo_2, Shader=ColourSwatch(SwatchColor=RGBA(100, 168, 178, 162)))

set_tool_3 = PythonScript(init=init, tool_geo=mesh_2, tool_plane=pln_2)  # -> out, tool, tool_plane, tool_geo, tool_axes, tool_axes_colors; inputs tool_geo: list of Mesh, tool_plane: Plane
# ---------- set_tool_3: Python ----------
import Rhino.Geometry as rg
import ghpythonlib.components as ghcomp
import math as m


from abb_communication.clients.rfl_robot import MeshMouldTool
from abb_communication.clients.rfl_robot.tool import LwsGripperTool
from abb_communication.clients.rfl_robot.tool import RthGripperTool
#from abb_communication.clients.rfl_robot import Tool
from abb_communication.geometry import Frame


tool = RthGripperTool(tool_geo, tool_plane)

tool_plane = tool.get_plane()
tool_axes, tool_axes_colors = tool.get_frame_axes_as_lines()
# ---------- end set_tool_3 ----------
pln_5 = Plane(set_tool_3.tool_plane)
preview_5 = CustomPreview(Geometry=set_tool_3.tool_axes, Shader=set_tool_3.tool_axes_colors)
geo_3 = Geometry(set_tool_3.tool_geo)
preview_6 = CustomPreview(Geometry=geo_3, Shader=ColourSwatch(SwatchColor=RGBA(100, 168, 178, 162)))

select_tool = StreamFilter(Gate=int_2, Stream0=set_tool.tool, Stream1=set_tool_2.tool, Stream2=set_tool_3.tool)
tool = Data(select_tool)
tool_2 = ClusterOutput(tool)
