# Grasshopper definition 170319_ABB_RFLControl_two_robots.gh (Grasshopper 0.9.76)
# plug-ins: Python Interpreter

# ----
# angleB
# speed
# data for further calculation
# set path
# set path
# set path
# set path
# set path
# set path
# set path
# force
# force
# force
# force
# force
# force
# angleA
# angleA
# angleA
# angleA
# angleA
# angleA
# angleB
# angleB
# angleB
# angleB
# angleB
# angleB
# speed
# speed
# speed
# speed
# speed
# speed
# force
# force
# force
# force
# force
# force
# angleA
# angleA
# angleA
# angleA
# angleA
# angleA
# angleA
# angleA
# angleA
# angleA
# angleA
# angleA
# angleA
# angleB
# angleB
# angleB
# angleB
# angleB
# angleB
# speed
# speed
# speed
# speed
# speed
# speed
# speed
# speed
# speed
# speed
# speed
# speed
# speed
# data for further calculation
# data for further calculation
# data for further calculation
# data for further calculation
# data for further calculation
# data for further calculation
# . . . . . . . . . . . . . . . . . .
# .                                 .
# .   <<><><>    <<><><>  <<        .
# .   <<    ><   <<       <<        .
# .   <<><><>    <<><><   <<        .
# .   <<  ><     <<       <<        .
# .   <<   <>    <<       <<        .
# .   <<    ><   <<       <<><><>   .
# .                                 .
# .             GKR 2016/17         .
# . . . . . . . . . . . . . . . . . .
# 
# Created on 10.12.2016
# 
# @author: kathrind, stefanap
unload_abb_communication_lib = Button()
py = PythonScript(unload=unload_abb_communication_lib)
# ---------- py: Python ----------
from abb_communication.useful import unload_rfl_lib

if unload:
    unload_rfl_lib()
# ---------- end py ----------

gantry = Panel("""22000
-6000
-4000""")
rob_01 = Plane(flatten([Plane(origin=(22624.31217, 6551.220909, 1786.60254), x=(-1, 0, 0), y=(0, 0.8660254038, 0.5)), Plane(origin=(22624.31217, 6557.470909, 1775.777223), x=(-1, 0, 0), y=(0, 0.8660254038, 0.5)), Plane(origin=(22624.31217, 6563.720909, 1764.951905), x=(-1, 0, 0), y=(0, 0.8660254038, 0.5)), Plane(origin=(22624.31217, 6569.970909, 1754.126588), x=(-1, 0, 0), y=(0, 0.8660254038, 0.5)), Plane(origin=(22624.31217, 6576.220909, 1743.30127), x=(-1, 0, 0), y=(0, 0.8660254038, 0.5))]))
lng = ListLength(List=rob_01)
gantry_x = Slider(13000, range=0..37200)
gantry_y = Slider(2500, range=0..12200)
gantry_z = Slider(2000, range=1350..4600)
gantry_y_2 = Slider(10000, range=0..12200)
# material resistance
# force
# angleA
# angleB
# speed
# force
# angleA
# angleB
# speed
# material resistance
# force
# angleA
# angleB
# speed
# force
# angleA
# angleB
# speed
gantry_z_2 = Slider(1400, range=1350..4600)
pln = Plane(Plane(origin=(22624.31217, 6551.220909, 1786.60254), x=(-1, 0, 0), y=(0, 0.8660254038, 0.5)))
python = PythonScript(x=gantry, y=lng)  # -> out, flatten(a); inputs x: list
# ---------- python: Python ----------
a = []
for i in range(y):
    a.append(x)
    
print a
# ---------- end python ----------
button = Button()

# ----
# Define plane sequence WCS
number_slider = Slider(30, range=0..100)
crv = Curve(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)
pframes = PerpFrames(Curve=crv, Count=number_slider, Align=True)  # -> Frames, Parameters
reorient_planes = PythonScript(F=pframes.Frames)  # -> out, F; inputs F: list of Plane
# ---------- reorient_planes: Python ----------
import Rhino.Geometry as rg
import math as m



[f.Rotate(m.radians(90), f.XAxis, f.Origin) for f in F]
[f.Rotate(m.radians(90), f.ZAxis, f.Origin) for f in F]
# ---------- end reorient_planes ----------

merge = Merge(Data1=gantry_x, Data2=gantry_y, Data3=gantry_z)
merge_2 = Merge(Data1=gantry_x, Data2=gantry_y_2, Data3=gantry_z_2)
timer = Timer(TimerInterval=100)  # disabled

# ----
# tools
list = ValueList({"mm tool": 0, "lws gripper": 1, "rth gripper": 2}, selected="lws gripper")

python_2 = PythonScript(x=button, y=merge)  # -> out, rob_joints; inputs y: list
# ---------- python_2: Python ----------
import random


def rand_num(x_min, x_max):
    num = random.random()*(x_max-x_min)+x_min
    return num
    

y[1] = y[1]*-1
y[2] = y[2]*-1

j0_min = -180
j0_max = 180
j1_min = -90
j1_max = 150
j2_min = -180
j2_max = 75
j3_min = -400
j3_max = 400
j4_min = -125
j4_max = 120
j5_min = -400
j5_max = 400

rob_joints = [rand_num(j0_min, j0_max), rand_num(j1_min, j1_max), rand_num(j2_min, j2_max), rand_num(j3_min, j3_max), rand_num(j4_min, j4_max), rand_num(j5_min, j5_max)] + y
print rob_joints
# ---------- end python_2 ----------
python_3 = PythonScript(x=button, y=merge_2)  # -> out, rob_joints; inputs y: list
# ---------- python_3: Python ----------
import random


def rand_num(x_min, x_max):
    num = random.random()*(x_max-x_min)+x_min
    return num
    

y[1] = y[1]*-1
y[2] = y[2]*-1

x1_min = 0
x1_max = 37200
y1_min = -12200
y1_max = 0
z1_min = -4600
z1_max = -1300

j0_min = -180
j0_max = 180
j1_min = -90
j1_max = 150
j2_min = -180
j2_max = 75
j3_min = -400
j3_max = 400
j4_min = -125
j4_max = 120
j5_min = -400
j5_max = 400

rob_joints = [rand_num(j0_min, j0_max), rand_num(j1_min, j1_max), rand_num(j2_min, j2_max), rand_num(j3_min, j3_max), rand_num(j4_min, j4_max), rand_num(j5_min, j5_max)] + y
print rob_joints
# ---------- end python_3 ----------

# ----
# RFL robot
list_2 = ValueList({"192.168.125.1", "127.0.0.1"}, selected="127.0.0.1")
init = Button()
rfl = RFL(init=init, ip_abb=list_2)

tool = Tool(int=list, init=init)
cluster = Cluster(init=init)
set_tool_and_base = PythonScript(robot=rfl, tool=tool, gantry=cluster)  # -> out, robot, gantry_geo, tool_geo
# ---------- set_tool_and_base: Python ----------
from scriptcontext import sticky as st


robot.set_tool(tool)
robot.set_gantry(gantry)
#robot.set_robot_origin(base_plane1, 1)
# set_robot_origin_with_measured_base(self, base_plane):

st["rfl_robot"] = robot

tool_geo = tool.geo
gantry_geo = gantry.geo
# ---------- end set_tool_and_base ----------
mesh = Mesh(set_tool_and_base.tool_geo)
mesh_2 = Mesh(set_tool_and_base.gantry_geo)

send_current_robot_tool_pose_joint_multi = Button()  # "send current robot tool pose joint multiple"
# RFL communication
send_current_robot_tool_pose_multiple = Button()
send_current_robot_tool_pose_joint = Button()
send_current_robot_tool_pose = Button()
list_3 = ValueList({"joints_meshmould_left_low": "98.54 -20.98 45.48 0.0 65.50 68.54", "joints_meshmould_left_high": "98.54 -23.4 23.9 0.0 89.50 68.54", "joints_meshmould_right_low": "-81.46 -20.98 45.48 0.0 65.50 68.54", "joints_meshmould_parking_high": "0 -20.98 45.48 0.0 65.50 -111.46", "joints_meshmould_parking_mid": "0 -60.94 66.90 0.0 84.28 63.15", "joints_meshmould_parking_low": "0 -70.8 72.19 0.0 88.92 61.82"}, selected="joints_meshmould_parking_high")
send_robot_joints_absolute = Button()
send_robot_joints_relative = Button()
number_slider_2 = Slider(1, range=1..2)
stepsize = Slider(-10, range=-180..180)
stepsize_2 = Slider(200, range=-14000..14000)
axis_1_6 = Slider(5, range=1..9)
set_joint_6_to_zero = Button()
set_speed_slow = Button()
set_speed_mid = Button()
set_speed_fast = Button()
list_4 = ValueList({"tool_0": 0, "tool_meshmould": 1, "tool_mtip": 6, "tool_lws_gripper": 2, "tool_rth_gripper": 3}, selected="tool_0")
list_5 = ValueList({"wobj_0": 0, "wobj_common": 1, "wobj_base": 2, "wobj_stu_pick": 3, "wobj_stu_base": 4}, selected="wobj_0")
set_wobj = Button()
set_tool = Button()
expression = Expression(x=axis_1_6, y=stepsize, z=stepsize_2, Expression="If(x < 7, y, z)")
refresh_text_window = Button()
reset_robot = Button()
r_on = Button()
r_off = Button()
if_connection = PythonScript(
    robot=set_tool_and_base.robot,
    connect_robot=r_on,
    close_robot=r_off,
    refresh=refresh_text_window,
    reset_robot=reset_robot)  # -> out; inputs connect_robot: Boolean, close_robot: Boolean, refresh: Boolean
# ---------- if_connection: Python ----------
import Rhino.Geometry as rg
from abb_communication.clients.rfl_robot.communication.messages.clientstates import *

print robot.comm.running

# =========================================================================================    
if connect_robot == True:
    if robot.comm.running == False:
        robot.comm.start()
    else:
        pass

# =========================================================================================    
if close_robot == True:
    if robot.comm.running == True:
        robot.comm.close()
        robot.comm.cmd_counter_to_client = 0
        robot.comm.cmd_exec_counter_from_client = 0
        robot.comm.publish_state(1)
    else:
        pass

if reset_robot:
    robot.comm.close()
    robot.comm.cmd_counter_to_client = 0
    robot.comm.cmd_exec_counter_from_client = 0
    robot.comm.publish_state(1)
    try:
        robot.comm.start()
    except:
        print "CONNECTION TO ABB FAILED"

robot_conncection_state = "online" if robot.comm.running else "offline"
print "ABB CONNECTION STATE:", robot_conncection_state
print "ABB STATE: ", client_states_str_array[robot.comm.state]
print "Sent commands to ABB: ",  robot.comm.get_cmd_counter()
print "Executed commands from ABB: ",  robot.comm.cmd_exec_counter_from_client
# ---------- end if_connection ----------
panel = Panel(if_connection)

subtraction = Subtraction(A=number_slider_2, B=1)
filter = StreamFilter(Gate=subtraction, Stream0=python_2.rob_joints, Stream1=python_3.rob_joints)

# ----
# Calculation planes and poses
ur_poses = PythonScript(robot=set_tool_and_base.robot, planes_tool_WCS=reorient_planes.F, idx=Slider(30, range=0..30), init=Button())  # -> origin_plane, planes_tool_WCS, planes_tool_RCS, planes_tool0_RCS, poses_tool_RCS, plane_at_idx_WCS, tool_geo_on_plane_at_idx_WCS, tool_geo_colors; inputs planes_tool_WCS: list of Plane, idx: Int32
# ---------- ur_poses: Python ----------
import Rhino.Geometry as rg
import ghpythonlib.components as ghcomp

origin_plane_1 = robot.origin_plane_1
origin_plane_2 = robot.origin_plane_2

planes_tool_RCS_1 = [robot.get_tool_plane_in_RCS(tp_WCS, 1) for tp_WCS in planes_tool_WCS]
planes_tool_RCS_2 = [robot.get_tool_plane_in_RCS(tp_WCS, 2) for tp_WCS in planes_tool_WCS]

planes_tool0_RCS_1 = [robot.get_tool0_plane_in_RCS(tp_WCS, 1) for tp_WCS in planes_tool_WCS]
planes_tool0_RCS_2 = [robot.get_tool0_plane_in_RCS(tp_WCS, 2) for tp_WCS in planes_tool_WCS]

poses_tool_RCS_1 = [robot.get_tool_pose_in_RCS(tp_WCS, 1) for tp_WCS in planes_tool_WCS]
poses_tool_RCS_2 = [robot.get_tool_pose_in_RCS(tp_WCS, 2) for tp_WCS in planes_tool_WCS]

"""
ur_tool_geo_on_planes_WCS_nested = [robot.tool.get_transformed_geo_trfd(rg.Transform.PlaneToPlane(rg.Plane.WorldXY, tp_WCS)) for tp_WCS in ur_planes_tool_WCS]
ur_tool_geo_on_planes_WCS = [x for sublist in ur_tool_geo_on_planes_WCS_nested for x in sublist]

ur_tool_geo_on_planes_RCS_nested = [robot.tool.get_transformed_geo_trfd(rg.Transform.PlaneToPlane(rg.Plane.WorldXY, tp_RCS)) for tp_RCS in ur_planes_tool_RCS]
ur_tool_geo_on_planes_RCS = [x for sublist in ur_tool_geo_on_planes_RCS_nested for x in sublist]"""

plane_at_idx_WCS = planes_tool_WCS[idx]
T = rg.Transform.PlaneToPlane(rg.Plane.WorldXY, plane_at_idx_WCS)

tool_geo_on_plane_at_idx_WCS = robot.tool.get_transformed_geo_WCS(T)
tool_geo_colors = robot.tool.colors
print tool_geo_colors
# ---------- end ur_poses ----------
pln_2 = Plane(ur_poses.plane_at_idx_WCS)
geo = Geometry(ur_poses.tool_geo_on_plane_at_idx_WCS)
planesrf = PlaneSurface(Plane=ur_poses.planes_tool_WCS, XSize=Domain(-10, 10), YSize=Domain(-10, 10))
preview = CustomPreview(Geometry=geo, Shader=ur_poses.tool_geo_colors)

int = Integer(expression)
if_sender = PythonScript(
    init=init,
    plane=pln,
    ext_axes=gantry,
    list_planes=rob_01,
    list_ext_axes=python.a,
    set_speed_fast=set_speed_fast,
    set_speed_mid=set_speed_mid,
    set_speed_slow=set_speed_slow,
    send_current_tool_pose=send_current_robot_tool_pose,
    send_current_tool_poses_mult=send_current_robot_tool_pose_multiple,
    sent_current_tool_pose_joints=send_current_robot_tool_pose_joint,
    send_current_tool_poses_joints_mult=send_current_robot_tool_pose_joint_multi,
    send_joints_absolute=send_robot_joints_absolute,
    joints_abb_1=filter,
    send_joints_rel=simplify(send_robot_joints_relative),
    joint=axis_1_6,
    relative_angle=int,
    set_joint_6_to_zero=set_joint_6_to_zero,
    set_tool=set_tool,
    tool_num=list_4,
    set_wobj=set_wobj,
    wobj_num=list_5,
    rob_num=number_slider_2)  # -> out, a; inputs ext_axes: list, list_planes: list, list_ext_axes: list, send_current_tool_pose: Boolean, joints_abb_1: list, joint: Int32, set_tool: Boolean, tool_num: Int32
# ---------- if_sender: Python ----------
from abb_communication.clients.rfl_robot.communication.messages.messagetypes import *
import Rhino.Geometry as rg
from abb_communication.geometry import Frame
from scriptcontext import sticky as st
import math as m
from threading import Thread
import time

print ext_axes


robot = st["rfl_robot"]
#print joints_abb
if robot:    
    
    robot.comm.float_arbitrary = rob_num
    
    if set_speed_fast:
        print "SET SPEED FAST"
        robot.comm.set_speed_fast()
    if set_speed_mid:
        print "SET SPEED MID"
        robot.comm.set_speed_mid()
    if set_speed_slow:
        print "SET SPEED SLOW"
        robot.comm.set_speed_slow()
    
    if set_tool:
        if tool_num == 0:
            print "SET TOOL 0"
            robot.comm.set_tool0()
        elif tool_num == 1:
            print "SET TOOL MESH MOULD"
            robot.comm.set_tool_meshmould()
        elif tool_num == 6:
            print "SET TOOL MTIP"
            robot.comm.set_tool_mtip()
        elif tool_num == 7:
            print "SET TOOL LWS GRIPPER"
            robot.comm.set_tool_lws_gripper()
        elif tool_num == 8:
            print "SET TOOL STU GRIPPER"
            robot.comm.set_tool_stu_gripper()
        else:
            print "WRONG TOOL NUM"
    
    if set_wobj:
        if wobj_num == 0:
            print "SET WOBJ 0"
            robot.comm.set_wobj_0()
        elif wobj_num == 1:
            print "SET WOBJ LWS COMMON"
            robot.comm.set_wobj_common()
        elif wobj_num == 2:
            print "SET WOBJ BASE"
            robot.comm.set_wobj_base()
        elif wobj_num == 3:
            print "SET WOBJ STU PICK"
            robot.comm.set_wobj_stu_pick()
        elif wobj_num == 4:
            print "SET WOBJ STU BASE"
            robot.comm.set_wobj_stu_base()
        else:
            print "WRONG TOOL NUM"
    
    # =========================================================================================
    # =========================================================================================
    if robot.comm.running:
        print "ROBOT IS ONLINE"
        # =========================================================================================
        if send_current_tool_pose:
            robot.float_arbitrary = int(rob_num)
            #tool_plane_RCS = robot.get_tool_plane_in_RCS(plane_WCS)
            #robot.comm.send_pose_cartesian(tool_plane_RCS)
            #tool0_plane_RCS = robot.get_tool0_plane_in_RCS(plane_WCS)
            #robot.comm.send_pose_cartesian(tool0_plane_RCS)
            robot.comm.send_pose_cartesian(plane, ext_axes)
            
        if sent_current_tool_pose_joints:
            robot.float_arbitrary = int(rob_num)
            send_pose_cartesian_joints(plane, ext_axes)
        
        if send_current_tool_poses_mult:
            robot.float_arbitrary = int(rob_num)
            robot.comm.send_pose_cartesian_list(list_planes, list_ext_axes)
        
        if send_current_tool_poses_joints_mult:
            robot.float_arbitrary = int(num_rob)
            robot.comm.send_pose_cartesian_joints_list(list_planes, list_ext_axes)
            
        if send_joints_rel:
            robot.float_arbitrary = int(rob_num)
            print "joints rel"
            joints = [0,0,0,0,0,0,0,0,0]
            joints[joint-1] = relative_angle
            robot.comm.send_axes_relative(joints, int_arr = None)
            
        if send_joints_absolute:
            #joints_abb_list = [float(x) for x in joints_abb.split()]
            joints_abb_list = joints_abb
            robot.comm.send_axes_absolute(joints_abb_list, int_arr = None)
        
        if set_joint_6_to_zero:
            posej = robot.comm.get_current_pose_joint()
            posej_deg = [m.degrees(j) for j in posej]
            posej_deg[5] = 0
            #posej_deg[3] = 0
            robot.comm.send_axes_absolute(posej_deg, int_arr = None)       
        
            
    else:
        print "ROBOT IS OFFLINE"
# ---------- end if_sender ----------
# inclination_length for 2, 4, 10, 15
# inclination_length for 30
panel_2 = Panel(if_sender.out)

# ==== cluster Tool
p1_fixed = Mesh(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)
p3_rot_back_frame = Mesh(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)
p3_rot_back_gripper_retracted = Mesh(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)
p3_rot_back_gripper_extended = Mesh(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)
mm_tool_plane = Plane(Plane(origin=(-87.75034292, 151.9880897, 617), x=(0.5, -0.8660254038, 0), y=(-0.8660254038, -0.5, 0)))
mm_cam_plane = Plane(Plane(origin=(-220.4173906, -246.1664658, 566.7384126), x=(-0.8256223359, 0.5642231459, 0), y=(-0.2905964029, -0.4252269385, 0.8571673007)))
p2_rot_front = Mesh(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)
collision_geo = Mesh(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)
mesh = Mesh([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])
plane = Plane(PlaneXY(0, 0, 0))
pln = Plane(Plane(origin=(0.0867109651, 1.472961418, 319.9745917), x=(-0.99999089, -0.004254372967, 0.0003466928643), y=(0.004257543076, -0.9999436638, 0.009723299055)))
mesh_2 = Mesh([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])
plane_2 = Plane(PlaneXY(0, 0, 0))
pln_2 = Plane(Plane(origin=(0.0867109651, 1.472961418, 319.9745917), x=(-0.99999089, -0.004254372967, 0.0003466928643), y=(0.004257543076, -0.9999436638, 0.009723299055)))
init = ClusterInput()
int = ClusterInput()
tool_geo_mesh = Mesh([p1_fixed, p2_rot_front, p3_rot_back_frame, p3_rot_back_gripper_retracted, p3_rot_back_gripper_extended, collision_geo])
int_2 = Integer(int)

set_tool = PythonScript(init=init, tool_geo=tool_geo_mesh, tool_plane=mm_tool_plane, cam_plane=mm_cam_plane)  # -> out, tool, tool_plane, tool_geo, tool_axes, tool_axes_colors; inputs tool_geo: list of Mesh, tool_plane: Plane
# ---------- set_tool: Python ----------
import Rhino.Geometry as rg
import ghpythonlib.components as ghcomp
import math as m


from abb_communication.clients.rfl_robot import MeshMouldTool
from abb_communication.geometry import Frame



#rot_plane = rg.Plane(rg.Plane.WorldXY)

#T_trans = rg.Transform.Translation(rot_plane.ZAxis*40)


#T_rot = rg.Transform.Rotation(m.radians(-20), rot_plane.ZAxis, rot_plane.Origin)
#tool_geo = ghcomp.Transform(tool_geo, T_rot)
#tool_plane = ghcomp.Transform(tool_plane, T_rot)
#cam_plane = ghcomp.Transform(cam_plane, T_rot)

#T_rot = rg.Transform.Rotation(m.radians(-20), rot_plane.XAxis, rot_plane.Origin)
#tool_geo = ghcomp.Transform(tool_geo, T_rot)
#tool_plane = ghcomp.Transform(tool_plane, T_rot)
#cam_plane = ghcomp.Transform(cam_plane, T_rot)
#rot_plane = ghcomp.Transform(rot_plane, T_rot)

#T_rot = rg.Transform.Rotation(m.radians(10), rot_plane.YAxis, rot_plane.Origin)
#tool_geo = ghcomp.Transform(tool_geo, T_rot)
#tool_plane = ghcomp.Transform(tool_plane, T_rot)
#cam_plane = ghcomp.Transform(cam_plane, T_rot)
#rot_plane = ghcomp.Transform(rot_plane, T_rot)

#tool_geo = ghcomp.Transform(tool_geo, T_trans)
#tool_plane = ghcomp.Transform(tool_plane, T_trans)
#cam_plane = ghcomp.Transform(cam_plane, T_trans)


tool = MeshMouldTool(tool_geo, tool_plane, cam_plane)


tool_plane = tool.get_plane()
tool_axes, tool_axes_colors = tool.get_frame_axes_as_lines()
# ---------- end set_tool ----------
pln_3 = Plane(set_tool.tool_plane)
preview = CustomPreview(Geometry=set_tool.tool_axes, Shader=set_tool.tool_axes_colors)
geo = Geometry(set_tool.tool_geo)
preview_2 = CustomPreview(Geometry=geo, Shader=ColourSwatch(SwatchColor=RGBA(100, 168, 178, 162)))

set_tool_2 = PythonScript(init=init, tool_geo=mesh, tool_plane=pln)  # -> out, tool, tool_plane, tool_geo, tool_axes, tool_axes_colors; inputs tool_geo: list of Mesh, tool_plane: Plane
# ---------- set_tool_2: Python ----------
import Rhino.Geometry as rg
import ghpythonlib.components as ghcomp
import math as m


from abb_communication.clients.rfl_robot import MeshMouldTool
from abb_communication.clients.rfl_robot.tool import LwsGripperTool
#from abb_communication.clients.rfl_robot import Tool
from abb_communication.geometry import Frame


tool = LwsGripperTool(tool_geo, tool_plane)

tool_plane = tool.get_plane()
tool_axes, tool_axes_colors = tool.get_frame_axes_as_lines()
# ---------- end set_tool_2 ----------
pln_4 = Plane(set_tool_2.tool_plane)
preview_3 = CustomPreview(Geometry=set_tool_2.tool_axes, Shader=set_tool_2.tool_axes_colors)
geo_2 = Geometry(set_tool_2.tool_geo)
preview_4 = CustomPreview(Geometry=geo_2, Shader=ColourSwatch(SwatchColor=RGBA(100, 168, 178, 162)))

set_tool_3 = PythonScript(init=init, tool_geo=mesh_2, tool_plane=pln_2)  # -> out, tool, tool_plane, tool_geo, tool_axes, tool_axes_colors; inputs tool_geo: list of Mesh, tool_plane: Plane
# ---------- set_tool_3: Python ----------
import Rhino.Geometry as rg
import ghpythonlib.components as ghcomp
import math as m


from abb_communication.clients.rfl_robot import MeshMouldTool
from abb_communication.clients.rfl_robot.tool import LwsGripperTool
from abb_communication.clients.rfl_robot.tool import RthGripperTool
#from abb_communication.clients.rfl_robot import Tool
from abb_communication.geometry import Frame


tool = RthGripperTool(tool_geo, tool_plane)

tool_plane = tool.get_plane()
tool_axes, tool_axes_colors = tool.get_frame_axes_as_lines()
# ---------- end set_tool_3 ----------
pln_5 = Plane(set_tool_3.tool_plane)
preview_5 = CustomPreview(Geometry=set_tool_3.tool_axes, Shader=set_tool_3.tool_axes_colors)
geo_3 = Geometry(set_tool_3.tool_geo)
preview_6 = CustomPreview(Geometry=geo_3, Shader=ColourSwatch(SwatchColor=RGBA(100, 168, 178, 162)))

select_tool = StreamFilter(Gate=int_2, Stream0=set_tool.tool, Stream1=set_tool_2.tool, Stream2=set_tool_3.tool)
tool = Data(select_tool)
tool_2 = ClusterOutput(tool)

# ==== cluster RFL
l1 = Mesh(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)
l3 = Mesh(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)
l4 = Mesh(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)
l5 = Mesh(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)
l6 = Mesh(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)
l2 = Mesh(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)
base = Mesh([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])
base_2 = Mesh([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])
mesh = Mesh([l1, l2, l3, l4, l5, l6])
ip_abb = ClusterInput()
init = ClusterInput()
plane = Plane([PlaneXY(-1.185867404e-09, 0, 0), Plane(origin=(175, 0, 495), x=(0, 0, 1), y=(1, 0, 0)), Plane(origin=(175, 0, 1590), x=(0, 0, 1), y=(1, 0, 0)), Plane(origin=(175, 0, 1765), x=(0, 0, -1), y=(0, 1, 0)), Plane(origin=(1446, 0, 1765), x=(0, 0, 1), y=(1, 0, 0)), Plane(origin=(1581, 0, 1765), x=(-1.94917184e-05, 1.016258774e-11, -0.9999999998), y=(-2.075117433e-05, 0.9999999998, 4.146386344e-10))])
if = PythonScript(init=init, ip_abb=ip_abb, joint_planes=plane, base_geo=base, link_geo=mesh)  # -> robot; inputs joint_planes: list of Plane, base_geo: list of Mesh, link_geo: list of Mesh
# ---------- if: Python ----------
from abb_communication.clients import Robot4x

robot = Robot4x(link_geo, base_geo, joint_planes, ip_abb = ip_abb)
# ---------- end if ----------
robot = ClusterOutput(if)

# ==== cluster Cluster

rob_11_z1 = Brep(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)
rob_11_z_base = Brep([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])
rob_11_12_y = Brep([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])
rob_11_12_21_22_x = Brep([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])
rob_11_z2 = Brep([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])
mesh = Mesh(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)
mesh_2 = Mesh([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])
mesh_3 = Mesh([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])
mesh_4 = Mesh([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])
mesh_5 = Mesh([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])

mjoin = MeshJoin(Meshes=mesh_3)
mjoin_2 = MeshJoin(Meshes=mesh_2)
mjoin_3 = MeshJoin(Meshes=mesh_4)
mjoin_4 = MeshJoin(Meshes=mesh)
mjoin_5 = MeshJoin(Meshes=mesh_5)
merge = Merge(Data1=mjoin_4, Data2=mjoin_2, Data3=mjoin, Data4=mjoin_3, Data5=mjoin_5)
xy = XYPlane(Origin=Point(0, 0, 0))
init = ClusterInput()
set_tool = PythonScript(init=init, gantry_geo=merge, gantry_plane=xy)  # -> out, gantry, gantry_geo; inputs gantry_geo: list of Mesh, gantry_plane: Plane
# ---------- set_tool: Python ----------
import Rhino.Geometry as rg
import ghpythonlib.components as ghcomp
import math as m

#from abb_communication.clients.rfl_robot import Tool
from abb_communication.clients.rfl_robot.gantry import Gantry
from abb_communication.geometry import Frame

gantry = Gantry(gantry_geo, gantry_plane)

gantry_geo_n = gantry.geo
# ---------- end set_tool ----------
geo = Geometry(set_tool.gantry_geo)
gantry = ClusterOutput(set_tool.gantry)
