# Grasshopper definition visualize-path.ghx (Grasshopper 0.9.76)
# plug-ins: Python Interpreter

panel = Panel("C:\Users\stefanap\Documents\git_repos\lws_geometry\fabrication_input")
render_all_frames = BooleanToggle(False)
visualization = PythonScript(v=Slider(11, range=0..33), frame=Slider(0, range=0..150), render_all=render_all_frames, input_folder=panel)  # -> out, a; inputs frame: Int32
# ---------- visualization: Python ----------
import logging
import scriptcontext as sc

import time
import math
import pickle
from compas_fabrication.fabrication.robots.rfl import *
from compas_fabrication.fabrication.robots.robot import Pose
from compas_fabrication.fabrication.grasshopper import xdraw_mesh
from compas_fabrication.fabrication.grasshopper.path_planning import PathVisualizer, InputParameterParser


def vrep_from_config(config):
    values = map(lambda v: v / 1000., config.external_axes)
    values.extend([math.radians(angle) for angle in config.joint_values])
    return values

a = []
with open(input_folder + '\paths_input', 'rb') as path_input:
    config_robot_main, config_robot_other, goal_pose, pickup_pose, robot_number, meshes, building_member, limits, states = pickle.load(path_input)

with open(input_folder + '\structure_bars_v', 'rb') as path_result:
    b_struct = pickle.load(path_result)
    path = map(Configuration.from_degrees_list,b_struct.vertex[v]["path"])

with Simulator() as simulator:
    main_robot = Robot(robot_number, client=simulator)
    other_robot = Robot(21 if robot_number == 22 else 22, client=simulator)
    simulator.set_robot_pose(main_robot, pickup_pose)
    pickup_config = simulator.get_robot_config(main_robot)

    for m in meshes:
        a.append(xdraw_mesh(*m.to_vertices_and_faces()))

    if render_all:
        for frame_index in range(len(path)):
            building_member_mesh = xdraw_mesh(*building_member.to_vertices_and_faces())
            visualizer = PathVisualizer(simulator, main_robot, building_member_mesh, pickup_config)
            a.extend(visualizer.get_frame_meshes(path, frame_index, sc.sticky))
    else:
        frame_index = ((len(path) - 1) * frame) // 100
        #LOG.debug('Rendering frame %d out of %d', frame_index + 1, len(path))
        building_member_mesh = xdraw_mesh(*building_member.to_vertices_and_faces())
        visualizer = PathVisualizer(simulator, main_robot, building_member_mesh, pickup_config)
        a.extend(visualizer.get_frame_meshes(path, frame_index, sc.sticky))
# ---------- end visualization ----------
