# Grasshopper definition 151021_Animation_Simulation.gh (Grasshopper 0.9.76)
# plug-ins: Python Interpreter

# ----
# Globals
# Calculate furnicular curves
# Calculate looseness factor
server_ip = ValueList({"10.0.0.100", "10.0.0.101", "10.0.0.102", "192.168.10.44", "127.0.0.1"}, selected="10.0.0.100")
gh_ip = ValueList({"10.0.0.100", "10.0.0.101", "10.0.0.102", "192.168.10.44"}, selected="10.0.0.100")
globals = Globals(server_ip=server_ip, gh_ip=gh_ip)

# ----
# Paths
reload = Button()
py = PythonScript(reload=reload)
# ---------- py: Python ----------
import sys, os
import pkgutil
from scriptcontext import sticky as st
import Grasshopper as gh

ghComp = ghenv.Component
ghDoc = ghComp.OnPingDocument()

# the full path of the gh file
path = ghDoc.FilePath
# the directory of the gh file
path = os.path.dirname(path)
st["path"] = path
# one level above, the directory of our library
parent_path = os.path.abspath(os.path.join(path, '..'))

# add SANS V0.7 Lite SWC
if parent_path not in sys.path:
    sys.path.append(parent_path)

def get_all_directories_from_path(path):
    directories = []
    for f in os.listdir(path):
        if os.path.isdir(os.path.join(path, f)) and f[0] != ".":
            directories.append(os.path.join(path, f))
    return directories

library_paths = []
library_paths.append(os.path.join(parent_path, "fabrication"))

for path in library_paths:
    if path not in sys.path:
        sys.path.append(path)
    """
    dirs = get_all_directories_from_path(lib_path)
    for dir in dirs:
        if dir not in sys.path:
            sys.path.append(dir)
    """

print "===> paths in sys.path: "
for path in sys.path:
    print path
print

reload_modules = []
#reload_modules = ["generic", "serial_connections", "globals", "ur_robot"]
modules_to_pop = []


for mod in sys.modules:
    for rmod in reload_modules:
        if str(mod[:len(rmod+".")]) == rmod+".":
            modules_to_pop.append(mod)

modules_to_pop += reload_modules

for mod in modules_to_pop:
    if mod in sys.modules:
        sys.modules.pop(mod)
        print "%s unloaded" % mod
# ---------- end py ----------

# ----
# Edge curve simulation
division = Slider(30, range=0..100)
wire_length_change_curve = Curve(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)
crva = Curve(<curve referenced from the Rhino model>)
crvb = Curve(<curve referenced from the Rhino model>)
sindex = Slider(40, range=0..100)
calculate = BooleanToggle(True)
cluster = Cluster(crva=crva, crvb=crvb, division=division, lcrv=wire_length_change_curve)  # -> pa_2, pb_2, lx
reset = Button()
python = PythonScript(
    PA=cluster.pa_2,
    PB=cluster.pb_2,
    LX=cluster.lx,
    resolution=12,
    absolute_force=4,
    sindex=sindex,
    calculate=calculate,
    reset=reset)  # -> P, F, R, TA, TB; inputs PA: list, PB: list, LX: list, resolution: Int32
# ---------- python: Python ----------
"""
Created on 09.10.2015

@author: Romana Rust

This file is inside a GH component, with the following inputs:
PA - the points on edge curve A
PB - the points on edge curve B
LX - the different engagement lengths of the wire 
resolution - the number of vertices to represent the wire
absolute_force - the resultant of all forces for one calculation should not be bigger that absolute force
sindex - index to which we need to calculate
calculate - calculate funicular shapes
reset - clear all values and restart computing
"""

import Rhino.Geometry as rg
import ghpythonlib.components as ghcomp
from simulation.funicular_shape import *
import time
from scriptcontext import sticky as st
import Grasshopper as gh
from copy import deepcopy

guid = str(ghenv.Component.InstanceGuid)
ghComp = ghenv.Component # this python component

# globals
init_length = LX[0] #
if init_length != (PA[0] - PB[0]).Length:
    raise Exception("The distance between PA[0] and PB[0] must be the same as LX[0].")

N = len(PA) # the number of curves to calculate
epsilon = 0.1

current_idx_key = "current_idx_" + guid 
forces_key = "forces_" + guid
positions_key = "positions_" + guid
rg_positions_key = "rg_positions_" + guid
rg_forces_key = "rg_forces_" + guid
rg_resultants_key = "rg_resultants_" + guid
rg_tangentsA_key = "rg_tangentsA_" + guid
rg_tangentsB_key = "rg_tangentsB_" + guid

qval_key = "qval_" + guid

exit_mode_optimization_failed = False
"""  We need to scale the forces, otherwise our optimisation by 
adjusting the qval, will sometimes not work."""
fmult = 100. 

# reset resp. initialize everything
if reset or current_idx_key not in st:
    st[current_idx_key] = 0
    st[positions_key] = [[] for i in range(N)]
    st[forces_key] = [[] for i in range(N)]
    st[rg_positions_key] = [[] for i in range(N)]
    st[rg_forces_key] = [rg.Vector3d(0,0,0) for i in range(N)]
    st[rg_resultants_key] = [rg.Vector3d(0,0,0) for i in range(N)]
    st[rg_tangentsA_key] = [rg.Vector3d(0,0,0) for i in range(N)]
    st[rg_tangentsB_key] = [rg.Vector3d(0,0,0) for i in range(N)]
    st[qval_key] = 1.

def reset_qval(qval):
    if type(qval) == type(np.array([])):  
        qval = qval[0]
    return qval

def self_update():
    ghComp.ExpireSolution(True)
    

idx = st[current_idx_key]
print ">> %i ==========================================" % idx

pA = np.array(list(PA[idx])) # convert to numpy point
pB = np.array(list(PB[idx])) # convert to numpy point

desired_length = LX[idx]


if calculate:

    if idx == 0:
        forces = np.array([[0,0,0] for i in range(resolution)])
        xyz = calculate_vertices(pA, pB, resolution) # get points equally distributed between pA and pB
    else:
        # get the previously calculated
        prev_positions = st[positions_key][idx-1]
        positions = calculate_vertices(pA, pB, resolution)
        # calculate forces
        forces = calculate_forces_normed(positions, prev_positions, absolute_force)
        # calculate shape according to forces with uniform length
        xyz, current_length, qval = calculate_funicular_shape(positions, forces * fmult, desired_length, st[qval_key])
        st[qval_key] = reset_qval(qval)
        if np.fabs(desired_length - current_length) > epsilon:
            exit_mode_optimization_failed = True
            
        print 
        
        # now we recalculate the forces according to the calculated positions(xyz) and check the difference
        forces_normalized = forces/(absolute_force/resolution) # every force vector has length 1
        
        distance_vectors = prev_positions - xyz
        lengths = np.apply_along_axis(np.linalg.norm, 1, distance_vectors)
        lengths = lengths/np.sum(lengths) # so that their sum is 1
        # we scale the forces to be in total absolute_force
        forces = absolute_force * np.transpose(forces_normalized.T * lengths)
        
        xyz, current_length, qval = calculate_funicular_shape(positions, forces * fmult, desired_length, st[qval_key])
        
        st[qval_key] = reset_qval(qval)
        if np.fabs(desired_length - current_length) > epsilon:
            exit_mode_optimization_failed = True
        
    rg_xyz = [rg.Point3d(xyz[i, 0], xyz[i, 1], xyz[i, 2]) for i in range(len(xyz))] # convert result to rg points
    rg_forces = [rg.Vector3d(f[0], f[1], f[2]) for f in forces] # convert forces into rg vectors
    
    resultant = np.apply_along_axis(np.sum, 0, forces)
    st[rg_resultants_key][idx] = rg.Vector3d(resultant[0], resultant[1], resultant[2])
    
    print "resultant", resultant/np.linalg.norm(resultant)
    print "f0 + f1", (forces[0] + forces[-1])/ np.linalg.norm(forces[0] + forces[-1])
    #print "forces: np.linalg.norm(R)", np.linalg.norm(R) #= absolute_force
    
    st[rg_tangentsA_key][idx] = (rg_xyz[0] - rg_xyz[1])/(rg_xyz[0] - rg_xyz[1]).Length
    st[rg_tangentsB_key][idx] = (rg_xyz[-1] - rg_xyz[-2])/(rg_xyz[-1] - rg_xyz[-2]).Length
    
    st[rg_forces_key][idx] = rg_forces
    st[rg_positions_key][idx] = rg_xyz
    
    st[positions_key][idx] = xyz
    st[forces_key][idx] = forces
    
    #if idx < len(PA) - 1:
    sindex = min(sindex, N-1)
    if idx < sindex and not exit_mode_optimization_failed:
        st[current_idx_key] += 1
        self_update() # update component and calculate with new index
    else:
        print "exit_mode_optimization_failed", exit_mode_optimization_failed
    
    P = st[rg_positions_key]
    F = st[rg_forces_key]
    R = st[rg_resultants_key]
    TA = st[rg_tangentsA_key]
    TB = st[rg_tangentsB_key]
# ---------- end python ----------
py_2 = PythonScript(P=python.P)  # -> C, L; inputs P: list
# ---------- py_2: Python ----------
import Rhino.Geometry as rg
import ghpythonlib.components as ghcomp

C = []
for p in P:
    if len(p):
        C.append(rg.Curve.CreateControlPointCurve(p, 3))

L = ghcomp.Loft(C)
# ---------- end py_2 ----------
brep = Brep(py_2.L)
py_3 = PythonScript(C=py_2.C, extension=Slider(300, range=250..1000))  # -> CA; inputs C: list
# ---------- py_3: Python ----------
""" Calculate outer points """
import Rhino.Geometry as rg
import ghpythonlib.components as ghcomp

inner_PA, inner_PB = ghcomp.EndPoints(C)

init_length = C[0].GetLength() + extension * 2

EL = []

outer_PA = []
outer_PB = []

CA = []

for ipA, ipB, crv in zip(inner_PA, inner_PB, C):
    length2add = (init_length - crv.GetLength())/2.
    pA = ipA - crv.TangentAtStart * length2add
    pB = ipB + crv.TangentAtEnd * length2add
    EL.append(rg.Line(crv.PointAtStart, pA))
    EL.append(rg.Line(crv.PointAtEnd, pB))
    outer_PA.append(pA)
    outer_PB.append(pB)
    CA.append(ghcomp.JoinCurves([rg.Line(pA, crv.PointAtStart), crv, rg.Line(crv.PointAtEnd, pB)], True))
# ---------- end py_3 ----------

# ----
# Interpolate simulated curves
N = Slider(10, range=0..10)
dam = DataDam(DataA=py_3, BufferDelay=10000000, BufferMode=0)
crv = Curve(dam)
py_4 = PythonScript(C=crv, F=python.F, N=N)  # -> CC, FV, FA; inputs C: list, F: list, N: Int32
# ---------- py_4: Python ----------
import Rhino.Geometry as rg
import rhinoscriptsyntax as rs

"""interpolate the forces between curves"""

Cnew = []
FV = [] # force vectors
FA = [] # force vector anchors

def interpolate_two_vectors(v1, v2, N):
    Vi = []
    d = (v2 - v1)/N
    for i in range(1, N):
        Vi.append(v1 + i * d)
    return Vi # = # N - 1

def interpolate_two_points(p1, p2, N):
    Pi = []
    v = (p2 - p1)/N
    for i in range(1, N):
        Pi.append(p1 + i * v)
    return Pi # = # N - 1
    
def sublist_from_center(alist, num):
    if (len(alist) - num) < 0:
        raise Exception("Length of list must be bigger than num")
    elif len(alist) == num:
        return alist[:]
    else:
        diff = len(alist) - num
        if diff % 2 != 0:
            raise Exception("Length of list and num must be either both even or both odd.")
        return alist[int(diff/2):int(-diff/2)]

for k, (c1, c2) in enumerate(zip(C[:-1], C[1:])):
    P1 = rs.CurvePoints(c1)
    P2 = rs.CurvePoints(c2)
    F1 = F[k]
    F2 = F[k+1]
    
    # divide the differences between points
    Cnew.append(rg.Curve.CreateControlPointCurve(P1, 3))

    Pnew_temp = [[] for i in range(1, N)]
    Fnew_temp = [[] for i in range(1, N)]
    
    print len(P1)
    print len(P2)
    print len(F1)
    
    # attention len(P1) != len(F1) !!!  
    
    FV.append(F1)
    FA.append(sublist_from_center(P1, len(F1)))
    
      
    for f1, f2 in zip(F1, F2):
        Fi = interpolate_two_vectors(f1, f2, N)
        for i, f in enumerate(Fi):
            Fnew_temp[i].append(f)
    
    for p1, p2 in zip(P1, P2):
        Pi = interpolate_two_points(p1, p2, N)
        for i, pt in enumerate(Pi):
            Pnew_temp[i].append(pt)

    for pts, forces in zip(Pnew_temp, Fnew_temp):
        FV.append(forces)
        FA.append(sublist_from_center(pts, len(forces)))
    
    for pts in Pnew_temp:
        Cnew.append(rg.Curve.CreateControlPointCurve(pts, 3))
        
    if k == len(C) - 2:
        Cnew.append(rg.Curve.CreateControlPointCurve(P2, 3))
        
        FV.append(F2)
        FA.append(sublist_from_center(P2, len(F2)))


CC = Cnew
# ---------- end py_4 ----------
py_5 = PythonScript(C=py_4.CC)  # -> CI; inputs C: list
# ---------- py_5: Python ----------
from scriptcontext import sticky as st
import Rhino.Geometry as rg

foam_block = st["foam_block"]
foam_block_brep = rg.Brep.CreateFromBox(foam_block)

CI = []

for i, c in enumerate(C):
    rc, crv_list, pt_list = rg.Intersect.Intersection.CurveBrep(c, foam_block_brep, .1)
    
    if len(pt_list):
        p1, p2 = pt_list
    else:
        # intersect with the side faces of the foam block
        f1 = foam_block_brep.Faces[1]
        f2 = foam_block_brep.Faces[3]
        rc, crvl, ptl1 = rg.Intersect.Intersection.CurveBrepFace(c, f1, 0.1)
        rc, crvl, ptl2 = rg.Intersect.Intersection.CurveBrepFace(c, f2, 0.1)
        p1, p2 = ptl1[0], ptl2[0]
        
    t1 = rg.Curve.ClosestPoint(c, p1)[1]
    t2 = rg.Curve.ClosestPoint(c, p2)[1]
    CI.append(rg.Curve.Trim(c, rg.Interval(t1, t2)))
# ---------- end py_5 ----------
py_6 = PythonScript(C=py_4.CC)  # -> ur1_pts, ur2_pts, ur1_tangents, ur2_tangents; inputs C: list
# ---------- py_6: Python ----------
import Rhino.Geometry as rg
from scriptcontext import sticky as st
import ghpythonlib.components as ghcomp

PA, PB = ghcomp.EndPoints(C)

crvA = rg.Curve.CreateControlPointCurve(PA, 1)
crvB = rg.Curve.CreateControlPointCurve(PB, 1)

TA = []
TB = []

# we want that the tangent's direction towards "outside" the curve
for c, pA, pB in zip(C, PA, PB):
    tA = c.TangentAtStart
    tB = c.TangentAtEnd
    # the smaller distance has the correct sign of tangent
    d1 = ((pA + tA) - c.PointAt(c.ClosestPoint(pA + tA)[1])).Length
    d2 = ((pA - tA) - c.PointAt(c.ClosestPoint(pA - tA)[1])).Length
    if d2 < d1: tA *= -1
    
    d1 = ((pB + tB) - c.PointAt(c.ClosestPoint(pB + tB)[1])).Length
    d2 = ((pB - tB) - c.PointAt(c.ClosestPoint(pB - tB)[1])).Length
    if d2 < d1: tB *= -1
    
    TA.append(tA)
    TB.append(tB)

ur1_plane = st["ur1_plane"]
ur2_plane = st["ur2_plane"]

# check which curve is closer to which robot

p1 = crvA.PointAt(crvA.ClosestPoint(ur1_plane.Origin)[1])
d1 = (p1 - ur1_plane.Origin).Length
p2 = crvB.PointAt(crvB.ClosestPoint(ur2_plane.Origin)[1])
d2 = (p2 - ur2_plane.Origin).Length

if d1 < d2:
    ur1_pts = PA
    ur2_pts = PB
    ur1_tangents = TA
    ur2_tangents = TB
    
else:
    ur1_pts = PB
    ur2_pts = PA
    ur1_tangents = TB
    ur2_tangents = TA
# ---------- end py_6 ----------

run = BooleanToggle(False)
reset_2 = Button()

idx = Slider(300, range=0..400)
animation_idx = Number(idx)

py_7 = PythonScript(forces=py_4.FV, anchors=py_4.FA, idx=animation_idx)  # -> A, V; inputs forces: list, anchors: list, idx: Int32
# ---------- py_7: Python ----------
import ghpythonlib.components as ghcomp

idx = min(idx, len(forces) - 1)

# show the current wire
A = anchors[idx]
V = forces[idx]
# ---------- end py_7 ----------
length_scale = Slider(110, range=0..200)
width_scale = Slider(0.3, range=0.1..4)
cone_scale = Slider(0.8, range=0.1..4)
trans = Slider(20, range=0..50)

# ----
# Find continuous path movement
list = ValueList({"UR1": "ur1", "UR2": "ur2"}, selected="UR1")
ur_poses = URPoses(ur=list, pts=py_6.ur1_pts)  # -> planes_wcs, planes_rcs, planes_rcs_mintpt, poses
list_2 = ValueList({"UR1": "ur1", "UR2": "ur2"}, selected="UR2")
ur_poses_2 = URPoses(ur=list_2, pts=py_6.ur2_pts)  # -> planes_wcs, planes_rcs, planes_rcs_mintpt, poses
joint_check = PythonScript(planes_RCS_minTPT=ur_poses.planes_rcs_mintpt, maxdiff=Slider(1, range=0..7))  # -> joints, idxs; inputs planes_RCS_minTPT: list
# ---------- joint_check: Python ----------
import math
import Rhino.Geometry as rg
from scriptcontext import sticky as st
from ur_robot.kinematic.joint_check import *

print maxdiff
all_joints = joint_check_all_start_indices(planes_RCS_minTPT, maxdiff)
print all_joints
idxs = [all_joints[i][0] for i in range(len(all_joints))]
joints = [all_joints[i][1] for i in range(len(all_joints))]

print idxs
print len(joints)
# ---------- end joint_check ----------
joint_check_2 = PythonScript(planes_RCS_minTPT=ur_poses_2.planes_rcs_mintpt, maxdiff=Slider(1, range=0..7))  # -> joints, idxs; inputs planes_RCS_minTPT: list; same code as joint_check
step = Button()
gate = PythonScript(joints=joint_check.joints, idxs=joint_check.idxs, step=step)  # -> joints, idx; inputs joints: list, idxs: list
# ---------- gate: Python ----------
from scriptcontext import sticky as st
from ur_robot.kinematic import get_smallest_solution

guid = str(ghenv.Component.InstanceGuid) # guid of this individual component

current_idx = "current_idx_" + guid

if current_idx not in st:
    st[current_idx] = 0

if step:
    st[current_idx] = (st[current_idx] + 1) % len(idxs)


try:
    idx = idxs[st[current_idx]]
except:
    st[current_idx] = 0
joints = joints[st[current_idx]]

init_joints = get_smallest_solution(joints[0])
# ---------- end gate ----------
step_2 = Button()
gate_2 = PythonScript(joints=joint_check_2.joints, idxs=joint_check_2.idxs, step=step_2)  # -> joints, idx; inputs joints: list, idxs: list; same code as gate
panel = Panel(gate.idx)
panel_2 = Panel(gate_2.idx)
joint_check_3 = PythonScript(joints=gate.joints)  # -> j0, j1, j2, j3, j4, j5; inputs joints: list
# ---------- joint_check_3: Python ----------
import numpy as np

joints = np.array(joints)

j0 = joints[:,0]
j1 = joints[:,1]
j2 = joints[:,2]
j3 = joints[:,3]
j4 = joints[:,4]
j5 = joints[:,5]
# ---------- end joint_check_3 ----------
joint_check_4 = PythonScript(joints=gate_2.joints)  # -> j0, j1, j2, j3, j4, j5; inputs joints: list; same code as joint_check_3
graph = QuickGraph([joint_check_4.j0, joint_check_4.j1, joint_check_4.j2, joint_check_4.j3, joint_check_4.j4, joint_check_4.j5])
graph_2 = QuickGraph([joint_check_3.j0, joint_check_3.j1, joint_check_3.j2, joint_check_3.j3, joint_check_3.j4, joint_check_3.j5])

wire_in_foam = Curve(py_5)
lng = ListLength(List=wire_in_foam)
python_2 = PythonScript(run=run, reset=reset_2, count=lng)  # -> C; inputs count: Int32
# ---------- python_2: Python ----------
from scriptcontext import sticky as st
import Grasshopper as gh

guid = str(ghenv.Component.InstanceGuid)

counter_key = "counter_" + guid
anchors = "anchors_" + guid
length = count


def ghComponentTimer(run,interval):
    """ Update the component at the interval like using a GH timer """
    
    # Ensure interval is larger than zero
    if interval <= 0:
        interval = 1
        
    # Get the Grasshopper document and component that owns this script
    ghComp = ghenv.Component
    ghDoc = ghComp.OnPingDocument()
    
    # Define the callback function
    def callBack(ghDoc):
        ghComp.ExpireSolution(False)
        
    # Update the solution
    if run:
        ghDoc.ScheduleSolution(interval, gh.Kernel.GH_Document.GH_ScheduleDelegate(callBack))


if reset or counter_key not in st:
    st[counter_key] = 0

else:
    if run:
        if st[counter_key] < length - 1:
            ghComponentTimer(run, 500)
            st[counter_key] += 1

C = st[counter_key]
# ---------- end python_2 ----------
idx_2 = Panel(python_2)

# ----
# GH Turntable
height = Slider(300, range=0..1000)
height_2 = Slider(19850, range=0..25000)
py_8 = PythonScript(h=height)  # -> target
# ---------- py_8: Python ----------
import Rhino.Geometry as rg


target = rg.Point3d(0,0,h)
# ---------- end py_8 ----------
lng_2 = ListLength(List=wire_in_foam)
animation_idx_2 = Receiver(animation_idx)
dom = Domain(DomainStart=0, DomainEnd=1)
frames = Receiver(lng_2)
py_9 = PythonScript(target=py_8, radius=Slider(28277, range=0..100000), h=height_2)  # -> A
# ---------- py_9: Python ----------
import Rhino.Geometry as rg
import math

C = rg.Circle(rg.Plane(target, rg.Vector3d.ZAxis), radius)

C.Transform(rg.Transform.Translation(rg.Vector3d.ZAxis * h))

A = rg.Arc(C, math.pi/2.)

A.Transform(rg.Transform.Rotation(math.radians(90 + 45), rg.Vector3d.ZAxis, rg.Point3d(0,0,0)))
# ---------- end py_9 ----------
range = Range(Domain=dom, Steps=frames)
crv_2 = Curve(reverse(py_9))
camera_path = Receiver(crv_2)
graph_3 = GraphMapper(range, x0=0, x1=1, y0=0, y1=1, container_name="Bezier", cpx=[0, 0.4522388577, 0.5140986443, 1], cpy=[0, 0, 1, 1])
domcomp = DomainComponents(Domain=camera_path)  # -> Start, End
multiplication = Multiplication(A=domcomp.End, B=graph_3)
eval = EvaluateCurve(Curve=camera_path, Parameter=multiplication)  # -> Point, Tangent, Length
rev = ReverseList(List=eval.Point)
vcomp = Decompose(Vector=eval.Tangent)  # -> XComponent, YComponent, ZComponent
item = ListItem(List=rev, Index=animation_idx_2, Wrap=True)
vec = VectorXYZ(XComponent=0, YComponent=vcomp.YComponent, ZComponent=vcomp.ZComponent)  # -> Vector, Length
camera = CSharpScript(location=item, target=py_8, upVector=vec.Vector)  # -> out, A; inputs location: Point3d, target: Point3d, upVector: Vector3d
# ---------- camera: C# ----------
    Rhino.Display.RhinoView view = doc.Views.ActiveView;

    Rhino.Display.RhinoViewport vp = view.ActiveViewport;

    vp.CameraUp = upVector;
    vp.SetCameraLocation(location, false);
    vp.SetCameraDirection(target - location, true);
# ---------- end camera ----------

# ----
# Animate
wire = Curve(py_4.CC)
vdis = VectorDisplay(Anchor=py_7.A, Vector=py_7.V)
python_3 = PythonScript(A=py_7.A, V=py_7.V, length_scale=length_scale, width_scale=width_scale, cone_scale=cone_scale, trans=trans)  # -> G
# ---------- python_3: Python ----------
import ghpythonlib.components as ghcomp
import Rhino.Geometry as rg

G = []



cone_height = 20 * cone_scale
radius = 7 * cone_scale

vunit = V/V.Length

A = A - vunit * trans

pt = A - cone_height * vunit

G.append(ghcomp.Pipe(rg.Line(pt, - V * length_scale), 2 * width_scale, 1))
G.append(ghcomp.Cone(rg.Plane(pt, vunit), radius, cone_height)[0])
# ---------- end python_3 ----------
idx_3 = Number(animation_idx)
colour_swatch = ColourSwatch(SwatchColor=RGB(39, 109, 112))
preview = CustomPreview(Geometry=python_3, Shader=ColourSwatch(SwatchColor=RGB(0, 0, 0)))
num = Number(0.2)
colour_swatch_2 = ColourSwatch(SwatchColor=RGBA(191, 191, 191, 167))
loft_opt = LoftOptions(Closed=False, Adjust=False, Rebuild=0, Refit=0, Type=1)
colour_swatch_3 = ColourSwatch(SwatchColor=RGB(102, 102, 102))
material = CreateMaterial(
    Diffuse=ColourSwatch(SwatchColor=RGB(115, 115, 115)),
    Specular=RGB(255, 255, 255),
    Emission=RGB(66, 66, 66),
    Transparency=0,
    Shine=0)
path = FilePath("C:\Users\rustr\Desktop\simulation\02_302\image_0077.jpg")

# ----
# Capture to file
capture = BooleanToggle(False)
path_2 = FilePath("C:\Users\rustr\Desktop\simulation\01\xxx.jpg")
python_4 = PythonScript(capture=capture, filepath=path, filename="image_", idx=animation_idx)  # -> out, a
# ---------- python_4: Python ----------
import os
import rhinoscriptsyntax as rs

parent_path = os.path.abspath(os.path.join(filepath, os.pardir))

filename = filename + "%04d" % idx + ".jpg"
filepath = os.path.join(parent_path, filename)
print filepath

width = 1225
height = 590
scale = 4

if capture:
    #rs.Command("!-_ViewCaptureToFile %s Width=%d Height=%d Scale=%d _Enter" % (filepath, width, height, scale))
    rs.Command("!-_ViewCaptureToFile %s _Enter" % (filepath))
# ---------- end python_4 ----------

# ----
# Precalculate transformations (this takes a while ...)
number_slider = Slider(2.5, range=0..10)
number_slider_2 = Slider(100, range=0..100)
calculate_2 = BooleanToggle(False)
python_5 = PythonScript(calculate=calculate_2, joints_ur1=gate.joints, joints_ur2=gate_2.joints)  # -> joints_ur1, joints_ur2; inputs joints_ur1: list, joints_ur2: list
# ---------- python_5: Python ----------
if not calculate:
    joints_ur1 = []
    joints_ur2 = []
# ---------- end python_5 ----------
list_3 = ValueList({"UR1": "ur1", "UR2": "ur2"}, selected="UR1")
transform = Transform(ur=list_3, joints=python_5.joints_ur1, tangents=py_6.ur1_tangents, cy_radius=number_slider, cy_length=number_slider_2)
list_4 = ValueList({"UR1": "ur1", "UR2": "ur2"}, selected="UR2")
transform_2 = Transform(ur=list_4, joints=python_5.joints_ur2, tangents=py_6.ur2_tangents, cy_radius=number_slider, cy_length=number_slider_2)

ur1_robot_positions = Data(transform)
ur2_robot_positions = Data(transform_2)
py_10 = PythonScript(wire=wire, wire_in_foam=wire_in_foam, wif_trim=number_slider_2, idx=animation_idx)  # -> W, WI; inputs wire: list, wire_in_foam: list, idx: Int32
# ---------- py_10: Python ----------
import ghpythonlib.components as ghcomp
import Rhino.Geometry as rg

idx = min(idx, len(wire) - 1)

# show the current wire
W = wire[idx]

if wif_trim:
    t0 = rg.Curve.LengthParameter(W, wif_trim)[1]
    t1 = rg.Curve.LengthParameter(W, W.GetLength() - wif_trim)[1]
    W = rg.Curve.Trim(W, t0, t1)
    print W

# loft the inner curves until the current 
if idx > 0:    
    #O = ghcomp.LoftOptions(False, False, False, False, 1)
    #L = ghcomp.Loft(wire_in_foam[:(idx + 1)], O)
    
    """ trim the wire with the length"""
    WI = wire_in_foam[:(idx + 1)]
# ---------- end py_10 ----------
py_11 = PythonScript(robots=ur2_robot_positions, idx=idx_3)  # -> G; inputs robots: list, idx: Int32
# ---------- py_11: Python ----------
G = robots[min(idx, len(robots) - 1)]
# ---------- end py_11 ----------
py_12 = PythonScript(robots=ur1_robot_positions, idx=idx_3)  # -> G; inputs robots: list, idx: Int32; same code as py_11
pipe = Pipe(Curve=py_10.W, Radius=1.7, Caps=0)
preview_2 = CustomPreview(Geometry=pipe, Shader=ColourSwatch(SwatchColor=RGB(199, 0, 36)))
preview_3 = CustomPreview(Geometry=[py_12, py_11], Shader=material)
loft = Loft(Curves=py_10.WI, Options=loft_opt)
edges = BrepEdges(Brep=[py_11, py_12])  # -> Naked, Interior, NonManifold
preview_4 = CustomPreview(Geometry=edges.Interior, Shader=ColourSwatch(SwatchColor=RGB(0, 0, 0)))
edges_2 = BrepEdges(Brep=loft)  # -> Naked, Interior, NonManifold
material_2 = CreateMaterial(
    Diffuse=ColourSwatch(SwatchColor=RGBA(34, 125, 148, 144)),
    Specular=RGB(255, 255, 255),
    Emission=RGB(0, 0, 0),
    Transparency=0.5,
    Shine=0)
preview_5 = CustomPreview(Geometry=loft, Shader=material_2)
geo = Geometry(edges_2.Naked)
pipe_2 = Pipe(Curve=geo, Radius=1.5, Caps=0)
preview_6 = CustomPreview(Geometry=pipe_2, Shader=ColourSwatch(SwatchColor=RGB(42, 76, 110)))

# ----
# UR5 Model
ur5_model = UR5Model()  # -> ur5_geo_2, ur5_axes_2, ur5_tp_2, ur5_workspace_2

# ----
# Tool Models
y_axis = Curve(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)
z_axis = Curve(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)
cardan_tool_vs04 = Geometry([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, Point(-1.001865257e-10, 0, 99.85), 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, Point(0, 0, 0), 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])
x_axis = Curve(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)
y_axis_2 = Curve(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)
z_axis_2 = Curve(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)
measurement_tool = Geometry([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])
x_axis_2 = Curve(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)
tool = PythonScript(G=measurement_tool, Ax=[x_axis_2, y_axis_2, z_axis_2])  # -> T; inputs G: list, Ax: list
# ---------- tool: Python ----------
from Geometry import get_tool_settings
import Rhino.Geometry as rg

G, ur_tcp, tcp_plane = get_tool_settings(G, Ax)

T = [G, ur_tcp, tcp_plane]
# ---------- end tool ----------
tool_2 = PythonScript(G=cardan_tool_vs04, Ax=[x_axis, y_axis, z_axis])  # -> T; inputs G: list, Ax: list
# ---------- tool_2: Python ----------
from Geometry import get_tool_settings

G, ur_tcp, tcp_plane = get_tool_settings(G, Ax)


print G
print ur_tcp
print tcp_plane

T = [G, ur_tcp, tcp_plane]

print T
# ---------- end tool_2 ----------
entwine = Entwine(Branch00=tool, Branch01=tool_2, FlattenInputs=True)

# ----
# Bases
ur1_base = PythonScript()  # -> Pl
# ---------- ur1_base: Python ----------
import Rhino.Geometry as rg

origin = rg.Point3d(350, -1150.0, -500)
x_axis = rg.Vector3d(0, 1, 0)
y_axis = rg.Vector3d(-1, 0, 0)
z_axis = rg.Vector3d(0, 0, 1)

"Measured base"

origin = rg.Point3d( 36.8134,-843.07,-368.677 )
x_axis = rg.Vector3d( -0.0300336638740391,0.999050014791557,-0.0315760507234886 )
y_axis = rg.Vector3d( -0.999543530278083,-0.0301219432893705,-0.00232370645702945 )
z_axis = rg.Vector3d( -0.00327263097946172,0.0314918477937233,0.999498651029109 )

# origin = rg.Point3d( 26.9886,-645.544,-379.4 )
# Reameasured: differs a lot !!!
# origin = rg.Point3d( 31.039,-655.801,-370.178 )
origin = rg.Point3d( 31.4917,-655.96,-369.934 )
x_axis = rg.Vector3d( -0.0291832452137712,0.999571898184238,0.0020877162528734 )
y_axis = rg.Vector3d( -0.999567774108,-0.0291755795981395,-0.00361255033062938 )
z_axis = rg.Vector3d( -0.00355009345955927,-0.00219223982999961,0.999991295422593 )


#NEW SETUP!!!
origin = rg.Point3d( 437.334,4.60392,-456.129 )
x_axis = rg.Vector3d( -0.999969259367364,0.00224561154694972,-0.00751249286624303 )
y_axis = rg.Vector3d( -0.00231448120369736,-0.999955264654769,0.00917125214835414 )
z_axis = rg.Vector3d( -0.00749156172255678,0.00918835774179287,0.999929722823042 )

"""
origin = rg.Point3d( 423.023,3.20397,-466.97 )
x_axis = rg.Vector3d( -0.999983051371542,-0.00552671697088409,0.0018309476188543 )
y_axis = rg.Vector3d( 0.005515288854221,-0.999965638505229,-0.00618897387982857 )
z_axis = rg.Vector3d( 0.00186508941173127,-0.00617877078021481,0.999979171899661 )
"""

"""
# 25.08.2015
origin = rg.Point3d( 422.17,4.1609,-466.073 )
x_axis = rg.Vector3d( -0.999995939944323,-0.00283404500952795,0.000297125821352051 )
y_axis = rg.Vector3d( 0.00283104729792288,-0.999949470969123,-0.00964575967814401 )
z_axis = rg.Vector3d( 0.0003244473249512,-0.00964487933856899,0.999953434434063 )
"""

# 03.09.2015


origin = rg.Point3d( 426.026,2.98727,-467.957 )
x_axis = rg.Vector3d( -0.999983871965634,-0.00302434946592004,0.00480719449650123 )
y_axis = rg.Vector3d( 0.00298920642062032,-0.999968879826283,-0.00730096048087704 )
z_axis = rg.Vector3d( 0.00482912555170445,-0.00728647303408138,0.999961792698666 )


# 07.09.2015
"""
origin = rg.Point3d( 436.318,5.76257,-455.211 )
x_axis = rg.Vector3d( -0.999976589310361,-0.00121662362261346,-0.00673354722098707 )
y_axis = rg.Vector3d( 0.00116610009858804,-0.999971178921903,0.00750210211209796 )
z_axis = rg.Vector3d( -0.00674248038754558,0.00749407449263554,0.999949187611912 )

origin = rg.Point3d( 436.154,5.91343,-455.619 )
x_axis = rg.Vector3d( -0.999973125327947,-5.51617228677659E-05,-0.00733113763627841 )
y_axis = rg.Vector3d( -1.46273367212674E-05,-0.999954691799306,0.00951914568625831 )
z_axis = rg.Vector3d( -0.00733133056809935,0.00951899709735853,0.999927817538027 )
"""
# adjustment


#origin -= z_axis * 18
#origin -= y_axis * 12
print origin


# origin is 400mm in RCS -xaxis 
# origin += - x_axis * 400
origin -= -x_axis * 1631
origin -= z_axis * 50

Pl = rg.Plane(origin, x_axis, y_axis)
# ---------- end ur1_base ----------
ur2_base = PythonScript()  # -> Pl
# ---------- ur2_base: Python ----------
import Rhino.Geometry as rg

origin = rg.Point3d(350, 1150.0, -500)
x_axis = rg.Vector3d(0, 1, 0)
y_axis = rg.Vector3d(-1, 0, 0)
z_axis = rg.Vector3d(0, 0, 1)

"Measured base"

origin = rg.Point3d( 14.5979,833.732,-383.642 )
x_axis = rg.Vector3d( -0.00556155320064056,0.00982020172738302,-0.999936314354084 )
y_axis = rg.Vector3d( -0.999984533639281,-1.45150383004744E-05,0.00556167884215785 )
z_axis = rg.Vector3d( 4.01026942720234E-05,0.999951780551116,0.00982013057075849 )

# Remeasured: origin = rg.Point3d( 9.53254,647.046,-381.01 )
# origin = rg.Point3d( 10.6508,647.054,-380.19 )
origin = rg.Point3d( 9.97215,647.082,-380.158 )
x_axis = rg.Vector3d( -0.00165927329633256,0.999996026405517,0.00227903165944619 )
y_axis = rg.Vector3d( -0.999972267790046,-0.00167577152084084,0.00725640686854703 )
z_axis = rg.Vector3d( 0.00726019717087872,-0.00226692809471742,0.999971074868695 )


#NEW SETUP!!!
#(Measuring at outer line: thickness alu: 50: inner rille: 12, 1650 - (50 - 12)/2 = 1631)
origin = rg.Point3d( -434.536,-5.31629,-461.01 )
x_axis = rg.Vector3d( -0.999314435307275,-0.0368825306560781,0.00321532562972384 )
y_axis = rg.Vector3d( 0.0369012699150775,-0.99930103680084,0.00597780289240709 )
z_axis = rg.Vector3d( 0.00299260173700016,0.00609235432073129,0.999976963511497 )

origin = rg.Point3d( -434.325,-5.64526,-460.862 )
x_axis = rg.Vector3d( -0.999324780493377,-0.0367403188044348,0.000363408878045801 )
y_axis = rg.Vector3d( 0.036741580977494,-0.999314724836011,0.00448742166531973 )
z_axis = rg.Vector3d( 0.000198290540373528,0.00449774388739753,0.999989865439038 )

# 25.08.2015
origin = rg.Point3d( -435.164,-8.3479,-459.27 )
x_axis = rg.Vector3d( -0.999147252745121,-0.0412742515922073,-0.00109703572453012 )
y_axis = rg.Vector3d( 0.0412708392571157,-0.99914358244159,0.00296976308795989 )
z_axis = rg.Vector3d( -0.00121867095273514,0.00292195504559259,0.999994988497353 )


# 03.09.2015
origin = rg.Point3d( -438.289,-9.17525,-460.72 )
x_axis = rg.Vector3d( -0.99896715908008,-0.0452786895263706,0.0038020197592205 )
y_axis = rg.Vector3d( 0.0452938150315409,-0.998965735777626,0.00399112291900887 )
z_axis = rg.Vector3d( 0.00361737465069939,0.00415920870366208,0.999984807676395 )

# 07.09.2015
origin = rg.Point3d( -434.682,-7.9614,-459.169 )
x_axis = rg.Vector3d( -0.999187744819992,-0.0402072109603326,0.00268901251962853 )
y_axis = rg.Vector3d( 0.0402180823239518,-0.999182435709444,0.00411898336090976 )
z_axis = rg.Vector3d( 0.00252120124608142,0.00422378462222305,0.999987901520684 )


# origin is 400mm in RCS +xaxis 
#origin += x_axis * 400
origin -= x_axis * 1631
origin -= z_axis * 50

Pl = rg.Plane(origin, x_axis, y_axis)
print Pl
# ---------- end ur2_base ----------

# ----
# Tool
list_5 = ValueList({"Measurement tool": 0, "Cardan tool vs4": 1}, selected="Cardan tool vs4")
list_6 = ValueList({"Measurement tool": 0, "Cardan tool vs4": 1}, selected="Cardan tool vs4")
tools = PythonScript(ur1_tool_id=list_5, ur2_tool_id=list_6, T=entwine)  # -> ur1_tool, ur2_tool; inputs ur1_tool_id: Int32, ur2_tool_id: Int32, T: tree
# ---------- tools: Python ----------
import Rhino.Geometry as rg
from scriptcontext import sticky as st

ur1_G, ur1_tcp, ur1_tcp_plane = T.Branch(ur1_tool_id)
ur2_G, ur2_tcp, ur2_tcp_plane = T.Branch(ur2_tool_id)

st["ur1_tcp"] = ur1_tcp
st["ur1_tcp_plane"] = ur1_tcp_plane
st["ur1_tool_geo"] = ur1_G

st["ur2_tcp"] = ur2_tcp
st["ur2_tcp_plane"] = ur2_tcp_plane
st["ur2_tool_geo"] = ur2_G

print st["ur1_tcp"]
print st["ur2_tcp"]

ur1_tool = st["ur1_tool_geo"]
ur2_tool = st["ur2_tool_geo"]
# ---------- end tools ----------
ur1_tool = Geometry(tools.ur1_tool)
ur2_tool = Geometry(tools.ur2_tool)

# ----
# UR2
workspace_ur2_set_tp = Brep(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)
list_7 = ValueList({"UR1": "ur1", "UR2": "ur2"}, selected="UR2")
set_rcs = SetRCS(ur=list_7, pl=ur2_base, G=ur5_model.ur5_geo_2, ax=ur5_model.ur5_axes_2, tp=ur5_model.ur5_tp_2, ws=workspace_ur2_set_tp)

# ----
# UR1
list_8 = ValueList({"UR1": "ur1", "UR2": "ur2"}, selected="UR1")
workspace_ur1_set_tp = Brep(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)
set_rcs_2 = SetRCS(ur=list_8, pl=ur1_base, G=ur5_model.ur5_geo_2, ax=ur5_model.ur5_axes_2, tp=ur5_model.ur5_tp_2, ws=workspace_ur1_set_tp)

# ----
# Foam block
L = Slider(1200, range=0..3000)
W = Slider(600, range=0..1000)
X = Slider(-300, range=-1000..1000)
Y = Slider(-600, range=-1000..1000)
_100 = Number(100)
_200 = Number(200)
_300 = Number(300)
_800 = Number(800)
V = Data([X, Y, W, L])
python_6 = PythonScript(V=V, fb_height=_800, box_heights=_100)  # -> B, C, Bx; inputs V: list, box_heights: list
# ---------- python_6: Python ----------
import Rhino.Geometry as rg
import ghpythonlib.components as gh
from scriptcontext import sticky as st

x, y, w, l = V
h = fb_height

all_bx_heights = sum(box_heights)

x_interval = rg.Interval(x, x+w)
y_interval = rg.Interval(y, y+l)
z_interval = rg.Interval(all_bx_heights, all_bx_heights + h)

zbx_interval = rg.Interval(0, all_bx_heights)
zbx2_interval = rg.Interval(-300, 0)

B = rg.Box(rg.Plane.WorldXY, x_interval, y_interval, z_interval)

Bx = [rg.Box(rg.Plane.WorldXY, x_interval, y_interval, zbx_interval)]

Bx.append(rg.Box(rg.Plane.WorldXY, x_interval, y_interval, zbx2_interval))

C = gh.BrepWireframe(B, -1)

st["foam_block"] = B

print st["foam_block"]
# ---------- end python_6 ----------

python_7 = PythonScript(tool=cardan_tool_vs04, T=tool_2)  # -> base, axisA, axisB, tcp_plane; inputs tool: list, T: list
# ---------- python_7: Python ----------
from scriptcontext import sticky as st
import Rhino.Geometry as rg
from copy import deepcopy

G, ur_tcp, tcp_plane = T

base = [0, 4, 5, 7]
base = [tool[x] for x in base]
axisA = tool[1]
axisB = tool[2]

print tcp_plane



st["ur1_tool_geo_detail"] = [base, axisA, axisB]
st["ur2_tool_geo_detail"] = [base, axisA, axisB]
# ---------- end python_7 ----------
brep_2 = Brep([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])
brep_3 = Brep(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)
rad = Radians(Degrees=Slider(52, range=-100..100))
rad_2 = Radians(Degrees=Slider(-2, range=-100..100))
panel_3 = Panel(rad)

# ----
# Setup base
colour_swatch_4 = ColourSwatch(SwatchColor=RGBA(161, 161, 161, 100))

colour_swatch_5 = ColourSwatch(SwatchColor=RGB(66, 66, 66))
pln = Plane(python_7.tcp_plane)
geo_2 = Geometry(python_7.base)
# new block
panel_4 = Panel(rad_2)
preview_7 = CustomPreview(Geometry=brep_2, Shader=ColourSwatch(SwatchColor=RGBA(209, 209, 209, 100)))
python_8 = PythonScript(tcp_plane=python_7.tcp_plane, axisA=python_7.axisA, axisB=python_7.axisB, angleA=rad, angleB=rad_2)  # -> axisA, axisB, plane, A, V
# ---------- python_8: Python ----------
import Rhino.Geometry as rg
from copy import deepcopy

R1 = rg.Transform.Rotation(angleA, tcp_plane.ZAxis, tcp_plane.Origin)

xvec = deepcopy(tcp_plane.XAxis)
yvec = deepcopy(tcp_plane.YAxis)
zvec = deepcopy(tcp_plane.ZAxis)

axisA.Transform(R1)

xvec.Transform(R1)
yvec.Transform(R1)

R2 = rg.Transform.Rotation(angleB, xvec, tcp_plane.Origin)

axisB.Transform(R2 * R1)

yvec.Transform(R2)
zvec.Transform(R2)

plane = rg.Plane(tcp_plane.Origin, xvec, yvec)

A = tcp_plane.Origin
V = - plane.YAxis * 50
# ---------- end python_8 ----------
foam = CustomPreview(Geometry=python_6.Bx, Shader=ColourSwatch(SwatchColor=RGB(212, 212, 212)))
foam_2 = CustomPreview(Geometry=python_6.B, Shader=ColourSwatch(SwatchColor=RGBA(71, 71, 71, 25)))
# Calculate edge curves
python_9 = PythonScript(V=python_8.V, tcp_plane=python_7.tcp_plane)  # -> angleA, angleB
# ---------- python_9: Python ----------
import Rhino.Geometry as rg
import math
from copy import deepcopy

""" 
We want to rotate the tool so that the handle orients in V
V is the yaxis of our plane, we still need an other axis
"""

# 1. we create a plane with normal is the yaxis

V = -V
v = V/V.Length

""" We want to measure the angle between 2 planes:
1nd plane is the plane that is spanned by the original yaxis and the original zaxis.
2nd plane is the one that is spaned by V and the original zaxis.
angle between 2 planes is the same as angle between their normals """

pl1 = rg.Plane(tcp_plane.Origin, tcp_plane.YAxis, tcp_plane.ZAxis)
pl2= rg.Plane(tcp_plane.Origin, v, tcp_plane.ZAxis)


def signed_angle(v1, v2, normal=None):
    """ This function returns the signed angle between v1 and v2.
    To get the sign of this angle, we rotate v1 about the normal 
    with the calculated angle and check wheater it has the same direction as v2."""
    
    dot = v1 * v2
    dot = max(-1, min(dot, 1)) # clamp between -1 and 1
    angle_radians = math.acos(dot)
    if not normal: # we cannot calculate if it is signed or not
        return angle_radians
    else:
        vec1, vec2 = deepcopy(v1), deepcopy(v1)
        vec1.Rotate(+ angle_radians, normal)
        vec2.Rotate(- angle_radians, normal)
        d1 = (vec1/vec1.Length - v2/v2.Length).Length
        d2 = (vec2/vec2.Length - v2/v2.Length).Length
        if d1 > d2: # vec must be v2
            angle_radians *= -1
    return angle_radians

angleA = signed_angle(pl1.ZAxis, pl2.ZAxis, tcp_plane.ZAxis)

""" since we know now the rotation about the first axis, 
we can transform the plane to get the next rotation, with the same principle """

R1 = rg.Transform.Rotation(angleA, tcp_plane.ZAxis, tcp_plane.Origin)
tcp_plane_R1 = deepcopy(tcp_plane)
tcp_plane_R1.Transform(R1)

pl1 = rg.Plane(tcp_plane_R1.Origin, tcp_plane_R1.YAxis, tcp_plane_R1.XAxis)
pl2 = rg.Plane(tcp_plane_R1.Origin, v, tcp_plane_R1.XAxis)

angleB = signed_angle(pl1.ZAxis, pl2.ZAxis, tcp_plane_R1.XAxis)

print "angleA", angleA
print "angleB", angleB
# ---------- end python_9 ----------
panel_5 = Panel(python_9.angleA)
panel_6 = Panel(python_9.angleB)
pln_2 = Plane(python_8.plane)
vdis_2 = VectorDisplay(Anchor=python_8.A, Vector=python_8.V)

# ==== cluster Globals
default_ur1_plane = Plane(Plane(origin=(0, 0, 0), x=(0, -1, 0), y=(1, 0, 0)))
default_ur2_plane = Plane(Plane(origin=(0, 0, 0), x=(0, 1, 0), y=(-1, 0, 0)))
distance_tcp_wire = Number(155)
# UR robot script specifics
default_ur2_plane_2 = Plane(Plane(origin=(0, 0, 0), x=(0, -1, 0), y=(1, 0, 0)))
arduino_in = Integer(8)
ur1_sync_in = Integer(0)
ur2_sync_in = Integer(0)
ur2_sync_out = Integer(1)
default_ur1_plane_2 = Plane(Plane(origin=(0, 0, 0), x=(0, 1, 0), y=(-1, 0, 0)))
ur1_arduino_out = Integer(3)
ur2_arduino_out = Integer(0)
ur1_sync_out = Integer(2)
ur1_ip = ValueList({"10.0.0.11", "10.0.0.12", "192.168.10.43"}, selected="10.0.0.11")
ur2_ip = ValueList({"10.0.0.11", "10.0.0.12", "192.168.10.43"}, selected="10.0.0.12")
gh_ip = ClusterInput()
server_ip = ClusterInput()
_30003 = Number(30003)
_30002 = Number(30002)
python = PythonScript(
    server_ip=server_ip,
    server_port=_30003,
    gh_ip=gh_ip,
    ur1_ip=ur1_ip,
    ur2_ip=ur2_ip,
    ur_send_port=_30002,
    default_ur1_plane=default_ur1_plane_2,
    default_ur2_plane=default_ur2_plane_2,
    arduino_in=arduino_in,
    ur1_arduino_out=ur1_arduino_out,
    ur2_arduino_out=ur2_arduino_out,
    ur1_sync_in=ur1_sync_in,
    ur1_sync_out=ur1_sync_out,
    ur2_sync_in=ur2_sync_in,
    ur2_sync_out=ur2_sync_out,
    distance_TCP_wire=distance_tcp_wire)  # inputs server_port: Int32, ur_send_port: Int32, default_ur1_plane: Plane, default_ur2_plane: Plane, arduino_in: Int32, ur2_arduino_out: Int32, ur1_sync_in: Int32, ur1_sync_out: Int32, ur2_sync_in: Int32, ur2_sync_out: Int32
# ---------- python: Python ----------
from scriptcontext import sticky as st

st["server_ip"] = server_ip
st["server_port"] = server_port

st["gh_ip"] = gh_ip

print gh_ip
print server_ip

st["ur1_ip"] = ur1_ip
st["ur2_ip"] = ur2_ip

print "ur1_ip", ur1_ip
print "ur2_ip", ur2_ip

st["default_ur1_plane"] = default_ur1_plane
st["default_ur2_plane"] = default_ur2_plane

st["ur_send_port"] = ur_send_port

print default_ur1_plane
print default_ur2_plane


st["arduino_in"] = arduino_in

st["ur1_arduino_out"] = ur1_arduino_out
st["ur2_arduino_out"] = ur2_arduino_out

print st["ur1_arduino_out"]
print st["ur2_arduino_out"]

st["ur1_sync_in"] = ur1_sync_in
st["ur1_sync_out"] = ur1_sync_out
st["ur2_sync_in"] = ur2_sync_in
st["ur2_sync_out"] = ur2_sync_out

st["distance_TCP_wire"] = distance_TCP_wire

print st["distance_TCP_wire"] 

# if we change server_ip, gh_client should be recreated
if "gh_client" in st and "gh_client_running" in st:
    if st["gh_client_running"]:
        st["gh_client"].close()
    del(st["gh_client"])
    st["gh_client_running"] = False
# ---------- end python ----------

# ==== cluster UR5Model
j1 = Curve(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)
j2 = Curve(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)
j3 = Curve(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)
j4 = Curve(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)
j5 = Curve(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)
j6 = Curve(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)
py = PythonScript(j2=j2)  # -> workspace
# ---------- py: Python ----------
import Rhino.Geometry as rg

workspace_center = j2.PointAtStart
workspace_radius = 931.780399290

WS = rg.Sphere(workspace_center, workspace_radius)

plane = rg.Plane.WorldXY
plane.Origin = workspace_center - plane.ZAxis * workspace_radius
C = rg.Cylinder(rg.Circle(plane,110), workspace_radius * 2)

workspace = rg.Brep.CreateBooleanDifference(rg.Brep.CreateFromSphere(WS), rg.Brep.CreateFromCylinder(C, True, True), 0.1)[0]
# ---------- end py ----------
ur5_tp = Plane(PlaneXZ(-817.25, -191.45, -5.491))
ur5_geo = Geometry([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])
ur5_axes = Curve([j1, j2, j3, j4, j5, j6])
ur5_workspace = Geometry(py)
ur5_geo_2 = ClusterOutput(ur5_geo)
ur5_axes_2 = ClusterOutput(ur5_axes)
ur5_tp_2 = ClusterOutput(ur5_tp)
ur5_workspace_2 = ClusterOutput(ur5_workspace)
py_2 = PythonScript(Ax=ur5_axes, G=ur5_geo, TP=ur5_tp, WS=py)  # inputs Ax: list, G: list
# ---------- py_2: Python ----------
from scriptcontext import sticky as st

st["ur_axes"] = Ax
st["ur_geo"] = G
st["ur_tool_plane"] = TP
st["ur_workspace"] = WS

print st["ur_axes"]
print st["ur_geo"]
print st["ur_tool_plane"]
# ---------- end py_2 ----------

# ==== cluster SetRCS
ur = ClusterInput()
pl = ClusterInput()
G = ClusterInput()
ax = ClusterInput()
tp = ClusterInput()
ws = ClusterInput()
set_rcs = PythonScript(UR=ur, Pl=pl, G=G, Ax=ax, TP=tp, WS=ws)  # -> URgeo; inputs Pl: Plane, G: list of GeometryBase, Ax: list of Curve, TP: Plane
# ---------- set_rcs: Python ----------
import ghpythonlib.components as ghcomp
import Rhino.Geometry as rg
from scriptcontext import sticky as st

"Compute transform"
print Pl
T_R2W = rg.Transform.PlaneToPlane(Pl, rg.Plane.WorldXY)

print  T_R2W
rc, T_W2R = T_R2W.TryGetInverse()

G = ghcomp.Transform(G, T_R2W)
Ax = ghcomp.Transform(Ax, T_R2W)
TP = ghcomp.Transform(TP, T_R2W)
WS = ghcomp.Transform(WS, T_R2W)


URgeo = [G, Ax, TP, WS]


st["%s_plane" % UR] = Pl
st["%s_transW2R" % UR] = T_W2R
st["%s_transR2W" % UR] = T_R2W
st["%s_all_geometry" % UR] = URgeo
# ---------- end set_rcs ----------
urgeo = ClusterOutput(set_rcs)

# ==== cluster URPoses
ur = ClusterInput()
pts = ClusterInput()
ur_poses = PythonScript(UR=ur, pts=pts)  # -> planes_WCS, planes_RCS, planes_RCS_minTPT, poses; inputs pts: list of Point3d
# ---------- ur_poses: Python ----------
from scriptcontext import sticky as st
import Rhino.Geometry as rg
from ur_robot.transformations import planeWCS_to_planeRCS, ur_pose_from_plane, get_planeRCS_without_tool

tcp_plane = st["%s_tcp_plane" % UR]
default_plane = st["default_%s_plane" % UR]
transW2R = st["%s_transW2R" % UR] 

planes_RCS = []
planes_RCS_minTPT = []
planes_WCS = []
poses = []

for i, pt in enumerate(pts):
    
    # planes in World Coordinate System
    plane = rg.Plane(pt, default_plane.XAxis, default_plane.YAxis)
    planes_WCS.append(rg.Plane(plane.Origin, plane.XAxis, plane.YAxis))
    
    # planes in Robot Coordinate System
    plane.Transform(transW2R)
    plane_RCS = rg.Plane(plane.Origin, plane.XAxis, plane.YAxis)
    planes_RCS.append(plane_RCS)
    
    # planes in Robot Coordinate System without Tool Transformation
    plane_RCS_minTPT = get_planeRCS_without_tool(plane_RCS, tcp_plane)
    planes_RCS_minTPT.append(plane_RCS_minTPT)
    
    # poses for URs 
    poses.append(ur_pose_from_plane(plane_RCS))
# ---------- end ur_poses ----------
planes_wcs = ClusterOutput(ur_poses.planes_WCS)
planes_rcs = ClusterOutput(ur_poses.planes_RCS)
planes_rcs_mintpt = ClusterOutput(ur_poses.planes_RCS_minTPT)
poses = ClusterOutput(ur_poses.poses)

# ==== cluster Cluster
crvb = ClusterInput()
crva = ClusterInput()
lcrv = ClusterInput()
division = ClusterInput()
division_2 = Number(division)
crvb_2 = Curve(crvb)
crva_2 = Curve(crva)
lcrv_2 = Curve(lcrv)
divide = DivideCurve(Curve=crva_2, Count=division_2, Kinks=False)  # -> Points, Tangents, Parameters
divide_2 = DivideCurve(Curve=crvb_2, Count=division_2, Kinks=False)  # -> Points, Tangents, Parameters
py = PythonScript(looseness_crv=lcrv_2, N=division_2)  # -> L, lines
# ---------- py: Python ----------
import Rhino.Geometry as rg
import ghpythonlib.components as ghcomp
import math

dL = (looseness_crv.PointAtEnd - looseness_crv.PointAtStart).Length
dV = (looseness_crv.PointAtEnd - looseness_crv.PointAtStart)/dL

PX, TX, tX = ghcomp.DivideCurve(rg.Line(looseness_crv.PointAtStart, looseness_crv.PointAtEnd), N, False)

tpx = TX[0]
tpx.Rotate(math.radians(90), rg.Vector3d.ZAxis)

""" Measure the height in every point """
lines = []
L = []

for px in PX:
    lx = rg.LineCurve(px, px + tpx * 1000)
    I = rg.Intersect.Intersection.CurveCurve(looseness_crv, lx, 0.1, 0.1)
    ip = I[0].PointA
    lines.append(rg.Line(px, ip))
    L.append((px - ip).Length)


if math.fabs(L[0]) > .1 or math.fabs(L[-1]) > .1:
    raise Exception("Please have start and end always at 0.")
# ---------- end py ----------
L = Data(py.L)
pb = Point(divide_2.Points)
pa = Point(divide.Points)
python = PythonScript(PA=pa, PB=pb, L=L)  # -> LX; inputs PA: list, PB: list, L: list
# ---------- python: Python ----------
LX = []
for pA, pB, l in zip(PA, PB, L):
    LX.append((pA - pB).Length + l)
# ---------- end python ----------
pa_2 = ClusterOutput(pa)
pb_2 = ClusterOutput(pb)
lx = ClusterOutput(python)

# ==== cluster Transform
ur = ClusterInput()
joints = ClusterInput()
tangents = ClusterInput()
cy_radius = ClusterInput()
cy_length = ClusterInput()
python = PythonScript(UR=ur, joints=joints, tangents=tangents, cy_radius=cy_radius, cy_length=cy_length)  # -> robot; inputs joints: list, tangents: list
# ---------- python: Python ----------
import Rhino.Geometry as rg
import math
from ur_robot.transformations import apply_joint_rotation
from ur_robot.transformations.cardan_joint_kinematic import inverse as inverse_cardan_joint, forward as forward_cardan_joint
from copy import deepcopy
from scriptcontext import sticky as st
import ghpythonlib.components as ghcomp

URgeo = st["%s_all_geometry" % UR]
ur_plane = st["%s_plane" % UR]
base, axisA, axisB = st["%s_tool_geo_detail" % UR]
tcp_plane = st["%s_tcp_plane" % UR]

G, Ax, TP, WS = URgeo

robot = []

for q, tangent in zip(joints, tangents):

    Gt, Axt, TPt = apply_joint_rotation(G, Ax, TP, q)
    
    # transform the detailed tool geometry
    T = rg.Transform.ChangeBasis(TPt, rg.Plane.WorldXY) 
    
    base_trans = ghcomp.Transform(base, T)
    axisA_trans = ghcomp.Transform(axisA, T)
    axisB_trans  = ghcomp.Transform(axisB, T)
    tcp_plane_trans = ghcomp.Transform(tcp_plane, T)
    
    # get the angles
    angleA, angleB = inverse_cardan_joint(tcp_plane_trans, -tangent)
    # get the rotation matrix
    R1, R2, pl = forward_cardan_joint(tcp_plane_trans, angleA, angleB)
    
    axisA_trans = ghcomp.Transform(axisA_trans, R1)
    axisB_trans = ghcomp.Transform(axisB_trans, R2)
    
    cy = rg.Cylinder(rg.Circle(rg.Plane(pl.Origin, -pl.YAxis), cy_radius), cy_length)
    
    robot.append(Gt + base_trans + [axisA_trans, axisB_trans, cy])
# ---------- end python ----------
robot = ClusterOutput(python)
