# Grasshopper definition 151126_Move_IF_simple_mesh_with_limits.gh (Grasshopper 0.9.76)
# plug-ins: Python Interpreter

j2 = Plane(Plane(origin=(175, 0, 495), x=(0, 0, 1), y=(1, 0, 0)))
j6 = Plane(Plane(origin=(1581, 0, 1765), x=(-1.94917184e-05, 1.016258774e-11, -0.9999999998), y=(-2.075117433e-05, 0.9999999998, 4.146386344e-10)))
j1 = Plane(PlaneXY(-1.185867404e-09, 0, 0))
j3 = Plane(Plane(origin=(175, 0, 1590), x=(0, 0, 1), y=(1, 0, 0)))
j4 = Plane(Plane(origin=(175, 0, 1765), x=(0, 0, -1), y=(0, 1, 0)))
j5 = Plane(Plane(origin=(1446, 0, 1765), x=(0, 0, 1), y=(1, 0, 0)))
base = Mesh([<mesh referenced from the Rhino model> x2])
l1 = Mesh(<mesh referenced from the Rhino model>)
l2 = Mesh(<mesh referenced from the Rhino model>)
l3 = Mesh(<mesh referenced from the Rhino model>)
l4 = Mesh(<mesh referenced from the Rhino model>)
l5 = Mesh(<mesh referenced from the Rhino model>)
l6 = Mesh(<mesh referenced from the Rhino model>)
mesh = Mesh([l1, l2, l3, l4, l5, l6])
pln = Plane([j1, j2, j3, j4, j5, j6])
base_2 = Mesh(<mesh referenced from the Rhino model>)
pln_2 = Plane(Plane(origin=(-130.0301514, -74.99937439, 515), x=(0.8660254038, 0.5, 0), y=(0.5, -0.8660254038, 0)))
ifjointtransformation = PythonScript(joint_planes=pln, base_geo=base, link_geo=mesh, tool_geo=base_2, tool_plane=pln_2)  # -> out, ifjointtransform; inputs joint_planes: list of Plane, base_geo: list of Mesh, link_geo: list of Mesh, tool_geo: Mesh
# ---------- ifjointtransformation: Python ----------
"""
// ///////////////////////////////////// 
// Created on 04.11.2015

// @author: DORF
// /////////////////////////////////////  
"""

import copy
import Rhino.Geometry as rg
import ghpythonlib.components as gh
import math as m 

class IFJointTransformation():
    
    def __init__(self, joint_planes, link_geo, base_geo, tool_geo, tool_plane):
        """ the class is initialized with the joint origins as planes, 
        rotation should be around the respective x-axis of the plane. 
        the link geo is one mesh for one link/tool"""
        
        self.joint_planes = joint_planes
        self.link1, self.link2, self.link3, self.link4, self.link5, self.link6 = link_geo
        self.base_geo = base_geo
        
        self.tool_geo = tool_geo
        self.tool_plane = tool_plane
        
        self.tool_T = rg.Transform.PlaneToPlane(tool_plane, rg.Plane.WorldXY)
        self.tool_geo_trfd = gh.Transform(tool_geo, self.tool_T)
        
    def apply_joint_rotation(self, joint_values, with_tool = True):
                # the angles in radians
        joint_values = [m.radians(j) for j in joint_values]
        a1, a2, a3, a4, a5, a6 = joint_values
        
        # calculate transformations
        j1, j2, j3, j4, j5, j6 = [rg.Plane(jp) for jp in self.joint_planes]
        
        T1 = rg.Transform.Rotation(a1, j1.ZAxis, j1.Origin)
        T2 = T1 * rg.Transform.Rotation(a2, j2.ZAxis, j2.Origin)
        T3 = T2 * rg.Transform.Rotation(a3, j3.ZAxis, j3.Origin)
        T4 = T3 * rg.Transform.Rotation(a4, j4.ZAxis, j4.Origin)
        T5 = T4 * rg.Transform.Rotation(a5, j5.ZAxis, j5.Origin)
        T6 = T5 * rg.Transform.Rotation(a6, j6.ZAxis, j6.Origin)
        
        link1_t = gh.Transform(self.link1, T1)
        link2_t = gh.Transform(self.link2, T2)
        link3_t = gh.Transform(self.link3, T3)
        link4_t = gh.Transform(self.link4, T4)
        link5_t = gh.Transform(self.link5, T5)
        link6_t = gh.Transform(self.link6, T6)
        
        tp = gh.Transform(rg.Plane(j6), T6)
        
        tool_geo = gh.Transform(self.tool_geo, rg.Transform.PlaneToPlane(rg.Plane.WorldXY, tp))
        
        return [link1_t, link2_t, link3_t, link4_t, link5_t, link6_t, tool_geo] if with_tool else [link1_t, link2_t, link3_t, link4_t, link5_t, link6_t]
    

ifjointtransform = IFJointTransformation(joint_planes, link_geo, base_geo, tool_geo, tool_plane)
# ---------- end ifjointtransformation ----------
a4 = Slider(-96.552, range=-400..400)
a1 = Slider(-0.348, range=-180..180)
a2 = Slider(25.043, range=-90..150)
a3 = Slider(-55.826, range=-180..75)
a5 = Slider(0, range=-125..120)
a6 = Slider(0, range=-400..400)
c_script = CSharpScript(angles=[a1, a2, a3, a4, a5, a6], b=Button())  # -> out; inputs angles: list of Double, b: Boolean
# ---------- c_script: C# ----------
    //double[] joint_angles = new double[6]{0.0, 0.0, 0.0, 0.0, 0.0, 0.0};
    //double[] joint_angles = new double[6]{90.0, -90.0, 90.0, -90.0, -90.0, -45.0};
    double[] joint_angles = new double[9]{0.0, 0.0, 0.0, 0.0, 0.0, 0.0, 0.0, 0.0, 0.0};
    int i = 0;
    if(b == true){
      try {
        foreach(IGH_Param src in Component.Params.Input[0].Sources){
          Grasshopper.Kernel.Special.GH_NumberSlider nslider = (Grasshopper.Kernel.Special.GH_NumberSlider) src;
          nslider.SetSliderValue((decimal) joint_angles[i]);
          i++;
        }
      } catch
      {

      }
    }
# ---------- end c_script ----------
python = PythonScript(ifjt=ifjointtransformation.ifjointtransform, a1=a1, a2=a2, a3=a3, a4=a4, a5=a5, a6=a6)  # -> link_geo, tool_geo, base_geo, track_geo
# ---------- python: Python ----------
geo = ifjt.apply_joint_rotation([a1, a2, a3, a4, a5, a6])

link_geo = geo[:6]
tool_geo = geo[6]
base_geo, track_geo = ifjt.base_geo

print link_geo
# ---------- end python ----------
preview = CustomPreview(Geometry=python.link_geo, Shader=ColourSwatch(SwatchColor=RGBA(148, 168, 168, 160)))
preview_2 = CustomPreview(Geometry=python.tool_geo, Shader=ColourSwatch(SwatchColor=RGBA(255, 231, 150, 160)))
preview_3 = CustomPreview(Geometry=python.base_geo, Shader=ColourSwatch(SwatchColor=RGBA(187, 199, 191, 158)))
preview_4 = CustomPreview(Geometry=python.track_geo, Shader=ColourSwatch(SwatchColor=RGBA(38, 43, 40, 160)))
