# Grasshopper definition 160126_CameraAnimation.gh (Grasshopper 0.9.76)

# ----
# CAMERA
# ANIMATION
total_number_of_frames = Slider(1000, range=0..1000)
animation_slider = Slider(999, range=0..999)
dom = Domain(DomainStart=0, DomainEnd=1)
frames = Receiver(total_number_of_frames)
range = Range(Domain=dom, Steps=frames)
camera_path = Curve(<curve referenced from the Rhino model>)
target_path = Curve(<curve referenced from the Rhino model>)
graph = GraphMapper(range, x0=0, x1=1, y0=0, y1=1, container_name="Bezier", cpx=[0, 0.4522388577, 0.5835821629, 1], cpy=[0, 0, 1, 1])
domcomp = DomainComponents(Domain=camera_path)  # -> Start, End
multiplication = Multiplication(A=domcomp.End, B=graph)
frames_2 = Receiver(total_number_of_frames)
eval = EvaluateCurve(Curve=camera_path, Parameter=multiplication)  # -> Point, Tangent, Angle
divide = DivideCurve(Curve=target_path, Number=expr("x-1", frames_2), Kinks=False)  # -> Points, Tangents, Parameters
frame_number = Receiver(animation_slider)
item = ListItem(List=divide.Points, Index=frame_number, Wrap=True)
item_2 = ListItem(List=eval.Point, Index=frame_number, Wrap=True)
vcomp = Decompose(Vector=eval.Tangent)  # -> XComponent, YComponent, ZComponent
vec = VectorXYZ(XComponent=0, YComponent=vcomp.YComponent, ZComponent=vcomp.ZComponent)  # -> Vector, Length
camera = CSharpScript(location=item_2, target=item, upVector=vec.Vector)  # -> out, A; inputs location: Point3d, target: Point3d, upVector: Vector3d
# ---------- camera: C# ----------
    Rhino.Display.RhinoView view = doc.Views.ActiveView;

    Rhino.Display.RhinoViewport vp = view.ActiveViewport;

    vp.CameraUp = upVector;
    vp.SetCameraLocation(location, false);
    vp.SetCameraDirection(target - location, true);
# ---------- end camera ----------
