# Grasshopper definition AnimatedCamera (1).ghx (Grasshopper 0.8.7)

# Instructions: 1.  Set "Target Path" to a rhino curve.  This is the path along which the camera's target will move.
# 
# 2. Set "Camera Path" to a rhino curve.  This is the path along which the camera itself will move.
# 
# 3. Set the total number of frames
# 
# 4. Enable the Camera button.  It will move the active view in Rhino to the correct position along the camera path.
# 
# 5. Run the animation by animating the Animation Slider (right-click on it).
target_path = Curve(<curve referenced from the Rhino model>)
camera_path = Curve(<curve referenced from the Rhino model>)
animation_slider = Slider(100, range=0..100)
total_number_of_frames = Slider(100, range=0..100)
frames = Receiver(total_number_of_frames)
dom = Domain(DomainStart=0, DomainEnd=1)
range = Range(Domain=dom, Steps=frames)
camera_path_2 = Receiver(camera_path)
# Graph Mapper: The graph mapper basically slows the camera down at the beginning and end of the animation
graph = GraphMapper(range, x0=0, x1=1, y0=0, y1=1, container_name="Bezier", cpx=[0, 0.4522388577, 0.5835821629, 1], cpy=[0, 0, 1, 1])
domcomp = DomainComponents(Domain=camera_path_2)  # -> Start, End
multiplication = Multiplication(A=domcomp.End, B=graph)
target_path_2 = Receiver(target_path)
frames_2 = Receiver(total_number_of_frames)
frame_number = Receiver(animation_slider)
eval = EvaluateCurve(Curve=camera_path_2, Parameter=multiplication)  # -> Point, Tangent, Length
divide = DivideCurve(Curve=target_path_2, Number=expr("n-1", frames_2), Kinks=False)  # -> Points, Tangents, Parameters
item = ListItem(List=eval.Point, Index=expr("i-1", frame_number), Wrap=False)
item_2 = ListItem(List=divide.Points, Index=expr("i-1", frame_number), Wrap=False)
vcomp = Decompose(Vector=eval.Tangent)  # -> XComponent, YComponent, ZComponent
vec = VectorXYZ(XComponent=0, YComponent=vcomp.YComponent, ZComponent=vcomp.ZComponent)  # -> Vector, Length
camera = CSharpScript(location=item, target=item_2, upVector=vec.Vector)  # -> out, A; inputs location: Point3d, target: Point3d, upVector: Vector3d; disabled
# ---------- camera: C# ----------
    Rhino.Display.RhinoView view = doc.Views.ActiveView;

    Rhino.Display.RhinoViewport vp = view.ActiveViewport;

    vp.CameraUp = upVector;
    vp.SetCameraLocation(location, false);
    vp.SetCameraDirection(target - location, true);
# ---------- end camera ----------
