# Grasshopper definition TestInvoke.gh (Grasshopper 0.9.59)

enable = BooleanToggle(True)
vb = VBScript(Enable=enable)  # -> out, A
# ---------- vb: VB ----------
    If (Enable) Then
      abort = False
    Else
      abort = True
    End If

    If (Enable AndAlso thread Is Nothing) Then
      thread = New System.Threading.Thread(AddressOf CheckFile)
      thread.Name = "Asynchronous file checker"
      thread.IsBackground = True
      thread.Priority = System.Threading.ThreadPriority.BelowNormal
      thread.Start()
    End If

    A = content
# ---------- vb: VB additional code ----------
  Private abort As Boolean = True
  Private content As String = Nothing
  Private thread As System.Threading.Thread = Nothing

  Private Sub ExpireComponent()
    If (Component Is Nothing) Then Return
    Component.ExpireSolution(True)
  End Sub
  Private Sub CheckFile()
    Dim file As String = "C:\testfile.txt"
    Do
      'This abort flag allows some external function to short-circuit this logic.
      If (abort) Then
        thread = Nothing
        Return
      End If

      Try
        'Test to see if a specific file exists.
        If (System.IO.File.Exists(file)) Then
          'If it does exist, read the contents, delete the file and trigger a new solution.
          content = System.IO.File.ReadAllText(file)
          System.IO.File.Delete(file)
          thread = Nothing

          'Invoke the component on the main UI thread.
          Dim dlg As Action = AddressOf ExpireComponent
          Rhino.RhinoApp.MainApplicationWindow.Invoke(dlg)
          Return
        End If
      Catch Ex As Exception
      End Try

      'If the file doesn't exist, pause this thread for some time to avoid checking too often.
      Threading.Thread.Sleep(50)
    Loop
  End Sub
# ---------- end vb ----------
panel = Panel(vb.A)
