# Grasshopper definition anim_slider_cont.gh (Grasshopper 0.9.76)
# plug-ins: Python Interpreter

reset = Button()
run = BooleanToggle(False)
list = ValueList({"100", "200", "500"}, selected="500")
list_2 = ValueList({"20", "50", "100", "500"}, selected="50")
python = PythonScript(run=run, reset=reset, count=list, timer_speed=list_2)  # -> C; inputs count: Int32, timer_speed: Int32
# ---------- python: Python ----------
from scriptcontext import sticky as st
import Grasshopper as gh

guid = str(ghenv.Component.InstanceGuid)

counter_key = "counter_" + guid
anchors = "anchors_" + guid
length = count


def ghComponentTimer(run,interval):
    """ Update the component at the interval like using a GH timer """
    
    # Ensure interval is larger than zero
    if interval <= 0:
        interval = 1
        
    # Get the Grasshopper document and component that owns this script
    ghComp = ghenv.Component
    ghDoc = ghComp.OnPingDocument()
    
    # Define the callback function
    def callBack(ghDoc):
        ghComp.ExpireSolution(False)
        
    # Update the solution
    if run:
        ghDoc.ScheduleSolution(interval, gh.Kernel.GH_Document.GH_ScheduleDelegate(callBack))


if reset or counter_key not in st:
    st[counter_key] = 0

else:
    if run:
        if st[counter_key] < length - 1:
            ghComponentTimer(run, timer_speed)
            st[counter_key] += 1
        else:
            st[counter_key] = 0
            ghComponentTimer(run, timer_speed)
            

C = st[counter_key]
# ---------- end python ----------
idx = Panel(python)
python_2 = PythonScript(c=idx, to_num=list)  # -> out, c; inputs c: Int32
# ---------- python_2: Python ----------
def map_range(value,fromMin,fromMax,toMin,toMax):
    fromSpan = fromMax - fromMin
    toSpan = toMax - toMin
    valueScaled = float(value-fromMin)/float(fromSpan)
    return toMin + (valueScaled * toSpan)
    
    
c = map_range(c, 0, to_num, 1500, 2000)
# ---------- end python_2 ----------
idx_2 = Panel(python_2.c)
