# Grasshopper definition counter_test_for_lukas.gh (Grasshopper 0.9.76)
# plug-ins: Python Interpreter

reset = Button()
run = BooleanToggle(False)
python = PythonScript(run=run, reset=reset)  # -> out, a
# ---------- python: Python ----------
import time
import Rhino as rc
import Grasshopper as gh
from scriptcontext import sticky as st
import Rhino.Geometry as rg


def ghComponentTimer(run,interval):
    
    """ Update the component at the interval like using a GH timer """
    
    # Ensure interval is larger than zero
    if interval <= 0:
        interval = 1
        
    # Get the Grasshopper document and component that owns this script
    ghComp = ghenv.Component
    ghDoc = ghComp.OnPingDocument()
    
    # Define the callback function
    def callBack(ghDoc):
        ghComp.ExpireSolution(False)
        
    # Update the solution
    if run:
        ghDoc.ScheduleSolution(interval,gh.Kernel.GH_Document.GH_ScheduleDelegate(callBack))
        
        

guid = str(ghenv.Component.InstanceGuid)

counter = "counter_" + guid

if counter not in st:
    st[counter] = 0

if run:
    if counter in st:
        st[counter] +=1
    # Update the component
    ghComponentTimer(run, 5)

if reset:
    del st[counter]

if counter in st:
    a = st[counter]
else:
    a = 0
# ---------- end python ----------
multiplication = Multiplication(A=python.a, B=10)
pt = ConstructPoint(XCoordinate=0, YCoordinate=0, ZCoordinate=multiplication)
panel = Panel(python.a)
xy = XYPlane(Origin=pt)
sph = Sphere(Base=xy, Radius=multiplication)
