# Grasshopper definition selfupdate_component_from_within_thread.gh (Grasshopper 0.9.76)
# plug-ins: Python Interpreter

# self update component from within thread
max_value = Slider(5, range=0..10)
timestep = Slider(0.5, range=0..1)
run = Button()
init = PythonScript(max_value=max_value, timestep=timestep, run=run)  # -> counter
# ---------- init: Python ----------
import time
from threading import Thread

class Counter(Thread):
    
    def __init__(self, max_value, timestep):
        Thread.__init__(self)
        self.daemon = False
        
        self.timestep = timestep
        self.current_value = 0
        self.max_value = max_value
        # here we set this component for the one to update
        # must be later overwritten, if desired
        self.ghComp = ghenv.Component
        
    def update_component(self):
        # this updates the component in which Counter was created
        self.ghComp.ExpireSolution(True)
    
    def run(self):
        while True:
            self.current_value += 1
            time.sleep(timestep) # do something different
            self.update_component()
            if self.current_value >= self.max_value:
                break

counter = Counter(max_value, timestep)
counter.start()
# ---------- end init ----------
update = PythonScript(counter=init)  # -> value
# ---------- update: Python ----------
# here we tell the counter that this component is the one to update
counter.ghComp = ghenv.Component

value = counter.current_value
# ---------- end update ----------
panel = Panel(update)
