# Grasshopper definition selfupdate_component_from_within_thread_testkd.gh (Grasshopper 0.9.76)
# plug-ins: Python Interpreter

# self update component from within thread
max_value = Slider(10, range=0..10000)
timestep = Slider(0.5, range=0..1)
toggle = BooleanToggle(False)
run = Button()
init = PythonScript(max_value=max_value, timestep=timestep, run=run)  # -> out, counter
# ---------- init: Python ----------
import time
from threading import Thread
import Rhino

import time
import Grasshopper as gh
from scriptcontext import sticky as st
import Rhino.Geometry as rg

#from Grasshopper.GH_InstanceServer.ActiveCanvas.Invoke(ghComp.ExpireSolution(False))
#Grasshopper.GH_InstanceServer.ActiveCanvas.Invoke(new Action/span>bool>(currentGHComponent.ExpireSolution), new object[] { false })


class Counter(Thread):
    
    def __init__(self, max_value, timestep):
        Thread.__init__(self)
        self.daemon = False
        
        self.timestep = timestep
        self.current_value = 0
        self.max_value = max_value
        # here we set this component for the one to update
        # must be later overwritten, if desired
        self.ghComp = ghenv.Component
        self.ghDoc = self.ghComp.OnPingDocument()
        print "Hello"
        
    def update_component(self):
        # this updates the component in which Counter was created
        print "Hello1"
        #Grasshopper.GH_InstanceServer.ActiveCanvas.Invoke(self.ghComp.ExpireSolution(True))
        """Dim dlg As Action = AddressOf ExpireComponent
        Rhino.RhinoApp.MainApplicationWindow.Invoke(dlg)"""
        #Rhino.RhinoApp.MainApplicationWindow.Invoke(self.ghComp.ExpireSolution(True))
        #Grasshopper.GH_InstanceServer.ActiveCanvas.Invoke()
        #self.ghComp.ExpireSolution(True)
        #self.ghComp.NewSolution(False)
        #GH_Document.NewSolution(False)
        #print Grasshopper.GH_InstanceServer.ActiveCanvas.Invoke(self.ghComp.ExpireSolution(True))
        """print "Hello2"
        def callBack(ghDoc):
            self.ghComp.ExpireSolution(False)
        
        self.ghDoc.ScheduleSolution(1,gh.Kernel.GH_Document.GH_ScheduleDelegate(callBack))
        #self.ghComp.NewSolution(True)"""
        

        if str(self.ghDoc.SolutionState) == "PostProcess":
            
            self.ghComp.ExpireSolution(True)
            Rhino.RhinoApp.WriteLine(str(self.ghDoc.SolutionState))
        else:
            pass
        Rhino.RhinoApp.WriteLine(str(self.ghDoc.SolutionState))
        Rhino.RhinoApp.WriteLine(str(self.current_value))
    
    def run(self):
        while True:
            self.current_value += 1
            time.sleep(timestep) # do something different
            print "Hello0"
            self.update_component()
            if self.current_value >= self.max_value:
                break

counter = Counter(max_value, timestep)
counter.start()
# ---------- end init ----------
update = PythonScript(counter=init.counter)  # -> value
# ---------- update: Python ----------
# here we tell the counter that this component is the one to update
counter.ghComp = ghenv.Component

value = counter.current_value
# ---------- end update ----------
panel = Panel(init.out)
panel_2 = Panel(update)
