# Grasshopper definition slider_animation.gh (Grasshopper 0.9.76)

r1 = Slider(999, range=0..999)
c_script = CSharpScript(sliders=r1)  # inputs sliders: tree
# ---------- c_script: C# ----------
    if (_form != null)
      return;

    _form = new Form();
    _form.FormBorderStyle = FormBorderStyle.FixedToolWindow;
    _form.Size = new Size(300, 200);
    _form.StartPosition = FormStartPosition.Manual;
    _form.Text = "Slider Animator";
    _form.FormClosed += FormClosed;
    Grasshopper.GUI.GH_WindowsFormUtil.CenterFormOnEditor(_form, true);

    Button button = new Button();
    button.Text = "Perform animation";
    button.Tag = Component; // Make the button aware of the script-component that spawned it.
    button.Dock = DockStyle.Fill;
    button.Click += ButtonClick;

    _form.Controls.Add(button);

    _form.Show(Grasshopper.Instances.DocumentEditor);
    Grasshopper.Instances.DocumentEditor.FormShepard.RegisterForm(_form);
# ---------- c_script: C# additional code ----------
  private Form _form;

  private void FormClosed(object sender, EventArgs e)
  {
    _form = null;
  }
  private void ButtonClick(object sender, EventArgs e)
  {
    Button button = sender as Button;
    if (button == null)
      return;

    IGH_Component component = button.Tag as IGH_Component;
    if (component == null)
      return;

    GH_Document doc = component.OnPingDocument();
    if (doc == null)
    {
      button.FindForm().Close();
      return;
    }

    // Collect all sliders that are plugged into the first input parameter of the script component.
    List<Grasshopper.Kernel.Special.GH_NumberSlider> sliders = new List<Grasshopper.Kernel.Special.GH_NumberSlider>();
    foreach (IGH_Param param in component.Params.Input[0].Sources )
    {
      Grasshopper.Kernel.Special.GH_NumberSlider slider = param as Grasshopper.Kernel.Special.GH_NumberSlider;
      if (slider != null)
        sliders.Add(slider);
    }

    if (sliders.Count == 0)
      return;

    button.Text = "Animating sliders...";

    // Start a loop that will run a 100 times.
    for (int i = 0; i <= 1000; i++)
    {
      double norm = 1.0 - i / 1000.0;

      // Adjust slider values.
      for (int k = 0; k < sliders.Count; k++)
      {
        norm = 1.0 - norm;

        Grasshopper.Kernel.Special.GH_NumberSlider slider = sliders[k];
        int tick = (int) (norm * slider.TickCount);
        slider.TickValue = tick;
      }

      // Run a new solution.
      doc.NewSolution(false);
    }

    button.Text = "Perform animation";
  }

  /// <summary>
  /// This method will be called once every solution, before any calls to RunScript.
  /// </summary>
  public override void BeforeRunScript()
  { }
  /// <summary>
  /// This method will be called once every solution, after any calls to RunScript.
  /// </summary>
  public override void AfterRunScript()
  { }
# ---------- end c_script ----------
